# Grasshopper definition 160811_carpenterworm_terrain.gh (Grasshopper 0.9.76)
# plug-ins: Python Interpreter

fib = Fibonacci(SeedA=1, SeedB=1, Number=10)
dom = ConstructDomain(DomainStart=["0", "1"], DomainEnd="0.5")
range = Range(Domain=dom, Steps=10)
lng = ListLength(List=range)
smaller = SmallerThan(FirstNumber=fib, SecondNumber=lng)  # -> SmallerThan, OrEqualTo
sift = SiftPattern(List=fib, SiftPattern=smaller.OrEqualTo)  # -> Output0, Output1
bool = Boolean(sift.Output1)
cull = CullPattern(List=sift.Output1, CullPattern=bool)
neg = Negative(Value=cull)
item = ListItem(List=range, Index=neg, Wrap=True)

dom_2 = ConstructDomain(DomainStart="0", DomainEnd="1")
range_2 = Range(Domain=dom_2, Steps="10")
sin = Sine(Value=range_2)
bnd = Bounds(Numbers=sin)
dom_3 = ConstructDomain(DomainStart="0", DomainEnd="0.5")
num = Number("10")
remap = RemapNumbers(Value=sin, Source=bnd, Target=dom_3)  # -> Mapped, Clipped
subtraction = Subtraction(A="1", B=remap.Mapped)
pt = Point([Point(74.48377238, -63.83578373, 0), Point(65.85991244, -62.97384209, 0), Point(54.51194397, -60.64041139, 0), Point(42.75175652, -57.18719269, 0), Point(32.21520889, -50.41229875, 0), Point(24.25161249, -38.47715174, 0)])
merge = Merge(Data1=remap.Mapped, Data2=subtraction)
nurbs = NurbsCurve(Vertices=pt, Degree=3, Periodic=False)  # -> Curve, Length, Domain
python = PythonScript(curve=nurbs.Curve, n=num)  # -> out, tList, recList_even; inputs n: Int32
# ---------- python: Python ----------
import rhinoscriptsyntax  as rs 
import math

#创建中间密，两边疏的数列
tList1 = [math.sin(i) for i in rs.frange(0,1,1/n)]
tList = []
for t in tList1:
    new_t1 = t/source*0.5
    new_t2 = 1-new_t1
    tList.append(new_t1)
    tList.append(new_t2)
tList = sorted(list(set(tList)))
print (tList)

#偶数点位置建立矩形
recList_even = []
for t in tList:
    pt = rs.EvaluateCurve(curve,t)
    print (pt)
    rec = rs.PlaneFromPoints(pt,(0,0,0),(0,0,0))
    recList_even.append(rec)
# ---------- end python ----------
neg_2 = Negative(Value="3")
sort = SortList(Keys=merge)  # -> Keys, ValuesA
dcon = DeleteConsecutive(Set=sort.Keys, Wrap=False)  # -> Set, Count
eval = EvaluateLength(Curve=nurbs.Curve, Length=python.tList, Normalized=True)  # -> Point, Tangent, Parameter
pframe = PerpFrame(Curve=nurbs.Curve, Parameter=eval.Parameter)
panel = Panel("""0
1""")
multiplication = Multiplication(A="3", B="2.5")
dom_4 = ConstructDomain(DomainStart="3", DomainEnd=neg_2)
dispatch = Dispatch(List=pframe, DispatchPattern=panel)  # -> ListA, ListB
vdis = VectorDisplay(Anchor=eval.Point, Vector=eval.Tangent)
neg_3 = Negative(Value=multiplication)
rectangle = Rectangle(Plane=dispatch.ListB, XSize=dom_4, YSize=neg_3, Radius=0)  # -> Rectangle, Length
