# Grasshopper definition 01_list_04_truss.gh (Grasshopper 0.9.76)

pt = ConstructPoint(XCoordinate="7", YCoordinate=0, ZCoordinate=0)
number_slider = Slider(2.132, range=0..10)
Y = UnitY(Factor=1)
xy = XYPlane(Origin=Point(0, 0, 0))
line = LineSDL(Start=pt, Direction=Y, Length=Slider(15.5, range=0..100))
neg = Negative(Value=number_slider)
offset = Offset(Curve=line, Distance=[neg, number_slider], Plane=xy, Corners=1)  # -> flatten(Curve)
offset_2 = Offset(Curve=line, Distance=[neg, number_slider], Plane=xy, Corners=1)  # -> simplify(Curve)
ext = ExtendCurve(Curve=line, Type=0, Start="1", End="1")
panel = Panel(offset_2)
len = Length(Curve=ext)
end = EndPoints(Curve=ext)  # -> Start, End
number_slider_2 = Slider(1.105, range=0..10)
subtraction = Subtraction(A="15", B="1")
pdecon = Deconstruct(Point=end.Start)  # -> XComponent, YComponent, ZComponent
pdecon_2 = Deconstruct(Point=end.End)  # -> XComponent, YComponent, ZComponent
addition = Addition(A=len, B=Slider(0.36743, range=0..100))
Z = UnitZ(Factor=1)
panel_2 = Panel("""True
False""")
addition_2 = Addition(A=pdecon.ZComponent, B=number_slider_2)
addition_3 = Addition(A=pdecon_2.ZComponent, B=number_slider_2)
merge = Merge()
pt_2 = ConstructPoint(XCoordinate=pdecon_2.XComponent, YCoordinate=pdecon_2.YComponent, ZCoordinate=addition_3)
pt_3 = ConstructPoint(XCoordinate=pdecon.XComponent, YCoordinate=pdecon.YComponent, ZCoordinate=addition_2)
cat = Catenary(PointA=pt_3, PointB=pt_2, Length=addition, Gravity=Z)
dup = DuplicateData(Data=cat, Number=2, Order=True)  # -> simplify(graft(Data))
merge_2 = Merge(Data1=offset_2, Data2=dup)
divide = DivideCurve(Curve=merge_2, Count=subtraction, Kinks=False)  # -> Points, Tangents, Parameters
cull = CullPattern(List=divide.Points, CullPattern=panel_2)
path_mapper = PathMapper(cull, source="{A;B}(i)", target="{A;i}")
path_mapper_2 = PathMapper(path_mapper, source="{A;B}", target="{A}")
subtraction_2 = Subtraction(A="15", B="1")
cat_2 = Catenary(PointA=pt_3, PointB=pt_2, Length=addition, Gravity=Z)
neg_2 = Negative(Value="2")
pline = PolyLine(Vertices=path_mapper_2, Closed=False)
divide_2 = DivideCurve(Curve=cat_2, Count=subtraction_2, Kinks=False)  # -> Points, Tangents, Parameters
divide_3 = DivideCurve(Curve=offset, Count=subtraction_2, Kinks=False)  # -> Points, Tangents, Parameters
shift = ShiftList(List=divide_3.Points, Shift=neg_2, Wrap=False)
shift_2 = ShiftList(List=divide_2.Points, Shift="2", Wrap=False)
bang = ExplodeTree(Data=divide_3.Points)  # -> Branch0, Branch1
bang_2 = ExplodeTree(Data=shift)  # -> Branch0, Branch1
entwine = Entwine(Branch00=bang.Branch0, Branch01=divide_2.Points, Branch02=bang.Branch1, FlattenInputs=True)
entwine_2 = Entwine(Branch00=bang_2.Branch0, Branch01=shift_2, Branch02=bang_2.Branch1, FlattenInputs=True)
panel_3 = Panel("""True
False""")
panel_4 = Panel("""True
False""")
cull_2 = CullPattern(List=entwine, CullPattern=panel_3)
cull_3 = CullPattern(List=entwine_2, CullPattern=panel_4)
flip = FlipMatrix(Data=cull_2)
flip_2 = FlipMatrix(Data=cull_3)
pline_2 = PolyLine(Vertices=flip, Closed=False)
pline_3 = PolyLine(Vertices=flip_2, Closed=False)
panel_5 = Panel(flip)
panel_6 = Panel(entwine_2)
