# Grasshopper definition 160918_haystack_002.gh (Grasshopper 0.9.76)

md_slider = MDSlider(
    slider_value=Point(0.5914634146, 0.6780488549, 0.5),
    SliderMode=0,
    x_domain=Domain(-100, 100),
    y_domain=Domain(-100, 100),
    z_domain=Domain(0, 1))
complex = ComplexComponents(Complex=md_slider)  # -> Real, Imaginary

panel = Panel("""15.4
10.3
15.4
10.3""")
panel_2 = Panel("""0
1
2
3""")

complex_2 = CreateComplex(Real=complex.Real, Imaginary=complex.Imaginary)
panel_3 = Panel("""5
3
5
3""")
item = ListItem(
    List=[{imaginary=0, real=1}, {imaginary=1, real=0}, {imaginary=0, real=-1}, {imaginary=-1, real=0}],
    Index=panel_2,
    Wrap=False)
division = Division(A=panel, B=panel_3)
amp = Amplitude(Vector=item, Amplitude=panel)
pt = Point(complex_2)
stack = StackData(Data=graft(division), Stack=graft(panel_3))
ma = MassAddition(Input=amp)  # -> Result, PartialResults
addition = Addition(A=pt, B=ma.PartialResults)
amp_2 = Amplitude(Vector=graft(item), Amplitude=stack)
ma_2 = MassAddition()  # -> Result, PartialResults
ma_3 = MassAddition(Input=flatten(amp_2))  # -> Result, PartialResults
complex_3 = ComplexComponents(Complex=ma.PartialResults)  # -> Real, Imaginary
panel_4 = Panel(ma.PartialResults)
concat = Concatenate(FragmentA=complex_3.Real, FragmentB=complex_3.Imaginary, JoinSeparator=",")
partition = PartitionList(List=ma_3.PartialResults, Size=panel_3)
addition_2 = Addition(A=pt, B=partition)
panel_5 = Panel(addition_2)

concat_2 = Concatenate(FragmentA=concat, FragmentB=panel_2, JoinSeparator=";")
pline = PolyLine(Vertices=addition, Closed=True)

panel_6 = Panel(concat_2)
panel_7 = Panel(amp_2)
panel_8 = Panel(ma_3.PartialResults)
