# Grasshopper definition 160919_haystack_006.gh (Grasshopper 0.9.76)

panel = Panel("""3
2
3""")
panel_2 = Panel("""5
2
2""")
ma = MassAddition(Input=panel)  # -> Result, PartialResults
ma_2 = MassAddition(Input=panel_2)  # -> Result, PartialResults
series = Series(Start=0, Step=1, Count=ma.Result)
series_2 = Series(Start=0, Step=1, Count=ma_2.Result)
partition = PartitionList(List=series, Size=panel)  # -> simplify(Chunks)
partition_2 = PartitionList(List=series_2, Size=panel_2)  # -> simplify(Chunks)
panel_3 = Panel(partition)
panel_4 = Panel(partition_2)
graft = GraftTree(Tree=partition, IncludeEmptyLists=True, IncludeNullItems=True)
lng = ListLength(List=partition)
lng_2 = ListLength(List=partition_2)
addition = Addition(A=partition, B=partition_2)
addition_2 = Addition(A=graft, B=partition_2)
viewer = ParamViewer(graft)
multiplication = Multiplication(A=lng, B=lng_2)
repeat = RepeatData(Data=partition_2, Length=multiplication)
partition_3 = PartitionList(List=repeat, Size=lng_2)  # -> simplify(Chunks)
viewer_2 = ParamViewer(partition_3)
addition_3 = Addition(A=graft, B=partition_3)

panel_5 = Panel("""5
3
5
3""")
ma_3 = MassAddition(Input=panel_5)  # -> Result, PartialResults
panel_6 = Panel("""1
2
3""")
panel_7 = Panel("""2
3""")
pt = Point(Point(-95.50302731, 3.41775708, 0))
pt_2 = Point(Point(-61.12878793, 5.226927573, 0))
series_3 = Series(Start="10", Step=1, Count=ma_3.Result)
entwine = Entwine(Branch00=panel_6, Branch01=panel_7, Branch02="3", FlattenInputs=True)  # -> simplify(Result)
partition_4 = PartitionList(List=series_3, Size=panel_5)  # -> simplify(Chunks)
ln = Line(StartPoint=pt, EndPoint=pt_2)
panel_8 = Panel(entwine)
divide = DivideCurve(Curve=ln, Count=Slider(4, range=0..10), Kinks=False)  # -> simplify(flatten(Points)), Tangents, Parameters
lng_3 = ListLength(List=divide.Points)
subtraction = Subtraction(A=lng_3, B="1")
addition_4 = Addition(A=partition_4, B=entwine)
series_4 = Series(Start="1", Step=1, Count=subtraction)
shift = ShiftList(List=divide.Points, Shift="-1", Wrap=False)  # -> simplify(flatten(List))
panel_9 = Panel(shift)
panel_10 = Panel(partition_4)
shift_2 = ShiftList(List=divide.Points, Shift=series_4, Wrap=False)  # -> simplify(List)

viewer_3 = ParamViewer()
bang = ExplodeTree()  # -> Branch0, Branch1, Branch2, Branch3
viewer_4 = ParamViewer(bang.Branch0)
dpath = DeconstructPath(Branch=viewer_4)
cull_i = CullIndex(Indices=dpath, Wrap=True)
branch = TreeBranch(Path=cull_i, MaintainPaths=True)

ln_2 = Line(StartPoint=graft(shift), EndPoint=shift_2)
panel_11 = Panel(ln_2)
panel_12 = Panel(addition_4)
tstat = TreeStatistics()  # -> Paths, Length, Count
panel_13 = Panel(shift_2)
panel_14 = Panel("""精确度问题,有限元问题
忽略了一个角""")
md_slider = MDSlider(
    slider_value=Point(0.5853658537, 0.6780488549, 0.5),
    SliderMode=0,
    x_domain=Domain(-100, 100),
    y_domain=Domain(-100, 100),
    z_domain=Domain(0, 1))
repeat_2 = RepeatData(Data=[Slider(20, range=0..100), Slider(15, range=0..100)], Length="4")

panel_15 = Panel("""0
1
2
3""")
panel_16 = Panel(repeat_2)

complex = ComplexComponents(Complex=md_slider)  # -> Real, Imaginary
panel_17 = Panel("""5
3
5
3""")
int = Integer(panel_15)
num = Number(panel_16)
complex_2 = CreateComplex(Real=complex.Real, Imaginary=complex.Imaginary)
panel_18 = Panel("有限元插写")
division = Division(A=num, B=panel_17)
item = ListItem(
    List=[{imaginary=0, real=1}, {imaginary=1, real=0}, {imaginary=0, real=-1}, {imaginary=-1, real=0}],
    Index=int,
    Wrap=False)
panel_19 = Panel(item)
amp = Amplitude(Vector=item, Amplitude=division)
basicpoint = Point(complex_2)
amp_2 = Amplitude(Vector=item, Amplitude=num)
stack = StackData(Data=amp, Stack=panel_17)
ma_4 = MassAddition(Input=amp_2)  # -> Result, PartialResults
ma_5 = MassAddition(Input=stack)  # -> Result, PartialResults
addition_5 = Addition(A=basicpoint, B=ma_4.PartialResults)
complex_3 = ComplexComponents(Complex=ma_4.PartialResults)  # -> Real, Imaginary
partition_5 = PartitionList(List=ma_5.PartialResults, Size=panel_17)  # -> simplify(Chunks)
shift_3 = ShiftList(List=partition_5, Shift=1, Wrap=False)  # -> simplify(List)

shift_4 = ShiftList(List=tstat.Paths, Shift="1", Wrap=False)  # -> simplify(List)
branch_2 = TreeBranch(Tree=shift_3, Path=shift_4, MaintainPaths=True)
viewer_5 = ParamViewer(branch_2)
dpath_2 = DeconstructPath(Branch=viewer_5)
subtraction_2 = Subtraction(A=dpath_2, B="1")
path = ConstructPath(Indices=subtraction_2)  # -> flatten(Branch)
replace = ReplacePaths(Data=branch_2, Search=viewer_5, Replace=path)

panel_20 = Panel(replace)

addition_6 = Addition(A=basicpoint, B=partition_5)
concat = Concatenate(FragmentA=complex_3.Real, FragmentB=complex_3.Imaginary, JoinSeparator=",")
complex_4 = ComplexComponents(Complex=partition_5)  # -> Real, Imaginary
panel_21 = Panel(ma_4.PartialResults)
complex_5 = CreateComplex(Real=complex_4.Real, Imaginary=complex_4.Imaginary)

pline = PolyLine(Vertices=addition_5, Closed=True)
concat_2 = Concatenate(FragmentA=concat, FragmentB=int, JoinSeparator=";")

panel_22 = Panel(concat_2)
miniestlinecount = Integer(Slider(5, range=0..10))
series_5 = Series(Start=0, Step=1, Count=miniestlinecount)
circlecountseed = Integer(Slider(54.95, range=0..100))
circlecount = Integer(Slider(5, range=0..10))
panel_23 = Panel("28")
sidelocateseed = Number(Slider(40.18, range=0..100))

shift_5 = ShiftList(List=complex_5, Shift="-1", Wrap=False)  # -> simplify(List)

tstat_2 = TreeStatistics(Tree=shift_5)  # -> Paths, Length, Count
lng_4 = ListLength(List=tstat_2.Paths)
subtraction_3 = Subtraction(A=lng_4, B="1")
series_6 = Series(Start="1", Step=1, Count=subtraction_3)
shift_6 = ShiftList(List=tstat_2.Paths, Shift=series_6, Wrap=False)  # -> simplify(List)
bang_2 = ExplodeTree(Data=shift_6)  # -> Branch0, Branch1, Branch2
branch_3 = TreeBranch(Tree=shift_5, Path=bang_2.Branch0, MaintainPaths=True)
branch_4 = TreeBranch(Tree=shift_5, Path=bang_2.Branch1, MaintainPaths=True)
branch_5 = TreeBranch(Tree=shift_5, Path=bang_2.Branch2, MaintainPaths=True)
entwine_2 = Entwine(Branch00=branch_3, Branch01=branch_4, Branch02=branch_5, FlattenInputs=True)  # -> simplify(Result)

panel_24 = Panel(shift_5)

shift_7 = ShiftList(List=tstat_2.Paths, Shift="-1", Wrap=False)  # -> simplify(List)
branch_6 = TreeBranch(Tree=shift_5, Path=shift_7, MaintainPaths=True)
graft_2 = GraftTree(Tree=branch_6, IncludeEmptyLists=True, IncludeNullItems=True)
lng_5 = ListLength(List=branch_6)
lng_6 = ListLength(List=entwine_2)
multiplication_2 = Multiplication(A=lng_5, B=lng_6)
repeat_3 = RepeatData(Data=entwine_2, Length=multiplication_2)
partition_6 = PartitionList(List=repeat_3, Size=lng_6)  # -> simplify(Chunks)

# ----
# 重复排列点的做法
tstat_3 = TreeStatistics(Tree=shift_5)  # -> Paths, Length, Count
bang_3 = ExplodeTree(Data=shift_5)  # -> Branch0, Branch1, Branch2, Branch3
viewer_6 = ParamViewer(bang_3.Branch0)
panel_25 = Panel(tstat_3.Paths)
equals = Equality(FirstNumber=bang_3.Branch0)  # -> Equality, Inequality

panel_26 = Panel(branch_6)
vec2pt = Vector2Pt(PointA=graft_2, PointB=partition_6, Unitize=False)  # -> Vector, Length
threesidepoints = Point(graft_2)
vetor = Vector(vec2pt.Vector)

# ---- group: 运算数据结构
lng_7 = ListLength(List=vetor)
item_2 = ListItem(List=int, Index="-1", Wrap=True)
ma_6 = MassAddition(Input=flatten(lng_7))  # -> Result, PartialResults
addition_7 = Addition(A=item_2, B="1")
series_7 = Series(Start=addition_7, Step=1, Count=ma_6.Result)
complex_6 = ComplexComponents(Complex=threesidepoints)  # -> Real, Imaginary
partition_7 = PartitionList(List=series_7, Size=flatten(lng_7))  # -> simplify(Chunks)
concat_3 = Concatenate(FragmentA=complex_6.Real, FragmentB=complex_6.Imaginary, JoinSeparator=",")
int_2 = Integer(partition_7)
concat_4 = Concatenate(FragmentA=concat_3, FragmentB=int_2, JoinSeparator=";")

# ----
panel_27 = Panel(series_7)
vectorlength = Number(vec2pt.Length)
panel_28 = Panel(threesidepoints)
line = LineSDL(Start=threesidepoints, Direction=vetor, Length=vectorlength)
flatten = FlattenTree(Tree=vectorlength, Path="{0}")
sort = SortList(Keys=flatten)  # -> Keys, ValuesA
panel_29 = Panel(vetor)
cset = CreateSet(List=sort.Keys)  # -> Set, Map
panel_30 = Panel(concat_3)
item_3 = ListItem(List=cset.Set, Index=series_5, Wrap=False)
panel_32 = Panel(concat_4)
mindex = MemberIndex(Set=flatten, Member=graft(item_3))  # -> simplify(Index), Count
panel_33 = Panel(addition_7)
flatten_2 = FlattenTree(Tree=concat_4, Path="{0}")
addition_8 = Addition(A=panel_33, B=mindex.Index)
item_4 = ListItem(List=flatten_2, Index=mindex.Index, Wrap=False)
panel_34 = Panel(addition_8)
flatten_3 = FlattenTree(Tree=item_4, Path="{0}")
lng_8 = ListLength(List=flatten_3)
panel_35 = Panel(vetor)
subtraction_4 = Subtraction(A=lng_8, B="1")
random = Random(Range=subtraction_4, Number=circlecount, Seed=circlecountseed)
item_5 = ListItem(List=flatten_3, Index=random, Wrap=False)
flatten_4 = FlattenTree(Tree=panel_35, Path="{0}")
split = TextSplit(Text=item_5, Separators=";")
item_6 = ListItem(List=split, Index="0", Wrap=False)  # -> simplify(Item), simplify(Item1)
panel_38 = Panel(item_6.Item1)

subtraction_5 = Subtraction(A=item_6.Item1, B="-1")

item_7 = ListItem(List=flatten(vetor), Index=item_6.Item1, Wrap=False)
panel_39 = Panel(item_7)
split_2 = TextSplit(Text=item_6.Item, Separators=",")
complex_7 = ComplexComponents(Complex=item_7)  # -> Real, Imaginary
item_8 = ListItem(List=split_2, Index="0", Wrap=False)  # -> simplify(Item), simplify(Item1)
complex_8 = CreateComplex(Real=complex_7.Real, Imaginary=complex_7.Imaginary)
panel_40 = Panel(flatten_4)

# ---- group: startPoint
complex_9 = CreateComplex(Real=item_8.Item, Imaginary=item_8.Item1)

# ----
panel_41 = Panel(complex_9)
panel_42 = Panel(complex_8)

# ---- group: endPoint
addition_9 = Addition(A=complex_9, B=complex_8)

# ----
panel_43 = Panel(item_8.Item)
pt_3 = Point(addition_9)
addition_10 = Addition(A=complex_9, B=addition_9)
sidelocate_range = Number(addition_9)
panel_44 = Panel(item_5)
panel_45 = Panel(pt_3)
random_2 = Random(Range=sidelocate_range, Number=circlecount, Seed=sidelocateseed)  # -> simplify(graft(Random))
multiplication_3 = Multiplication(A=addition_10, B=random_2)
pt_4 = Point(multiplication_3)
panel_49 = Panel(multiplication_3)
addition_11 = Addition(A=basicpoint, B=pt_4)
panel_50 = Panel(addition_11)
int_3 = Integer(Slider(29, range=0..100))

item_9 = ListItem(List=flatten(flatten_4), Index=int_3, Wrap=False)

panel_51 = Panel(item_9)
