# Grasshopper definition 160919_haystack_007.gh (Grasshopper 0.9.76)

panel = Panel("""3
2
3""")
panel_2 = Panel("""5
2
2""")
ma = MassAddition(Input=panel)  # -> Result, PartialResults
ma_2 = MassAddition(Input=panel_2)  # -> Result, PartialResults
series = Series(Start=0, Step=1, Count=ma.Result)
series_2 = Series(Start=0, Step=1, Count=ma_2.Result)
partition = PartitionList(List=series, Size=panel)  # -> simplify(Chunks)
partition_2 = PartitionList(List=series_2, Size=panel_2)  # -> simplify(Chunks)
panel_3 = Panel(partition)
panel_4 = Panel(partition_2)
graft = GraftTree(Tree=partition, IncludeEmptyLists=True, IncludeNullItems=True)
lng = ListLength(List=partition)
lng_2 = ListLength(List=partition_2)
addition = Addition(A=partition, B=partition_2)
addition_2 = Addition(A=graft, B=partition_2)
viewer = ParamViewer(graft)
multiplication = Multiplication(A=lng, B=lng_2)
repeat = RepeatData(Data=partition_2, Length=multiplication)
partition_3 = PartitionList(List=repeat, Size=lng_2)  # -> simplify(Chunks)
viewer_2 = ParamViewer(partition_3)
addition_3 = Addition(A=graft, B=partition_3)

panel_5 = Panel("""5
3
5
3""")
ma_3 = MassAddition(Input=panel_5)  # -> Result, PartialResults
panel_6 = Panel("""1
2
3""")
panel_7 = Panel("""2
3""")
pt = Point(Point(-95.50302731, 3.41775708, 0))
pt_2 = Point(Point(-61.12878793, 5.226927573, 0))
series_3 = Series(Start="10", Step=1, Count=ma_3.Result)
entwine = Entwine(Branch00=panel_6, Branch01=panel_7, Branch02="3", FlattenInputs=True)  # -> simplify(Result)
partition_4 = PartitionList(List=series_3, Size=panel_5)  # -> simplify(Chunks)
ln = Line(StartPoint=pt, EndPoint=pt_2)
panel_8 = Panel(entwine)
divide = DivideCurve(Curve=ln, Count=Slider(4, range=0..10), Kinks=False)  # -> simplify(flatten(Points)), Tangents, Parameters
lng_3 = ListLength(List=divide.Points)
subtraction = Subtraction(A=lng_3, B="1")
addition_4 = Addition(A=partition_4, B=entwine)
series_4 = Series(Start="1", Step=1, Count=subtraction)
shift = ShiftList(List=divide.Points, Shift="-1", Wrap=False)  # -> simplify(flatten(List))
panel_9 = Panel(shift)
panel_10 = Panel(partition_4)
shift_2 = ShiftList(List=divide.Points, Shift=series_4, Wrap=False)  # -> simplify(List)

viewer_3 = ParamViewer()
bang = ExplodeTree()  # -> Branch0, Branch1, Branch2, Branch3
viewer_4 = ParamViewer(bang.Branch0)
dpath = DeconstructPath(Branch=viewer_4)
cull_i = CullIndex(Indices=dpath, Wrap=True)
branch = TreeBranch(Path=cull_i, MaintainPaths=True)

ln_2 = Line(StartPoint=graft(shift), EndPoint=shift_2)
panel_11 = Panel(ln_2)
panel_12 = Panel(addition_4)
tstat = TreeStatistics()  # -> Paths, Length, Count
panel_13 = Panel(shift_2)
panel_14 = Panel("""精确度问题,有限元问题
忽略了一个角""")
md_slider = MDSlider(
    slider_value=Point(0.5775609831, 0.6897561608, 0.5),
    SliderMode=0,
    x_domain=Domain(-100, 100),
    y_domain=Domain(-100, 100),
    z_domain=Domain(0, 1))
panel_15 = Panel("""有限元插写
有限元靠近整数n
有限元和场地之间的关系？
width先决定""")
repeat_2 = RepeatData(Data=[Slider(20, range=0..100), Slider(15, range=0..100)], Length="4")

panel_16 = Panel("""0
1
2
3""")
panel_17 = Panel(repeat_2)

complex = ComplexComponents(Complex=md_slider)  # -> Real, Imaginary
panel_18 = Panel("""5
3
5
3""")
int = Integer(panel_16)
num = Number(panel_17)
complex_2 = CreateComplex(Real=complex.Real, Imaginary=complex.Imaginary)
division = Division(A=num, B=panel_18)
finiteelement = Integer("2")
item = ListItem(
    List=[{imaginary=0, real=1}, {imaginary=1, real=0}, {imaginary=0, real=-1}, {imaginary=-1, real=0}],
    Index=int,
    Wrap=False)
panel_19 = Panel(item)
amp = Amplitude(Vector=item, Amplitude=division)
basicpoint = Point(complex_2)
amp_2 = Amplitude(Vector=item, Amplitude=num)
stack = StackData(Data=amp, Stack=panel_18)
ma_4 = MassAddition(Input=amp_2)  # -> Result, PartialResults
ma_5 = MassAddition(Input=stack)  # -> Result, PartialResults
addition_5 = Addition(A=basicpoint, B=ma_4.PartialResults)
complex_3 = ComplexComponents(Complex=ma_4.PartialResults)  # -> Real, Imaginary
partition_5 = PartitionList(List=ma_5.PartialResults, Size=panel_18)  # -> simplify(Chunks)
shift_3 = ShiftList(List=partition_5, Shift=1, Wrap=False)  # -> simplify(List)

shift_4 = ShiftList(List=tstat.Paths, Shift="1", Wrap=False)  # -> simplify(List)
branch_2 = TreeBranch(Tree=shift_3, Path=shift_4, MaintainPaths=True)
viewer_5 = ParamViewer(branch_2)
dpath_2 = DeconstructPath(Branch=viewer_5)
subtraction_2 = Subtraction(A=dpath_2, B="1")
path = ConstructPath(Indices=subtraction_2)  # -> flatten(Branch)
replace = ReplacePaths(Data=branch_2, Search=viewer_5, Replace=path)

panel_20 = Panel(replace)

addition_6 = Addition(A=basicpoint, B=partition_5)
concat = Concatenate(FragmentA=complex_3.Real, FragmentB=complex_3.Imaginary, JoinSeparator=",")
complex_4 = ComplexComponents(Complex=partition_5)  # -> Real, Imaginary
panel_21 = Panel(ma_4.PartialResults)
complex_5 = CreateComplex(Real=complex_4.Real, Imaginary=complex_4.Imaginary)

pline = PolyLine(Vertices=addition_5, Closed=True)
concat_2 = Concatenate(FragmentA=concat, FragmentB=int, JoinSeparator=";")

panel_22 = Panel(concat_2)
panel_23 = Panel("""两个可能出错的地方
点的排序方法不合理
向量连线之后的计算不合理，先用直线试试""")

shift_5 = ShiftList(List=complex_5, Shift="-1", Wrap=False)  # -> simplify(List)

# ----
# 重复排列点的做法
tstat_2 = TreeStatistics(Tree=shift_5)  # -> Paths, Length, Count
bang_2 = ExplodeTree(Data=shift_5)  # -> Branch0, Branch1, Branch2, Branch3
viewer_6 = ParamViewer(bang_2.Branch0)
panel_24 = Panel(tstat_2.Paths)
equals = Equality(FirstNumber=bang_2.Branch0)  # -> Equality, Inequality

tstat_3 = TreeStatistics(Tree=shift_5)  # -> Paths, Length, Count
lng_4 = ListLength(List=tstat_3.Paths)
subtraction_3 = Subtraction(A=lng_4, B="1")
series_5 = Series(Start="1", Step=1, Count=subtraction_3)
shift_6 = ShiftList(List=tstat_3.Paths, Shift=series_5, Wrap=False)  # -> simplify(List)
bang_3 = ExplodeTree(Data=shift_6)  # -> Branch0, Branch1, Branch2
branch_3 = TreeBranch(Tree=shift_5, Path=bang_3.Branch0, MaintainPaths=True)
branch_4 = TreeBranch(Tree=shift_5, Path=bang_3.Branch1, MaintainPaths=True)
branch_5 = TreeBranch(Tree=shift_5, Path=bang_3.Branch2, MaintainPaths=True)
entwine_2 = Entwine(Branch00=branch_3, Branch01=branch_4, Branch02=branch_5, FlattenInputs=True)  # -> simplify(Result)

panel_25 = Panel(shift_5)

shift_7 = ShiftList(List=tstat_3.Paths, Shift="-1", Wrap=False)  # -> simplify(List)
branch_6 = TreeBranch(Tree=shift_5, Path=shift_7, MaintainPaths=True)
graft_2 = GraftTree(Tree=branch_6, IncludeEmptyLists=True, IncludeNullItems=True)
lng_5 = ListLength(List=branch_6)
lng_6 = ListLength(List=entwine_2)
multiplication_2 = Multiplication(A=lng_5, B=lng_6)
repeat_3 = RepeatData(Data=entwine_2, Length=multiplication_2)
partition_6 = PartitionList(List=repeat_3, Size=lng_6)  # -> simplify(Chunks)

panel_26 = Panel(branch_6)
vec2pt = Vector2Pt(PointA=graft_2, PointB=partition_6, Unitize=False)  # -> Vector, Length

threesidepoints = Point(graft_2)
vetor = Vector(vec2pt.Vector)
vectorlength = Number(vec2pt.Length)

flatten = FlattenTree(Tree=vectorlength, Path="{0}")
miniestlinecount = Integer(Slider(5, range=0..10))
sort = SortList(Keys=flatten)  # -> Keys, ValuesA
cset = CreateSet(List=sort.Keys)  # -> Set, Map
series_6 = Series(Start=0, Step=1, Count=miniestlinecount)
item_2 = ListItem(List=cset.Set, Index=series_6, Wrap=False)
mindex = MemberIndex(Set=flatten, Member=graft(item_2))  # -> simplify(Index), Count

line = LineSDL(Start=threesidepoints, Direction=vetor, Length=vectorlength)

# ----
# 先忽略了前面描述矩形的四个向量编号
lng_7 = ListLength(List=vetor)
ma_6 = MassAddition(Input=flatten(lng_7))  # -> Result, PartialResults
series_7 = Series(Start="0", Step=1, Count=ma_6.Result)
complex_6 = ComplexComponents(Complex=threesidepoints)  # -> Real, Imaginary
partition_7 = PartitionList(List=series_7, Size=flatten(lng_7))  # -> simplify(Chunks)
concat_3 = Concatenate(FragmentA=complex_6.Real, FragmentB=complex_6.Imaginary, JoinSeparator=",")
int_2 = Integer(partition_7)
concat_4 = Concatenate(FragmentA=concat_3, FragmentB=int_2, JoinSeparator=";")

flatten_2 = FlattenTree(Tree=concat_4, Path="{0}")
item_3 = ListItem(List=flatten_2, Index=mindex.Index, Wrap=False)
flatten_3 = FlattenTree(Tree=item_3, Path="{0}")
lng_8 = ListLength(List=flatten_3)
circlecountseed = Integer(Slider(54.95, range=0..100))
circlecount = Integer(Slider(5, range=0..10))
subtraction_4 = Subtraction(A=lng_8, B="1")
random = Random(Range=subtraction_4, Number=circlecount, Seed=circlecountseed)
item_4 = ListItem(List=flatten_3, Index=random, Wrap=False)

panel_27 = Panel(item_4)

split = TextSplit(Text=item_4, Separators=";")
item_5 = ListItem(List=split, Index="0", Wrap=False)  # -> simplify(Item), simplify(Item1)
item_6 = ListItem(List=flatten(vetor), Index=item_5.Item1, Wrap=False)
split_2 = TextSplit(Text=item_5.Item, Separators=",")
complex_7 = ComplexComponents(Complex=item_6)  # -> Real, Imaginary
item_7 = ListItem(List=split_2, Index="0", Wrap=False)  # -> simplify(Item), simplify(Item1)
complex_8 = CreateComplex(Real=complex_7.Real, Imaginary=complex_7.Imaginary)
sidelocate_range = Number("0.5")
sidelocateseed = Number(Slider(24.18, range=0..100))
random_2 = Random(Range=sidelocate_range, Number=circlecount, Seed=sidelocateseed)  # -> simplify(graft(Random))

# ---- group: startPoint
complex_9 = CreateComplex(Real=item_7.Item, Imaginary=item_7.Item1)

# ---- group: endPoint
addition_7 = Addition(A=complex_9, B=complex_8)

# ----
addition_8 = Addition(A=complex_9, B=addition_7)
multiplication_3 = Multiplication(A=addition_8, B=random_2)

panel_29 = Panel(item_6)
panel_30 = Panel(item_7.Item)
pt_3 = Point(multiplication_3)
addition_9 = Addition(A=basicpoint, B=pt_3)
pl = ConstructPlane(Origin=addition_9, XAxis=Vector(1, 0, 0), YAxis=Vector(0, 1, 0))
cir = Circle(Plane=pl, Radius=1)
panel_31 = Panel(addition_9)
