# Grasshopper definition 20161205_graphics_clip_Sutherland_Cohen_001.gh (Grasshopper 0.9.76)

crv = Curve(<curve referenced from the Rhino model>)  # disabled
crv_2 = Curve(<curve referenced from the Rhino model>)  # disabled
genes = GenePool(Decimals=5, Maximum=20, Minimum=-10, Value=[20, 7.01428])
genes_2 = GenePool(Decimals=5, Maximum=10, Minimum=-10, Value=[10, -3.472])
explode = Explode(Curve=crv, Recursive=True)  # -> Segments, Vertices; disabled
end = EndPoints(Curve=crv_2)  # -> Start, End; disabled
shift = ShiftList(List=explode.Vertices, Shift=-1, Wrap=False)  # disabled
merge = Merge(Data1=end.Start, Data2=end.End)  # disabled
complex = CreateComplex(Real=genes, Imaginary=genes_2)
panel = Panel(shift)  # disabled
panel_2 = Panel(merge)  # disabled
panel_3 = Panel("""{-9.818182, 14.909091, 0.0}
{9.636364, 9.454545, 0.0}""")
panel_4 = Panel("""{-12.0, -7.0, 0.0}
{13.0, -7.0, 0.0}
{13.0, 7.0, 0.0}
{-12.0, 7.0, 0.0}""")
# Sutherland-cohen算法_logging
# 20161205
# 域的top,bottom,left,right
# 线的pt0的坐标与域比较得到code值
# 判断可见性的层级关系
# code值与所求交线的映射关系
# 求交点的算法以及精简处理好进fx的数据结构
# 替换掉combine这种搞不清的运算器
panel_5 = Panel("""{-17.991846, 14.901049, 0.0}
{21.96326, -1.933968, 0.0}""")
panel_6 = Panel("""{-7.454545, 2.0, 0.0}
{8.181818, -3.636364, 0.0}""")
panel_7 = Panel("""{-15.272727, 12.727273, 0.0}
{17.272727, -12.727273, 0.0}""")
panel_8 = Panel("""{-8.0, 13.0, 0.0}
{18.0, -4.0, 0.0}""")
txt = Text(panel_4)
txt_2 = Text(panel_8)
item = ListItem(List=txt_2, Index=0, Wrap=True)  # -> Item, Item1

firstpt_line0 = Point(item.Item)
endpt_line0 = Point(item.Item1)
complex_2 = ComplexComponents(Complex=firstpt_line0)  # -> Real, Imaginary
complex_3 = ComplexComponents(Complex=endpt_line0)  # -> Real, Imaginary
subtraction = Subtraction(A=complex_2.Imaginary, B=complex_3.Imaginary)
subtraction_2 = Subtraction(A=complex_2.Real, B=complex_3.Real)
division = Division(A=subtraction, B=subtraction_2)
k1 = Number(division)
multiplication = Multiplication(A=k1, B=complex_2.Real)
subtraction_3 = Subtraction(A=complex_2.Imaginary, B=multiplication)
b1 = Number(subtraction_3)
panel_9 = Panel(k1)

complex_4 = ComplexComponents(Complex=txt)  # -> Real, Imaginary
pt = Point(txt)
pt_2 = Point(txt_2)
pt_3 = Point(complex)
entwine = Entwine(Branch00=complex_4.Real, Branch01=complex_4.Imaginary, FlattenInputs=True)
pline = PolyLine(Vertices=pt_2, Closed=True)
pline_2 = PolyLine(Vertices=pt, Closed=True)
complex_5 = ComplexComponents(Complex=txt_2)  # -> Real, Imaginary
cset = CreateSet(List=entwine)  # -> Set, Map
number = Number(complex_5.Real)  # "xa,xb"
number_2 = Number(complex_5.Imaginary)  # "ya,yb"
sort = SortList(Keys=cset.Set)  # -> Keys, ValuesA
flatten = FlattenTree(Tree=sort.Keys, Path="{0}")

panel_10 = Panel("""0
2""")
# x0<xL  _ _ _ 1  -->left边交          --->3
# x0>xR _ _ 1 _   --->right边交      -->2
# y0<yB _ 1 _ _  --->bottom边交 -->1
# y0>yT 1_ _ _    ---> top边交  -->0
entwine_2 = Entwine(Branch00=number, Branch01=number_2, FlattenInputs=True)
item_2 = ListItem(List=flatten, Index=panel_10, Wrap=True)  # -> Item, Item1
smaller = SmallerThan(FirstNumber=entwine_2, SecondNumber=graft(item_2.Item))  # -> SmallerThan, OrEqualTo
larger = LargerThan(FirstNumber=entwine_2, SecondNumber=graft(item_2.Item1))  # -> LargerThan, OrEqualTo
int = Integer(smaller.SmallerThan)
int_2 = Integer(larger.LargerThan)
bang = ExplodeTree(Data=int_2)  # -> Branch0, Branch1
bang_2 = ExplodeTree(Data=int)  # -> Branch0, Branch1
concat = Concatenate(FragmentA=bang.Branch1, FragmentB=bang_2.Branch1, FragmentC=bang.Branch0, FragmentD=bang_2.Branch0)

panel_11 = Panel(flatten)

panel_12 = Panel("""1
-1""")
multiplication_2 = Multiplication(A=entwine_2, B=panel_12)
ma = MassAddition(Input=multiplication_2)  # -> Result, PartialResults
item_3 = ListItem(List=entwine_2, Index=0, Wrap=True)
bang_3 = ExplodeTree(Data=ma.Result)  # -> Branch0, Branch1
bang_4 = ExplodeTree(Data=item_3)  # -> Branch0, Branch1
division_2 = Division(A=bang_3.Branch1, B=bang_3.Branch0)
k = Number(division_2)
multiplication_3 = Multiplication(A=k, B=bang_4.Branch0)
subtraction_4 = Subtraction(A=bang_4.Branch1, B=multiplication_3)
b = Number(subtraction_4)

# ----
# if c1 and c2 == 0000 --> 完全可见
# else c1 * c2 != 0000 --> 完全不可见
#     if  c1 * c2 == 0000 --> 不完全可见
#     then 开始裁剪
txt_3 = Text(flatten(concat))
panel_13 = Panel(txt_3)
txt_4 = Text("0000")
equals = Equality(FirstNumber=txt_3, SecondNumber=txt_4)  # -> Equality, Inequality
item_4 = ListItem(List=equals.Equality, Index=0, Wrap=True)  # -> Item, Item1
and = GateAnd(A=item_4.Item, B=item_4.Item1)
gate = StreamGate(Stream=txt_3, Gate=and)  # -> Target0, Target1
chars = Characters(Text=gate.Target0)  # -> Result, Unicode
bang_5 = ExplodeTree(Data=chars.Result)  # -> Branch0, Branch1
panel_14 = Panel("""k*a+b
(a-b)/k""")
panel_15 = Panel("""1
1
0
0""")
panel_16 = Panel(and)
multiplication_4 = Multiplication(A=bang_5.Branch0, B=bang_5.Branch1)
txt_5 = Text(panel_14)
item_5 = ListItem(List=txt_5, Index=panel_15, Wrap=True)
join = TextJoin(Text=multiplication_4)
equals_2 = Equality(FirstNumber=join, SecondNumber=txt_4)  # -> Equality, Inequality
gate_2 = StreamGate(Stream=chars.Result, Gate=equals_2.Inequality)  # -> Target0, Target1
mindex = MemberIndex(Set=gate_2.Target0, Member="1")  # -> simplify(Index), Count

panel_17 = Panel("""3
2
1
0""")
item_6 = ListItem(List=flatten, Index=panel_17, Wrap=True)
item_7 = ListItem(List=item_6, Index=mindex.Index, Wrap=True)  # -> simplify(Item)

item_8 = ListItem(List=item_5, Index=mindex.Index, Wrap=True)  # -> simplify(Item)
item_9 = ListItem(List=panel_15, Index=mindex.Index, Wrap=True)
panel_18 = Panel(mindex.Index)

eval = Evaluate(F=item_8, a=item_7, k=simplify(k), b=simplify(b))  # -> simplify(r)
path_mapper = PathMapper(eval, source="{A}", target="{A-1}")

panel_19 = Panel(item_9)
merge_2 = Merge(Data1=graft(path_mapper), Data2=graft(item_7))
sift = SiftPattern(List=merge_2, SiftPattern=graft(item_9))  # -> Output0, Output1
rev = ReverseList(List=sift.Output0)
panel_20 = Panel(equals_2.Inequality)
combine = CombineData(Input0=rev, Input1=sift.Output1)  # -> simplify(Result), Index
panel_21 = Panel(eval)
item_10 = ListItem(List=combine.Result, Index=0, Wrap=True)  # -> Item, Item1
panel_22 = Panel(item_10.Item)

panel_23 = Panel("""0
2""")
entwine_3 = Entwine(Branch00=flatten(item_10.Item), Branch01=flatten(item_10.Item1), FlattenInputs=True)
item_11 = ListItem(List=flatten, Index=panel_23, Wrap=True)  # -> Item, Item1
complex_6 = CreateComplex(Real=item_10.Item, Imaginary=item_10.Item1)
smaller_2 = SmallerThan(FirstNumber=entwine_3, SecondNumber=graft(item_11.Item))  # -> SmallerThan, OrEqualTo
larger_2 = LargerThan(FirstNumber=entwine_3, SecondNumber=graft(item_11.Item1))  # -> LargerThan, OrEqualTo
int_3 = Integer(smaller_2.SmallerThan)
int_4 = Integer(larger_2.LargerThan)
bang_6 = ExplodeTree(Data=int_4)  # -> Branch0, Branch1
bang_7 = ExplodeTree(Data=int_3)  # -> Branch0, Branch1
concat_2 = Concatenate(FragmentA=bang_6.Branch1, FragmentB=bang_7.Branch1, FragmentC=bang_6.Branch0, FragmentD=bang_7.Branch0)
txt_6 = Text("0000")
txt_7 = Text(concat_2)
equals_3 = Equality(FirstNumber=txt_7, SecondNumber=txt_6)  # -> Equality, Inequality
sift_2 = SiftPattern(List=flatten(complex_6), SiftPattern=equals_3.Equality)  # -> Output0, Output1
panel_24 = Panel(sift_2.Output1)
clean = CleanTree(RemoveNulls=True, RemoveInvalid=True, RemoveEmpty=False, Tree=sift_2.Output1)
panel_25 = Panel(txt_7)
item_12 = ListItem(List=clean, Index=0, Wrap=True)  # -> Item, Item1
panel_26 = Panel(item_12.Item)

pt_4 = Point(complex_6)
ln = Line(StartPoint=item_12.Item, EndPoint=item_12.Item1)
preview = CustomPreview(Geometry=ln, Shader=ColourSwatch(SwatchColor=RGB(255, 255, 0)))
