# Grasshopper definition 20170310_taskbook_plane.gh (Grasshopper 0.9.76)

_201703010_现阶段工作 = Panel("""贴标签
运算器分布
案例编写""")
panel = Panel("""数据组织
交错韵律
最小单元""")
sqgrid = Square(Plane=PlaneXY(0, 0, 0), Size=1, ExtentX=5, ExtentY=5)  # -> Cells, Points

# ----
# 生成-->蓝色
# 解析-->黄色
# 数据-->白色
# 向量-->红色
# 变形-->绿色
# 预览-->紫色
path_mapper = PathMapper()
viewer = ParamViewer()

partition = PartitionList(Size=[3, 2])
tstat = TreeStatistics()  # -> Paths, Length, Count
shift = ShiftList(Shift=1, Wrap=True)
entwine = Entwine(FlattenInputs=True)
dup = DuplicateData(Number=2, Order=True)
item = ListItem(Index=0, Wrap=True)

area = Area()  # -> Area, Centroid
curvepoint = PointOnCurve(parameter=0.5)

del = DelaunayMesh(Plane=PlaneXY(0, 0, 0))
pline = PolyLine(Closed=False)
ln = Line()

unit = UnitVector()
amp = Amplitude(Amplitude=1)

points = PointList()
preview = CustomPreview(Shader={ambient=RGB(0, 0, 0), diffuse=RGB(255, 105, 180), emission=RGB(76, 32, 54), shine=0.5, specular=RGB(255, 255, 255), transparency=0})
vdis = VectorDisplay()

move = Move(Motion=Vector(0, 0, 10))  # -> Geometry, Transform

md_slider = MDSlider(slider_value=Point(0.5, 0.5, 0.5), SliderMode=0, x_domain=Domain(0, 1), y_domain=Domain(0, 1), z_domain=Domain(0, 1))
remap = RemapNumbers(Source=Domain(0, 1), Target=Domain(0, 1))  # -> Mapped, Clipped
prot = RotatePlane()

item_2 = ListItem(Index=0, Wrap=True)
filter = StreamFilter(Gate=0)
smaller = SmallerThan(SecondNumber=0)  # -> SmallerThan, OrEqualTo

pt = PointOriented(BasePlane=PlaneXY(0, 0, 0), UComponent=0, VComponent=0, WComponent=0)
pline_2 = PolyLine(Closed=False)
hexgrid = Hexagonal(Plane=PlaneXY(0, 0, 0), Size=1, ExtentX=5, ExtentY=5)  # -> Cells, Points
boxrec = BoxRectangle(Height=Domain(0, 10))
boundary = BoundarySurfaces()
circle = CircleCNR(Normal=Vector(0, 0, 1), Radius=1)
pop3d = Populate3D(Region={Plane=PlaneXY(0, 0, 0), X=Domain(0, 10), Y=Domain(0, 10), Z=Domain(0, 2)}, Count=100, Seed=1)

md_slider_2 = MDSlider(
    slider_value=Point(0, 0, 0.5),
    SliderMode=0,
    x_domain=Domain(-100, 100),
    y_domain=Domain(-100, 100),
    z_domain=Domain(0, 1))
panel_2 = Panel("""这个案例有很大问题
1:pathMapper：当树形数据改变后，怎么死的都不知道
2:plane和line不管数据类型的接入vector

重做""")
panel_3 = Panel("""二维投影
偏移缩放
坐标干扰
数据筛选""")
pt_2 = Point()
remap_2 = RemapNumbers(Value=Slider(0, range=0..1), Source=Domain(0, 1), Target=Domain(0, 6.283185307))  # -> Mapped, Clipped
vec2pt = Vector2Pt(Unitize=False)  # -> Vector, Length
offset = Offset(Distance=1, Plane=PlaneXY(0, 0, 0), Corners=1)
points_2 = PointList()
pop2d = Populate2D(Region={Plane=PlaneXY(0, 0, 0), Size=Domain2(u=0..20, v=0..10)}, Count=100, Seed=1)
prot_2 = RotatePlane(Plane=md_slider_2, Angle=remap_2.Mapped)
unit_2 = UnitVector(Vector=prot_2)
cullpt = CullDuplicates(Points=pop2d, Tolerance=0.1, CullMode=3)  # -> Points, Indices, Valence
amp_2 = Amplitude(Vector=unit_2, Amplitude=Slider(0.836, range=0..1))
sqgrid_2 = Square(Plane=prot_2, Size=Slider(0.553, range=0..10), ExtentX=Slider(13, range=0..100), ExtentY=Slider(13, range=0..100))  # -> Cells, Points
area_2 = Area(Geometry=sqgrid_2.Cells)  # -> Area, Centroid
md_slider_3 = MDSlider(
    slider_value=Point(0.1087802212, 0, 0.5),
    SliderMode=0,
    x_domain=Domain(-100, 100),
    y_domain=Domain(-100, 100),
    z_domain=Domain(0, 1))
panel_4 = Panel(pop2d)
remap_3 = RemapNumbers(Value=Slider(0, range=0..1), Source=Domain(0, 1), Target=Domain(0, 6.283185307))  # -> Mapped, Clipped
panel_5 = Panel("""0
8
80
72""")
path_mapper_2 = PathMapper(sqgrid_2.Cells, source="{A;B;C}(i)", target="{c%2;i%2}")
move_2 = Move(Geometry=area_2.Centroid, Motion=amp_2)  # -> Geometry, Transform
prot_3 = RotatePlane(Plane=md_slider_3, Angle=remap_3.Mapped)
path_mapper_3 = PathMapper(move_2.Geometry, source="{A;B;C}(i)", target="{c%2;i%2}")
entwine_2 = Entwine(
    Branch00=ColourSwatch(SwatchColor=RGB(0, 255, 0)),
    Branch01=ColourSwatch(SwatchColor=RGB(0, 0, 0)),
    Branch02=ColourSwatch(SwatchColor=RGB(33, 88, 112)),
    Branch03=ColourSwatch(SwatchColor=RGB(235, 181, 181)),
    FlattenInputs=True)
sph = Sphere(Base=path_mapper_3, Radius=Slider(0.25, range=0..1))
number_slider = Slider(0.52, range=0..1)
points_3 = PointList(Points=path_mapper_3, Size=Slider(0.636, range=0..1))
preview_2 = CustomPreview(Geometry=sph, Shader=entwine_2)
cpoly = ControlPolygon(Curve=path_mapper_2)  # -> Polygon, Points
num = Number(Slider(46.31, range=0..100))
int = Integer(Slider(1, range=0..10))
int_2 = Integer(Slider(9, range=0..10))
panel_6 = Panel("""0
2
2
0
1
3
3
1""")
shift_2 = ShiftList(List=cpoly.Points, Shift=-1, Wrap=False)
cullpt_2 = CullDuplicates(Points=cpoly.Points, Tolerance=0.1, CullMode=3)  # -> Points, Indices, Valence
smaller_2 = SmallerThan(FirstNumber=int, SecondNumber=int_2)  # -> SmallerThan, OrEqualTo
hexgrid_2 = Hexagonal(Plane=prot_3, Size=number_slider, ExtentX=int_2, ExtentY=int_2)  # -> Cells, Points
item_3 = ListItem(List=flatten(hexgrid_2.Points), Index=panel_5, Wrap=True)
points_4 = PointList(Points=flatten(hexgrid_2.Points), Size=Slider(0.42, range=0..10))
pline_3 = PolyLine(Vertices=item_3, Closed=True)
boxrec_2 = BoxRectangle(Rectangle=pline_3, Height=Slider(0.57, range=0..10))
pt_3 = PointOriented(
    BasePlane=prot_3,
    UComponent=Slider(2.365, range=0..10),
    VComponent=Slider(3.093, range=0..10),
    WComponent=Slider(0.615, range=0..10))
preview_3 = CustomPreview(Geometry=sph, Shader=entwine_2)
partition_2 = PartitionList(List=panel_6, Size="2")
pt_4 = Point(shift_2)
filter_2 = StreamFilter(Gate=smaller_2.SmallerThan, Stream1=int)
tstat_2 = TreeStatistics(Tree=pt_4)  # -> Paths, Length, Count
pt_5 = Point(pt_3)
pop3d_2 = Populate3D(Region=boxrec_2, Count=filter_2, Seed=num)
vec2pt_2 = Vector2Pt(PointA=hexgrid_2.Points, PointB=pt_5, Unitize=False)  # -> Vector, Length
division = Division(A=tstat_2.Count, B="4")
dup_2 = DuplicateData(Data=partition_2, Number=division, Order=True)
circle_2 = CircleCNR(Center=hexgrid_2.Points, Normal=vec2pt_2.Vector, Radius=number_slider)
partition_3 = PartitionList(List=dup_2, Size="2")
item_4 = ListItem(List=pt_4, Index=partition_3, Wrap=True)
offset_2 = Offset(Curve=circle_2, Distance=Slider(-0.251, range=-10..1), Plane=PlaneXY(0, 0, 0), Corners=1)
pline_4 = PolyLine(Vertices=item_4, Closed=False)  # -> simplify(Polyline)
boundary_2 = BoundarySurfaces(Edges=offset_2)
path_mapper_4 = PathMapper(pline_4, source="{A;B}", target="{A}")
path_mapper_5 = PathMapper(pline_4, source="{A;B;C}", target="{A;B}")
curvepoint_2 = PointOnCurve(pline_4, parameter=0.5)
unit_3 = UnitVector(Vector=path_mapper_4)
amp_3 = Amplitude(Vector=unit_3, Amplitude=Slider(0.24, range=0..1))
vdis_2 = VectorDisplay(Anchor=curvepoint_2, Vector=amp_3)
move_3 = Move(Geometry=path_mapper_3, Motion=amp_3)  # -> graft(Geometry), Transform
path_mapper_6 = PathMapper(pt_4, source="{A;B;C;D}", target="{A;B;C}")
ln_2 = Line(StartPoint=path_mapper_6, EndPoint=move_3.Geometry)
merge = Merge(Data1=move_3.Geometry, Data2=path_mapper_6)
del_2 = DelaunayMesh(Points=merge, Plane=prot_2)
