# Grasshopper definition 20170314_taskbook_3DForm.gh (Grasshopper 0.9.76)

# ----
# 生成-->蓝色
# 解析-->黄色
# 数据-->白色
# 向量-->红色
# 预览-->紫色
panel = Panel("""数据组织
交错韵律
最小单元""")
sqgrid = Square(Plane=PlaneXY(0, 0, 0), Size=1, ExtentX=5, ExtentY=5)  # -> Cells, Points

path_mapper = PathMapper()
viewer = ParamViewer()

partition = PartitionList(Size=[3, 2])
tstat = TreeStatistics()  # -> Paths, Length, Count
shift = ShiftList(Shift=1, Wrap=True)
entwine = Entwine(FlattenInputs=True)
dup = DuplicateData(Number=2, Order=True)
item = ListItem(Index=0, Wrap=True)

area = Area()  # -> Area, Centroid
curvepoint = PointOnCurve(parameter=0.5)

points = PointList()
preview = CustomPreview(Shader={ambient=RGB(0, 0, 0), diffuse=RGB(255, 105, 180), emission=RGB(76, 32, 54), shine=0.5, specular=RGB(255, 255, 255), transparency=0})
vdis = VectorDisplay()

del = DelaunayMesh(Plane=PlaneXY(0, 0, 0))
pline = PolyLine(Closed=False)
ln = Line()

unit = UnitVector()
amp = Amplitude(Amplitude=1)

# ----
# 生成-->蓝色
# 解析-->黄色
# 数据-->白色
# 向量-->红色
# 变形-->绿色
# 预览-->紫色
panel_2 = Panel("""建模思路
函数找形
非样变形""")

graph = GraphMapper(
    x0=0,
    x1=1,
    y0=0,
    y1=1,
    container_name="Sine Summation",
    Equation0_px=[0.2, 0.2004867792],
    Equation0_py=[0.2, 0.3020638824],
    Equation1_px=[0.6, 0.5952462554],
    Equation1_py=[0.3, 0.6849507093])
remap = RemapNumbers(Source=Domain(0, 1), Target=Domain(0, 1))  # -> Mapped, Clipped
item_2 = ListItem(Index=0, Wrap=True)
eval = Evaluate()
sort = SortList()  # -> Keys, ValuesA
range = Range(Domain=Domain(0, 1), Steps=10)

divide = DivideCurve(Count=10, Kinks=False)  # -> Points, Tangents, Parameters
edges = BrepEdges()  # -> Naked, Interior, NonManifold
devec = DeconstructVector()  # -> XComponent, YComponent, ZComponent

intcrv = Interpolate(Degree=3, Periodic=False, KnotStyle=1)  # -> Curve, Length, Domain
extr = Extrude()
join = BrepJoin()  # -> Breps, Closed
line = LineSDL(Direction=Vector(0, 0, 1), Length=1)
loft = Loft(Options={Adjust=False, Closed=False, LoftEnds=0, LoftSimp=0, LoftType=0, Rebuild=10, Refit=0.01})

scale_nu = ScaleNU(Plane=PlaneXY(0, 0, 0), ScaleX=1, ScaleY=1, ScaleZ=1)  # -> Geometry, Transform

devec_2 = DeconstructVector()  # -> XComponent, YComponent, ZComponent
vec = VectorXYZ(XComponent=0, YComponent=0, ZComponent=0)  # -> Vector, Length
vec2pt = Vector2Pt(Unitize=False)  # -> Vector, Length

number_slider = Slider(100, range=0..100)
number_slider_2 = Slider(3.2, range=0..10)
pi = Pi(Factor=Slider(9, range=0..10))
range_2 = Range(Domain=pi, Steps=number_slider)
range_3 = Range(Domain=Domain(0, 1), Steps=number_slider)
range_4 = Range(Domain=Domain(0, 1), Steps=number_slider)
graph_2 = GraphMapper(
    range_3,
    x0=0,
    x1=1,
    y0=-1,
    y1=1,
    container_name="Bezier",
    cpx=[0, 0.6925650835, 0.395832777, 1],
    cpy=[0.8004057407, 0.5106195211, 0.5397279859, 1])
graph_3 = GraphMapper(
    range_4,
    x0=0,
    x1=1,
    y0=0,
    y1=1,
    container_name="Bezier",
    cpx=[0, 0.5422222018, 0.7577240467, 1],
    cpy=[0, 0.5532994866, 0.3482969403, 0])
eval_2 = Evaluate(F="a*sin(x)", a=number_slider_2, x=range_2)
eval_3 = Evaluate(F="a*cos(x)", a=number_slider_2, x=range_2)
dom = ConstructDomain(DomainStart=Slider(0.05, range=0..0.1), DomainEnd=Slider(1.5, range=0..10))
remap_2 = RemapNumbers(Value=graph_3, Source="0 to 1", Target=Slider(21, range=0..100))  # -> Mapped, Clipped
remap_3 = RemapNumbers(Value=graph_2, Source="0 to 1", Target=dom)  # -> Mapped, Clipped
pt = ConstructPoint(XCoordinate=eval_2, YCoordinate=eval_3, ZCoordinate=remap_2.Mapped)
scale_nu_2 = ScaleNU(Geometry=pt, Plane=PlaneXY(0, 0, 0), ScaleX=remap_3.Mapped, ScaleY=remap_3.Mapped, ScaleZ=1)  # -> Geometry, Transform
intcrv_2 = Interpolate(Vertices=scale_nu_2.Geometry, Degree=3, Periodic=False, KnotStyle=1)  # -> reparameterize(Curve), Length, Domain
number_slider_3 = Slider(100, range=0..100)
divide_2 = DivideCurve(Curve=intcrv_2.Curve, Count=number_slider_3, Kinks=False)  # -> Points, Tangents, Parameters
pt_2 = Point(Point(0, 0, 0))
range_5 = Range(Domain=Domain(0, 1), Steps=number_slider_3)
vec2pt_2 = Vector2Pt(PointA=pt_2, PointB=divide_2.Points, Unitize=False)  # -> Vector, Length
graph_4 = GraphMapper(
    range_5,
    x0=0,
    x1=1,
    y0=0,
    y1=1,
    container_name="Bezier",
    cpx=[0, 0.2336956561, 0.3797094226, 1],
    cpy=[0, 0.5054347515, 0, 0])
devec_3 = DeconstructVector(Vector=vec2pt_2.Vector)  # -> XComponent, YComponent, ZComponent
vec_2 = VectorXYZ(XComponent=devec_3.XComponent, YComponent=devec_3.YComponent, ZComponent=0)  # -> Vector, Length
dom_2 = ConstructDomain(DomainStart=Slider(0.8, range=0..1), DomainEnd=Slider(1.7, range=0..10))
remap_4 = RemapNumbers(Value=graph_4, Source=Domain(0, 1), Target=dom_2)  # -> Mapped, Clipped
line_2 = LineSDL(Start=divide_2.Points, Direction=expr("-x", vec_2.Vector), Length=remap_4.Mapped)
Z = UnitZ(Factor=Slider(0.077, range=0..1))
loft_2 = Loft(Curves=line_2, Options={Adjust=False, Closed=False, LoftEnds=0, LoftSimp=0, LoftType=0, Rebuild=10, Refit=0.01})
extr_2 = Extrude(Base=loft_2, Direction=Z)
edges_2 = BrepEdges(Brep=loft_2)  # -> Naked, Interior, NonManifold
sort_2 = SortList(Keys=edges_2.Naked, ValuesA=edges_2.Naked)  # -> Keys, ValuesA
panel_3 = Panel("""2
3""")
item_3 = ListItem(List=sort_2.ValuesA, Index=panel_3, Wrap=True)
Z_2 = UnitZ(Factor=Slider(1.9, range=0..10))
extr_3 = Extrude(Base=item_3, Direction=Z_2)
cluster = Cluster(srf=extr_3, num=Slider(0.05, range=0..0.1))

md_slider = MDSlider(
    slider_value=Point(0, 0, 0.5),
    SliderMode=0,
    x_domain=Domain(-100, 100),
    y_domain=Domain(-100, 100),
    z_domain=Domain(0, 1))
remap_5 = RemapNumbers(Value=Slider(1, range=0..1), Source=Domain(0, 1), Target=Domain(0, 6.283185307))  # -> Mapped, Clipped
prot = RotatePlane(Plane=md_slider, Angle=remap_5.Mapped)
yz = YZPlane(Origin=prot)
distance = Number(Slider(3.934, range=0..10))
rectangle = Rectangle(Plane=yz, XSize=Slider(10, range=0..10), YSize=Slider(2.364, range=0..10), Radius=0)  # -> Rectangle, Length
cout = Integer(Slider(18, range=0..100))
series = Series(Start=0, Step=distance, Count=cout)
X = UnitX(Factor=1)
range_6 = Range(Domain=Domain(0, 1), Steps=expr("x-1", cout))
disc = Discontinuity(Curve=rectangle.Rectangle, Level=1)  # -> Points, Parameters
amp_2 = Amplitude(Vector=X, Amplitude=series)
graph_5 = GraphMapper(range_6, x0=0, x1=1, y0=0, y1=1, container_name="Sine", Equation_px=[0, 0.3466898501], Equation_py=[0, 1])
move = Move(Geometry=disc.Points, Motion=graft(amp_2))  # -> Geometry, Transform
item_4 = ListItem(List=move.Geometry, Index="2", Wrap=True)  # -> Item, Item1
num = Number(graph_5)
ln_2 = Line(StartPoint=item_4.Item, EndPoint=item_4.Item1)
Z_3 = UnitZ(Factor=1)
height = Number(Slider(2.633, range=0..10))
eval_4 = EvaluateCurve(Curve=ln_2, Parameter=graft(num))  # -> Point, Tangent, Angle
amp_3 = Amplitude(Vector=Z_3, Amplitude=height)
move_2 = Move(Geometry=eval_4.Point, Motion=amp_3)  # -> Geometry, Transform
multiplication = Multiplication(A=distance, B=Slider(0.8222, range=0..1))
ins = InsertItems(List=move.Geometry, Item=move_2.Geometry, Indices=3, Wrap=True)
X_2 = UnitX(Factor=1)
thickness = Number(multiplication)
pline_2 = PolyLine(Vertices=ins, Closed=True)
amp_4 = Amplitude(Vector=X_2, Amplitude=thickness)
move_3 = Move(Geometry=pline_2, Motion=amp_4)  # -> Geometry, Transform
merge = Merge(Data1=pline_2, Data2=move_3.Geometry)
gradient = Gradient(LowerLimit=0, UpperLimit=1, Parameter=num, stops=[0: RGB(0, 128, 0), 0.5: RGB(255, 255, 0), 1: RGB(255, 0, 0)])
boundary = BoundarySurfaces(Edges=merge)
extr_4 = Extrude(Base=pline_2, Direction=amp_4)
group = Group(Objects=[boundary, extr_4])
preview_2 = CustomPreview(Geometry=flatten(group), Shader=gradient)

# ==== cluster Cluster
srf = ClusterInput()
num = ClusterInput()
srf_2 = Surface(srf)
num_2 = Number(num)
offset = Offset(Surface=srf_2, Distance=num_2, Retrim=True)
edges = BrepEdges(Brep=srf_2)  # -> Naked, Interior, NonManifold
edges_2 = BrepEdges(Brep=offset)  # -> Naked, Interior, NonManifold
graft = GraftTree(Tree=edges_2.Naked, IncludeEmptyLists=True, IncludeNullItems=True)
graft_2 = GraftTree(Tree=edges.Naked, IncludeEmptyLists=True, IncludeNullItems=True)
merge = Merge(Data1=graft_2, Data2=graft)
loft = Loft(Curves=merge, Options={Adjust=False, Closed=False, LoftEnds=0, LoftSimp=0, LoftType=0, Rebuild=10, Refit=0.01})
join = BrepJoin(Breps=flatten([srf_2, loft, offset]))  # -> Breps, Closed
B = ClusterOutput(join.Breps)
