# Grasshopper definition Surface_Analysis.gh (Grasshopper 0.9.76)

box = Box()

# ----
# Box Corners
# 解析得到Box的八个角落
# 输入:Box       类型(box)
# 输出:cornerX*8 类型(point)
xy = XYPlane(Origin=Point(0, 0, 0))
box_2 = CenterBox(Base=xy, X=1, Y=1, Z=1)
box_corners = BoxCorners(Box=box_2)  # -> CornerA, CornerB, CornerC, CornerD, CornerE, CornerF, CornerG, CornerH
panel = Panel(box_corners.CornerA)
tbox = TwistedBox(
    CornerA=box_corners.CornerA,
    CornerB=box_corners.CornerB,
    CornerC=box_corners.CornerC,
    CornerD=box_corners.CornerD,
    CornerE=box_corners.CornerE,
    CornerF=box_corners.CornerF,
    CornerG=box_corners.CornerG,
    CornerH=box_corners.CornerH)

# ----
# Box Properties
# -------------------
# 返回Box的部分特性
# -------------------
# 输入：
# B(Box)
#     被分析的Box
# 输出：
# C(Point)
#     Box的中点
# D(Vector)
#     Box的对角向量
# A(Number)
#     Box的表面积
# V(Number)
#     Box的体积
# d(Integer)
#     退化情况
# 
# 退化情况是该算法为了普适计算，可接受多类型的Box：
# 接curve,degeneracy为1
# 接point,degeneracy为3
xy_2 = XYPlane(Origin=Point(0, 0, 0))
nurbs = NurbsCurve(
    Vertices=[Point(-0.5396071114, 2.046815825, 0), Point(1.084158872, 2.116147003, 0), Point(1.135722003, 2.723769012, 0), Point(-0.117417565, 3.21248751, 0)],
    Degree=3,
    Periodic=False)  # -> Curve, Length, Domain
box_3 = CenterBox(Base=xy_2, X=1, Y=1, Z=1)
crv = Curve(nurbs.Curve)
pt = Point([Point(-2.735856067, 2.522611672, 0), Point(0.03297808469, 2.663026553, 0), Point(-0.5040204836, 3.575451194, 0), Point(-2.281351019, 3.436836244, 0)])
box_corners_2 = BoxCorners(Box=box_3)  # -> CornerA, CornerB, CornerC, CornerD, CornerE, CornerF, CornerG, CornerH
boxprop = BoxProperties(Box=box_3)  # -> Center, Diagonal, Area, Volume, Degeneracy
panel_2 = Panel(boxprop.Area)
panel_3 = Panel(boxprop.Volume)
panel_4 = Panel(boxprop.Degeneracy)
addition = Addition(A=box_corners_2.CornerA, B=boxprop.Diagonal)
pt_2 = Point(box_corners_2.CornerG)
vdis = VectorDisplay(Anchor=box_corners_2.CornerA, Vector=boxprop.Diagonal)
panel_5 = Panel(addition)
panel_6 = Panel(pt_2)

# ----
# Deconstruct Box
# 把Box分解成它的组成部分
# 输入:Box        类型:Box
# 输出：Box Plane 类型:plane
#      X             domain
#      Y             domain
# 
# 说明可以通过plane和domain定义一个Box
#      Z             domain
xy_3 = XYPlane(Origin=Point(0, 0, 0))
box_4 = CenterBox(Base=xy_3, X=1, Y=1, Z=1)
debox = DeconstructBox(Box=box_4)  # -> Plane, X, Y, Z
panel_7 = Panel(debox.Plane)
panel_8 = Panel(debox.X)

# ----
# Evaluate Box
# -------------------
# 在标量化的UVW向量空间中，分析Box
# -------------------
# 输入：
# B(Box)
#     被分析的Box
# U(Number)
#     {u}参数（0,1之间的值在box内）
# V(Number)
#     {v}参数（0,1之间的值在box内）
# W(Number)
#     {w}参数（0,1之间的值在box内）
# 输出：
# Pl(Plane)
#     坐标平面
# Pt(Point)
#     坐标点
# I(Boolean)
#     如果在Box内部或在Box上返回True
number_slider = Slider(0.51, range=0..1)
number_slider_2 = Slider(0.45, range=0..1)
xy_4 = XYPlane(Origin=Point(0, 0, 0))
box_5 = CenterBox(Base=xy_4, X=1, Y=1, Z=1)
box_6 = EvaluateBox(Box=box_5, UParameter=number_slider, VParameter=Slider(1, range=0..1), WParameter=Slider(1.3, range=0..10))  # -> Plane, Point, Include
panel_9 = Panel("U,v,W任何一个值等于0或1，point在Box的表面上")
panel_10 = Panel(box_6.Plane)
panel_11 = Panel(box_6.Point)
panel_12 = Panel(box_6.Include)

xy_5 = XYPlane(Origin=Point(0, 0, 0))
cone = Cone(Base=PlaneXY(0, 0, 0), Radius=0.5, Length=1)  # -> Cone, Tip
sqgrid = Square(Plane=xy_5, Size=Slider(0.22, range=0..1), ExtentX=Slider(9, range=0..100), ExtentY=Slider(4, range=0..100))  # -> Cells, Points
srf = Surface(cone.Cone)
loft_opt = LoftOptions(Closed=False, Adjust=False, Rebuild=0, Refit=0, Type=3)
pline = PolyLine(Vertices=sqgrid.Points, Closed=False)
srfpt = SurfacePoints(Surface=srf)  # -> Points, Weights, Greville, UCount, VCount
loft = Loft(Curves=flatten(pline), Options=loft_opt)
srf_2 = Surface(loft)
srfpt_2 = SurfacePoints(Surface=srf_2)  # -> Points, Weights, Greville, UCount, VCount
lng = ListLength(List=flatten(sqgrid.Points))
panel_13 = Panel(srfpt_2.VCount)
lng_2 = ListLength(List=srfpt_2.Points)
panel_14 = Panel(srfpt_2.UCount)
panel_15 = Panel(lng)
panel_16 = Panel(lng_2)

panel_17 = Panel("""Dimensions
-------------------
得到曲面的近似尺寸
-------------------
输入：
S(Surface)
    待测量的曲面
输出：
U(Number)
    u方向上的尺寸近似值
V(Number)
    v方向上的尺寸近似值""")
number_slider_3 = Slider(0.5, range=0..1)
number_slider_4 = Slider(1, range=0..1)
cone_2 = Cone(Base=PlaneXY(0, 0, 0), Radius=number_slider_3, Length=number_slider_4)  # -> Cone, Tip
srf_3 = Surface(cone_2.Cone)
eval = Evaluate(F="2*pi*x", x=number_slider_3)
eval_2 = Evaluate(F="sqrt(x*x+y*y)", x=number_slider_3, y=number_slider_4)
dim = Dimensions(Surface=srf_3)  # -> UDimension, VDimension
panel_18 = Panel(eval)
panel_19 = Panel(eval_2)
panel_20 = Panel(dim.UDimension)
panel_21 = Panel(dim.VDimension)
panel_22 = Panel("周长和母线长")

panel_23 = Panel("""Brep Topology
-------------------
返回显示Brep的拓扑
-------------------""")
xy_6 = XYPlane(Origin=Point(0, 0, 0))
box_7 = CenterBox(Base=xy_6, X=1, Y=1, Z=1)
topology = BrepTopology(Brep=box_7, PerspectiveOnly=False)  # -> FaceFaceAdjacency, FaceEdgeAdjacency, EdgeFaceAdjacency
panel_24 = Panel("拓扑资料")

# ----
# Brep Edges
# -------------------
# 提取brep的边缘曲线
# -------------------
# 输入：
# B(Brep)
#     基础Brep
# 输出：
# En(Curve)
#     Naked edge curves
# Ei(Curve)
#     实质边缘曲线
# Em(Curve)
#     非样条边缘曲线
# 
# 边缘曲线用这个运算器，至于这几个概念不易区分的情况，多尝试理解
number_slider_5 = Slider(0.111, range=0..1)
nurbs_2 = NurbsCurve(
    Vertices=[Point(-0.5396071114, 2.046815825, 0), Point(1.084158872, 2.116147003, 0), Point(1.135722003, 2.723769012, 0), Point(-0.117417565, 3.21248751, 0)],
    Degree=3,
    Periodic=False)  # -> Curve, Length, Domain
crv_2 = Curve(nurbs_2.Curve)
box_8 = CenterBox(Base=PlaneXY(0, 0, 0), X=1, Y=1, Z=1)
sph = Sphere(Base=PlaneXY(0, 0, 0), Radius=1)
cone_3 = Cone(Base=PlaneXY(0, 0, 0), Radius=0.5, Length=1)  # -> Cone, Tip
cyl = Cylinder(Base=PlaneXY(0, 0, 0), Radius=0.5, Length=1)
pipe = Pipe(Curve=crv_2, Radius=number_slider_5, Caps=0)
brep = Brep(box_8)
edges = BrepEdges(Brep=brep)  # -> Naked, Interior, NonManifold
panel_25 = Panel(edges.Naked)
panel_26 = Panel(edges.Interior)
panel_27 = Panel(edges.NonManifold)

# ----
# Deconstruct Brep
# -------------------
# 分解brep得到它的组成部分
# -------------------
# 输入：
# B(Brep)
#     基础Brep
# 输出：
# Faces(Surface)
#     Brep的面
# Edge(Curve)
#     Brep的边缘曲线
# Vertices(Point)
#     Brep的顶点
# 思考题：用Iso Curve运算器搭配所学其他运算器，实现Wireframe的效果
xy_7 = XYPlane(Origin=Point(0, 0, 0))
box_9 = CenterBox(Base=xy_7, X=1, Y=1, Z=1)
cone_4 = Cone(Base=PlaneXY(0, 0, 0), Radius=0.5, Length=1)  # -> Cone, Tip
brep_2 = Brep(box_9)
panel_28 = Panel("区分Box和Brep分解")
debox_2 = DeconstructBox()  # -> Plane, X, Y, Z
debrep = DeconstructBrep(Brep=brep_2)  # -> Faces, Edges, Vertices
cluster = Cluster()
item = ListItem(List=debrep.Faces, Index=0, Wrap=True)
iso = IsoCurve(Surface=item)  # -> UIsocurve, VIsocurve

# ----
# Is Planar
# -------------------
# 检测一个Surface是否为平面曲面
# -------------------
# 输入：
# S(Surface)
#     待检测的曲面
# I(Boolean)
#     用于检测的平面曲面是否穿过Surfaces
# 输出：
# p(Boolean)
#     Surface的平面性
# P(Plane)
#     平面
number_slider_6 = Slider(1, range=0..1)
nurbs_3 = NurbsCurve(
    Vertices=[Point(-0.5396071114, 2.046815825, 0), Point(1.084158872, 2.116147003, 0), Point(1.135722003, 2.723769012, 0), Point(-0.117417565, 3.21248751, 0)],
    Degree=3,
    Periodic=False)  # -> Curve, Length, Domain
Z = UnitZ(Factor=1)
crv_3 = Curve(nurbs_3.Curve)
extr = Extrude(Base=crv_3, Direction=Z)
cone_5 = Cone(Base=PlaneXY(0, 0, 0), Radius=0.5, Length=1)  # -> Cone, Tip
planesrf = PlaneSurface(Plane=PlaneXY(0, 0, 0), XSize=number_slider_6, YSize=number_slider_6)
srf_4 = Surface(planesrf)
planar = IsPlanar(Surface=srf_4, Interior=Toggle(False))  # -> Planar, Plane
panel_29 = Panel(planar.Plane)
panel_30 = Panel(planar.Planar)

# ----
# Brep Wireframe
# -------------------
# 抽离缠绕着brep的曲线
# -------------------
# 输入：
# B(Brep)
#     基础Brep
# D(Integer)
#     缠绕曲线的结构线密度
# 输出：
# W(Curve)
#     Wireframe curves
# 
# 可以类比绕毛线球
xy_8 = XYPlane(Origin=Point(0, 0, 0))
box_10 = CenterBox(Base=xy_8, X=1, Y=1, Z=1)
brep_3 = Brep(box_10)
wires = BrepWireframe(Brep=brep_3, Density=Slider(4, range=0..10))
curvepoint = PointOnCurve(wires, parameter=0.5)
points = PointList(Points=curvepoint, Size=Slider(0.16, range=0..10))
panel_31 = Panel(wires)

# ==== cluster Cluster
S = ClusterInput()
iso = IsoCurve(Surface=S)  # -> UIsocurve, VIsocurve
