# Grasshopper definition Surface_Freeforms.gh (Grasshopper 0.9.76)

pt = Point([Point(9.827565524, -3.10955794, 0), Point(1.3008132, 6.846955749, 0), Point(-6.782242871, -2.263836977, 0), Point(2.308475903, -8.132383039, 6.105145112)])
pt_2 = Point([Point(12.01150176, -1.181930227, 0), Point(10.47528685, 1.719474853, 1.22760975), Point(11.18960901, 4.348718982, 1.22760975), Point(4.849466013, 1.793857266, 3.334789095), Point(11.76386682, 2.564958832, 4.210888747), Point(16.48911077, 3.632256082, 5.969791209)])
item = ListItem(List=pt, Index=0, Wrap=True)  # -> Item, Item1, Item2, Item3
srf4pt = _4PointSurface(CornerA=item.Item, CornerB=item.Item1, CornerC=item.Item2, CornerD=item.Item3)
debrep = DeconstructBrep(Brep=srf4pt)  # -> Faces, Edges, Vertices
srfgrid = SurfaceFromPoints(Points=pt_2, UCount=Slider(2, range=0..10), Interpolate=Toggle(True))
panel = Panel(debrep.Vertices)
extr = Extrude()
patch = Patch(Spans=20, Flexibility=1, Trim=True)
fpatch = FragmentPatch()
pipe = Pipe(Radius=1, Caps=0)
vpipe = PipeVariable(Caps=0)
railrev = RailRevolution(Scale=False)
