# Grasshopper definition 160929_PE_points_intersection_008_vectorElection.gh (Grasshopper 0.9.76)

# kernel intersection algorithm 002_siftPoint
panel = Panel("""0
0.4
1
1.5
1.5
1.92

2.05
2.1
2.4
2.3
2.3
2.1
3
3.12
3.11
3.12""")
panel_2 = Panel("""0
1
2
3
2
2
3
1
2
1
0
0
2
0
1
3""")

# ----
# Point:indicate a position in space
# Line:length,direction,position
# Point
# two ends of the line
# the intersection of two lines
# the meeting of lines at the corner of a space or volumn
# the center of field
# log:
# 20161010
# 设计向量方向与数据结构之间的映射关系
# 数据结构用集合运算然后替换
# 替换树形结构的时候需要拍平
# 无论什么情况都留出0123正交的位置为Null
# 如果0123存在，没关系，不存在，插入一个空值
panel_3 = Panel("2")
# {0,0}-->0/2*pi
# 0/2*pi <= a< 1/2*pi
# {1,0}-->1/2*pi
# 1/2*pi <= a < 2/2*pi
# {2,0}-->2/2*pi
# 2/2*pi <= a < 3/2*pi
# {3,0}-->3/2*pi
# 3/2*pi <= a < 4/2*pi
# log:
# 20161010
# 如果0123存在，没关系，不存在，插入一个空值
# 光是插入一个空值也是不行，修改标签运算的算法使其更合理:原因是set的时候把null去掉了
# 应该是插入不是替换
# 不是插入一个Null就能解决问题的，问题处在了member的寻找上，寻找时候把null数据给删除了，结果找不到对应的path
pi = Pi(Factor=panel_3)
random = Random(Range=pi, Number="20", Seed=Slider(33.222, range=0..100))

panel_4 = Panel("""0
2
1
3""")

pi_2 = Pi(Factor=1)
ins = InsertItems(List=random, Item=pi_2, Indices="0", Wrap=True)

# ----
# {0;0} --> 0
# {1;0} --> 1/2*pi
# {2;0} --> pi
# {3;0} --> 3/2*pi
# 当向量中不存在某正交方向时候为Null
panel_5 = Panel("2")
pi_3 = Pi(Factor=panel_5)
num = Number(panel_4)
remap = RemapNumbers(Value=num, Source="4", Target=pi_3)  # -> Mapped, Clipped
pi_4 = Pi(Factor=1)
sort = SortList(Keys=remap.Mapped)  # -> Keys, ValuesA
division = Division(A=pi_4, B="2")
angle = Number(sort.Keys)
series = Series(Start=0, Step=division, Count="5")
consec = ConsecutiveDomains(Numbers=series, Additive=False)  # -> simplify(Domains)
domain = Domain(graft(consec))
dedomain = DeconstructDomain(Domain=domain)  # -> Start, End
larger = LargerThan(FirstNumber=angle, SecondNumber=dedomain.Start)  # -> LargerThan, OrEqualTo
smaller = SmallerThan(FirstNumber=angle, SecondNumber=dedomain.End)  # -> SmallerThan, OrEqualTo
and = GateAnd(A=larger.OrEqualTo, B=smaller.SmallerThan)
sift = SiftPattern(List=angle, SiftPattern=and)  # -> Output0, Output1
clean = CleanTree(RemoveNulls=True, RemoveInvalid=True, RemoveEmpty=False, Tree=sift.Output1)  # -> simplify(Tree)
item = ListItem(List=clean, Index="0", Wrap=True)
equals = Equality(FirstNumber=item, SecondNumber=simplify(dedomain.Start))  # -> Equality, Inequality
int = Integer(equals.Inequality)
ins_2 = InsertItems(List=clean, Indices="0", Wrap=True)
neg = Negative(Value=int)
cull_i = CullIndex(List=ins_2, Indices=neg, Wrap=False)  # -> simplify(List)
num_2 = Number(cull_i)
cset = CreateSet(List=num_2)  # -> Set, Map
addition = Addition(A=cset.Map, B=int)
tstat = TreeStatistics(Tree=addition)  # -> Paths, Length, Count
dpath = DeconstructPath(Branch=tstat.Paths)
graft = GraftTree(Tree=addition, IncludeEmptyLists=True, IncludeNullItems=True)
stack = StackData(Data=dpath, Stack=graft(tstat.Length))
graft_2 = GraftTree(Tree=cull_i, IncludeEmptyLists=True, IncludeNullItems=True)
graft_3 = GraftTree(Tree=stack, IncludeEmptyLists=True, IncludeNullItems=True)  # -> simplify(Tree)
ins_3 = InsertItems(List=graft_3, Item=graft, Indices="-1", Wrap=True)
path = ConstructPath(Indices=ins_3)  # -> simplify(Branch)
viewer = ParamViewer(graft_2)
flatten = FlattenTree(Tree=path, Path="{0}")
replace = ReplacePaths(Data=graft_2, Search=viewer, Replace=flatten)

# ----
# log:
# 20161010
# 不是插入一个Null就能解决问题的，问题处在了member的寻找上，寻找时候把null数据给删除了，结果找不到对应的path:
# 找到替换的member的运算器
# 发现前馈需要一大堆的运算器，先做成后馈
# log:
# 20161010
# 发现前馈需要一大堆的运算器，先做成后馈
# 如果需要前反馈，可能需要修改标签运算的算法，所以先后馈，至少能做下去
# 重新Partition
# 还是回到前馈
panel_6 = Panel(sort.Keys)

# ----
# ErrorSample0
toggle = BooleanToggle(True)
panel_7 = Panel("""tim
my""")
panel_8 = Panel([toggle, Toggle(False)])
series_2 = Series(Start=0, Step=1, Count=10)
panel_9 = Panel("""5
7""")
bool = Boolean(panel_8)
sift_2 = SiftPattern(List=panel_7, SiftPattern=bool)  # -> Output0, Output1
ins_4 = InsertItems(List=series_2, Item=sift_2.Output1, Indices=panel_9, Wrap=True)  # -> simplify(List)
clean_2 = CleanTree(RemoveNulls=True, RemoveInvalid=True, RemoveEmpty=False, Tree=ins_4)

# ----
# ErrorSample1-DataTree
toggle_2 = BooleanToggle(True)
panel_10 = Panel([Toggle(True), Toggle(False), toggle_2])
panel_11 = Panel("""tim
my
name""")
bool_2 = Boolean(panel_10)
series_3 = Series(Start=0, Step=1, Count=3)  # -> simplify(graft(Series))
graft_4 = GraftTree(Tree="0", IncludeEmptyLists=True, IncludeNullItems=True)  # -> graft(Tree)
sift_3 = SiftPattern(List=graft(panel_11), SiftPattern=graft(bool_2))  # -> Output0, Output1
ins_5 = InsertItems(List=series_3, Item=sift_3.Output1, Indices=graft_4, Wrap=True)  # -> simplify(List)
clean_3 = CleanTree(RemoveNulls=True, RemoveInvalid=True, RemoveEmpty=False, Tree=ins_5)
panel_12 = Panel(clean_3)

# ----
# Sample2-cleanTree
toggle_3 = BooleanToggle(False)
panel_13 = Panel([Toggle(False), Toggle(True), toggle_3])
panel_14 = Panel("""tim
my
name""")
bool_3 = Boolean(panel_13)
series_4 = Series(Start=0, Step=1, Count=3)  # -> simplify(graft(Series))
graft_5 = GraftTree(Tree="0", IncludeEmptyLists=True, IncludeNullItems=True)  # -> graft(Tree)
sift_4 = SiftPattern(SiftPattern=graft(bool_3))  # -> Output0, Output1
ins_6 = InsertItems(List=series_4, Item=sift_4.Output1, Indices=graft_5, Wrap=True)  # -> simplify(List)
clean_4 = CleanTree(RemoveNulls=True, RemoveInvalid=True, RemoveEmpty=False, Tree=ins_6)
panel_15 = Panel(clean_4)

# ----
# log:
# 20161010
# 应该是插入不是替换：
# 连一个新电池，是True就插入，False就不插入
# 简短的并不需要连接电池
# 插入的应该是一个Null值，而不是正交角度
panel_16 = Panel("0")
item_2 = ListItem(List=clean, Index=panel_16, Wrap=True)
equals_2 = Equality(FirstNumber=item_2, SecondNumber=simplify(dedomain.Start))  # -> Equality, Inequality
num_3 = Number(clean)
neg_2 = Negative(Value=equals_2.Inequality)
ins_7 = InsertItems(List=num_3, Indices=graft("0"), Wrap=True)
cull_i_2 = CullIndex(List=ins_7, Indices=neg_2, Wrap=False)  # -> simplify(List)

# ----
# log:
# 20161010
# 插入的应该是一个Null值，而不是正交角度:
# 先保留空值，后根据boolean删除Null
# 插入一个空值的方法：
# 运用cull index运算器本身的性质，对布尔值进行negetive后删除不需要的空值
toggle_4 = BooleanToggle(False)
series_5 = Series(Start=0, Step=1, Count=3)  # -> simplify(graft(Series))
graft_6 = GraftTree(Tree="0", IncludeEmptyLists=True, IncludeNullItems=True)  # -> graft(Tree)
panel_17 = Panel([Toggle(False), Toggle(True), toggle_4])
bool_4 = Boolean(panel_17)
ins_8 = InsertItems(List=series_5, Indices=graft_6, Wrap=True)  # -> simplify(List)
int_2 = Integer(bool_4)
neg_3 = Negative(Value=int_2)
cull_i_3 = CullIndex(List=ins_8, Indices=graft(neg_3), Wrap=False)
panel_18 = Panel(cull_i_3)

panel_19 = Panel(ins_5)
panel_20 = Panel(clean_2)

# ----
# sample_treeStatistics
cset_2 = CreateSet(List=num_2)  # -> Set, Map
tstat_2 = TreeStatistics(Tree=cset_2.Map)  # -> Paths, Length, Count
dpath_2 = DeconstructPath(Branch=tstat_2.Paths)
stack_2 = StackData(Data=dpath_2, Stack=graft(tstat_2.Length))
graft_7 = GraftTree(Tree=cset_2.Map, IncludeEmptyLists=True, IncludeNullItems=True)
graft_8 = GraftTree(Tree=stack_2, IncludeEmptyLists=True, IncludeNullItems=True)  # -> simplify(Tree)
ins_9 = InsertItems(List=graft_8, Item=graft_7, Indices="-1", Wrap=True)
path_2 = ConstructPath(Indices=ins_9)  # -> simplify(Branch)
flatten_2 = FlattenTree(Tree=path_2, Path="{0}")

# ----
# log:
# 20161010
# 还是回到前馈：
# 用set运算器自带的index记录，与boolean值进行相加，对path运算得到新的path
# 记得替换数据结构的时候拍平
num_4 = Number(clean)
cset_3 = CreateSet(List=num_4)  # -> Set, Map
graft_9 = GraftTree(Tree=num_4, IncludeEmptyLists=True, IncludeNullItems=True)
flatten_3 = FlattenTree(Tree=cset_3.Set, Path="{0}")
graft_10 = GraftTree(Tree=cset_3.Set, IncludeEmptyLists=True, IncludeNullItems=True)
viewer_2 = ParamViewer(graft_9)
mindex = MemberIndex(Set=flatten_3, Member=num_4)  # -> Index, Count
tstat_3 = TreeStatistics(Tree=graft_10)  # -> Paths, Length, Count
item_3 = ListItem(List=tstat_3.Paths, Index=mindex.Index, Wrap=True)  # -> flatten(Item)
replace_2 = ReplacePaths(Data=graft_9, Search=viewer_2, Replace=item_3)

panel_21 = Panel(replace)

pshift = ShiftPaths(Data=replace_2, Offset=-1)
item_4 = ListItem(List=pshift, Index="0", Wrap=True)
equals_3 = Equality(FirstNumber=item_4, SecondNumber=simplify(dedomain.Start))  # -> Equality, Inequality
int_3 = Integer(equals_3.Inequality)
ins_10 = InsertItems(List=pshift, Indices="0", Wrap=True)
neg_4 = Negative(Value=int_3)
cull_i_4 = CullIndex(List=ins_10, Indices=neg_4, Wrap=False)  # -> simplify(List)

flatten_4 = FlattenTree(Tree=cull_i_4, Path="{0}")
null = NullItem(Item=flatten_4)  # -> NullFlags, InvalidFlags, Description
tstat_4 = TreeStatistics(Tree=replace_2)  # -> Paths, Length, Count
mindex_2 = MemberIndex(Set=null.NullFlags, Member=Toggle(True))  # -> Index, Count
int_4 = Integer(tstat_4.Length)
ins_11 = InsertItems(List=int_4, Item="1", Indices=mindex_2.Index, Wrap=True)
partition = PartitionList(List=flatten_4, Size=ins_11)  # -> simplify(Chunks)
viewer_3 = ParamViewer(partition)
viewer_4 = ParamViewer(replace_2)
replace_3 = ReplacePaths(Data=partition, Search=viewer_3, Replace=viewer_4)

panel_23 = Panel("""0
1
0
1.3
3
1
2""")

# ----
# {0;0} --> 0
# {1;0} --> 1/2*pi
# {2;0} --> pi
# {3;0} --> 3/2*pi
# 当向量中不存在某正交方向时候为Null
panel_24 = Panel("2")
pi_5 = Pi(Factor=panel_24)
num_5 = Number(panel_23)
pi_6 = Pi(Factor=1)
remap_2 = RemapNumbers(Value=num_5, Source="4", Target=pi_5)  # -> Mapped, Clipped
division_2 = Division(A=pi_6, B="2")
sort_2 = SortList(Keys=remap_2.Mapped)  # -> Keys, ValuesA
series_6 = Series(Start=0, Step=division_2, Count="5")
consec_2 = ConsecutiveDomains(Numbers=series_6, Additive=False)  # -> simplify(Domains)
domain_2 = Domain(graft(consec_2))
angle_2 = Number(sort_2.Keys)
dedomain_2 = DeconstructDomain(Domain=domain_2)  # -> Start, End
smaller_2 = SmallerThan(FirstNumber=angle_2, SecondNumber=dedomain_2.End)  # -> SmallerThan, OrEqualTo
larger_2 = LargerThan(FirstNumber=angle_2, SecondNumber=dedomain_2.Start)  # -> LargerThan, OrEqualTo
and_2 = GateAnd(A=larger_2.OrEqualTo, B=smaller_2.SmallerThan)
sift_5 = SiftPattern(List=angle_2, SiftPattern=and_2)  # -> Output0, Output1
clean_5 = CleanTree(RemoveNulls=True, RemoveInvalid=True, RemoveEmpty=False, Tree=sift_5.Output1)  # -> simplify(Tree)
item_5 = ListItem(List=clean_5, Index="0", Wrap=True)
equals_4 = Equality(FirstNumber=item_5, SecondNumber=simplify(dedomain_2.Start))  # -> Equality, Inequality
int_5 = Integer(equals_4.Inequality)
ins_12 = InsertItems(List=clean_5, Indices="0", Wrap=True)
neg_5 = Negative(Value=int_5)
cull_i_5 = CullIndex(List=ins_12, Indices=neg_5, Wrap=False)  # -> simplify(List)
num_6 = Number(cull_i_5)
cset_4 = CreateSet(List=num_6)  # -> Set, Map
addition_2 = Addition(A=cset_4.Map, B=int_5)
tstat_5 = TreeStatistics(Tree=addition_2)  # -> Paths, Length, Count
dpath_3 = DeconstructPath(Branch=tstat_5.Paths)
graft_11 = GraftTree(Tree=addition_2, IncludeEmptyLists=True, IncludeNullItems=True)
stack_3 = StackData(Data=dpath_3, Stack=graft(tstat_5.Length))
graft_12 = GraftTree(Tree=cull_i_5, IncludeEmptyLists=True, IncludeNullItems=True)
graft_13 = GraftTree(Tree=stack_3, IncludeEmptyLists=True, IncludeNullItems=True)  # -> simplify(Tree)
ins_13 = InsertItems(List=graft_13, Item=graft_11, Indices="-1", Wrap=True)
path_3 = ConstructPath(Indices=ins_13)  # -> simplify(Branch)
viewer_5 = ParamViewer(graft_12)
flatten_5 = FlattenTree(Tree=path_3, Path="{0}")
replace_4 = ReplacePaths(Data=graft_12, Search=viewer_5, Replace=flatten_5)

num_7 = Number(Toggle(False))
line = Line(Line((119.3393443, -60.78584412, 0), (119.6525493, -60.78584412, 0)))
line_2 = Line(Line((119.8096632, -60.78584412, 0), (119.4931182, -60.78584412, 0)))
panel_25 = Panel("运算器存在bug")
ccx = CurveCurve(CurveA=line, CurveB=line_2)  # -> Points, ParamsA, ParamsB
panel_26 = Panel(and_2)
line_bug_commonline = Line([Line((119.3540923, -60.56923774, 0), (119.5008735, -60.56923774, 0)), Line((119.5919791, -60.56923774, 0), (119.7404475, -60.56923774, 0))])
# debug:之前判断是实交和虚交的方法是判断交点point的x坐标是否在两线段的值域范围内，但是当上述情况的时候，直线会虚交被误判成实际交点
line_bug_insectiononextend = Line([Line((119.0174668, -60.28107794, 0), (119.4638718, -60.28107794, 0)), Line((119.2255633, -60.35451331, 0), (119.2255633, -61.15203638, 0))])
# log:
# 20161010
# 设计向量方向与数据结构之间的映射关系
# 分离对应的算法，让算法之间有通过也有分离
# 线线重合的问题解决后先放在一旁
# 数据结构的替换，在最后做
line_3 = Line([Line((119.5723897, -60.99532941, 0), (119.5723897, -61.13933165, 0)), Line((119.5723897, -60.99532941, 0), (119.7626783, -60.99532941, 0))])
panel_27 = Panel(sift_5.Output1)

# ----
# kernel intersection algorithm 001_trial
line_length = Panel("""3.2
5.1
6.3
4.2""")
panel_28 = Panel("""0
1
2
3""")
md_slider = MDSlider(
    slider_value=Point(0.5132578379, 0.5396976122, 0.5),
    SliderMode=0,
    x_domain=Domain(-100, 100),
    y_domain=Domain(-100, 100),
    z_domain=Domain(0, 1))  # disabled
line_length_2 = Number(line_length)
startpoint = Point(md_slider)  # disabled
int_6 = Integer(panel_28)
number_slider = Slider(0.52, range=0..100)  # disabled
number_slider_2 = Slider(2.4, range=0..100)  # disabled
number_slider_3 = Slider(7.61, range=0..100)  # disabled
number_slider_4 = Slider(6.19, range=0..100)  # disabled
item_6 = ListItem(List=["1,0", "0,1", "-1,0", "0,-1"], Index=int_6, Wrap=True)
item_7 = ListItem(List=line_length_2, Index=0, Wrap=True)
X = UnitX(Factor=1)
basicvector = Vector(item_6)
merge = Merge(Data1=number_slider, Data2=number_slider_2)  # disabled
merge_2 = Merge(Data1=number_slider_3, Data2=number_slider_4)  # disabled
amp = Amplitude(Vector=X, Amplitude=item_7)  # disabled
line_4 = LineSDL(Start=startpoint, Direction=X, Length=item_7)  # disabled
complex = ComplexComponents(Complex=startpoint)  # -> Real, Imaginary; disabled
pt = PointOriented(BasePlane=startpoint, UComponent=merge, VComponent=merge_2, WComponent=0)  # disabled
complex_2 = ComplexComponents(Complex=amp)  # -> Real, Imaginary; disabled
complex_3 = CreateComplex(Real=complex.Real, Imaginary=complex.Imaginary)  # disabled
complex_4 = CreateComplex(Real=complex_2.Real, Imaginary=complex_2.Imaginary)  # disabled
item_8 = ListItem(List=pt, Index=0, Wrap=True)  # -> Item, Item1; disabled
X_2 = UnitX(Factor=1)  # disabled
Y = UnitY(Factor=1)  # disabled
addition_3 = Addition(A=complex_3, B=complex_4)  # disabled
line_5 = LineSDL(Start=item_8.Item1, Direction=Y, Length=item_7)  # disabled
line_6 = LineSDL(Start=item_8.Item, Direction=X_2, Length=item_7)  # disabled
panel_29 = Panel(addition_3)  # disabled
panel_30 = Panel("""1,2
2,1""")  # disabled
panel_31 = Panel("""2.0,2.0,0.0
-0.5,4.0,0.0""")  # disabled
panel_32 = Panel(complex_3)  # disabled
startpoint_2 = Point(panel_30)  # disabled
vec = Vector(panel_31)  # disabled
addition_4 = Addition(A=startpoint_2, B=vec)  # disabled
vec2pt = Vector2Pt(PointA=startpoint_2, PointB=addition_4, Unitize=False)  # -> Vector, Length; disabled
ln = Line(StartPoint=startpoint_2, EndPoint=addition_4)  # disabled
endpoint = Point(addition_4)  # disabled

panel_33 = Panel("把正交和斜交的情况分离开来，同时组织数据结构")

# ----
# 首点坐标相对于第一点
line_7 = Line([Line((-28.43570879, -32.87535514, 0), (26.13975502, -11.96140003, 0)), Line((18.7700756, 6.164027732, 0), (13.19302091, -43.43192296, 0)), Line((-30.62669456, -19.7294405, 0), (35.30205917, -38.25322931, 0)), Line((2.835633616, -1.404832213, 0), (-1.54633793, -45.62290873, 0))])  # disabled
panel_34 = Panel("1")  # disabled
linelist = Curve(line_7)  # disabled
lng = ListLength(List=linelist)  # disabled
subtraction = Subtraction(A=lng, B=panel_34)  # disabled
series_7 = Series(Start=0, Step=1, Count=subtraction)  # disabled
addition_5 = Addition(A=series_7, B=panel_34)  # disabled
item_9 = ListItem(List=linelist, Index=series_7, Wrap=False)  # -> simplify(graft(Item)); disabled
shift = ShiftList(List=linelist, Shift=addition_5, Wrap=False)  # -> simplify(List); disabled
end = EndPoints(Curve=item_9)  # -> Start, End; disabled
end_2 = EndPoints(Curve=shift)  # -> Start, End; disabled

panel_35 = Panel(remap_2.Mapped)
mindex_3 = MemberIndex(Set=panel_35, Member=simplify(graft(replace_4)))  # -> Index, Count
# instance
panel_36 = Panel(replace_4)
panel_37 = Panel(mindex_3.Index)
panel_38 = Panel("描述方法只是数据结构的不同，先用几何代表抽象的数据结构")
panel_39 = Panel("""多条线且含有多折线连线组织数据结构问题
得到交点
交点的path替换""")
panel_40 = Panel("""x0,y0;0,1,2,3
x1,y0;0,3,2""")
crv = Curve([<curve referenced from the Rhino model> x3])
crv_2 = Curve([<curve referenced from the Rhino model> x4])
explode = Explode(Curve=crv_2, Recursive=True)  # -> Segments, Vertices
end_3 = EndPoints(Curve=crv_2)  # -> Start, End
neg_6 = Negative(Value="1")
shift_2 = ShiftList(List=explode.Vertices, Shift="1", Wrap=False)
shift_3 = ShiftList(List=explode.Vertices, Shift=neg_6, Wrap=False)

panel_41 = Panel("""1,0
0,1
-1,0
0,-1""")
vec_2 = Vector(panel_41)

# ----
# describe space by (point;index) of vector
md_slider_2 = MDSlider(
    slider_value=Point(0.5591201782, 0.4691162109, 0.5),
    SliderMode=0,
    x_domain=Domain(-1000, 1000),
    y_domain=Domain(-1000, 1000),
    z_domain=Domain(0, 1))
panel_42 = Panel("""0
1
2
3""")
line_length_3 = Panel("""3.2
5.1
3.2
5.1""")
line_length_4 = Number(line_length_3)
int_7 = Integer(panel_42)
lng_2 = ListLength(List=int_7)
series_8 = Series(Start=0, Step=1, Count=lng_2)
item_10 = ListItem(List=vec_2, Index=int_7, Wrap=True)
item_11 = ListItem(List=line_length_4, Index=series_8, Wrap=True)
basicvectorunit = Vector(item_10)
amp_2 = Amplitude(Vector=basicvectorunit, Amplitude=item_11)
ma = MassAddition(Input=amp_2)  # -> Result, PartialResults
addition_6 = Addition(A=md_slider_2, B=ma.PartialResults)
pt_2 = Point(addition_6)
shift_4 = ShiftList(List=ma.PartialResults, Shift=-1, Wrap=True)
complex_5 = ComplexComponents(Complex=shift_4)  # -> Real, Imaginary
concat = Concatenate(FragmentA=complex_5.Real, FragmentB=complex_5.Imaginary, JoinSeparator=",")
pline = PolyLine(Vertices=pt_2, Closed=True)
concat_2 = Concatenate(FragmentA=concat, FragmentB=int_7, JoinSeparator=";")

subtraction_2 = Subtraction(A=shift_2, B=shift_3)

graft_14 = GraftTree(Tree=end_3.Start, IncludeEmptyLists=True, IncludeNullItems=True)  # -> simplify(Tree)
subtraction_3 = Subtraction(A=graft_14, B="{0,0,0}")  # -> flatten(Result)
item_12 = ListItem(List=subtraction_3, Index="0", Wrap=True)
subtraction_4 = Subtraction(A=graft_14, B=item_12)

unit = UnitVector(Vector=subtraction_2)
vec_3 = Vector(subtraction_2)
len = Length(Curve=explode.Segments)  # -> simplify(Length)
pshift_2 = ShiftPaths(Data=unit, Offset=-1)
mindex_4 = MemberIndex(Set=vec_2, Member=pshift_2)  # -> Index, Count
vdis = VectorDisplay(Anchor=shift_3, Vector=vec_3)
pshift_3 = ShiftPaths(Data=mindex_4.Index, Offset=-1)  # -> simplify(Data)

vecdirection = Integer(pshift_3)
veclength = Number(len)
pt_3 = Point(graft_14)

panel_43 = Panel(vec_2)
item_13 = ListItem(List=vec_2, Index=vecdirection, Wrap=True)
amp_3 = Amplitude(Vector=item_13, Amplitude=veclength)
ma_2 = MassAddition(Input=amp_3)  # -> Result, PartialResults
addition_7 = Addition(A=pt_3, B=ma_2.PartialResults)
pt_4 = Point(addition_7)
ins_14 = InsertItems(List=addition_7, Item=pt_3, Indices="0", Wrap=True)
neg_7 = Negative(Value="1")
panel_44 = Panel(concat_2)
panel_45 = Panel(pt_3)
panel_46 = Panel(amp_2)
panel_47 = Panel(ins_14)
shift_5 = ShiftList(List=ins_14, Shift=neg_7, Wrap=False)  # -> simplify(List)

# ----
# tree data trial
# first point 和 end point 的数据结构组织的方式是同一种的
# 
# 先手工傻做，再寻找规律
# 
# 先不管结构如何，把他们放在一起，结构在外部运算，在替换成对的树形数据
# 上升数据结构后手工或者数列
# 上升后全部拍平处理
# 用stack+listItem对拍平的数据处理
# 
# 留下来的问题是数据结构的替换
# 手工
pt_5 = Point(shift_5)
graft_15 = GraftTree(Tree=pt_5, IncludeEmptyLists=True, IncludeNullItems=True)

panel_48 = Panel(pt_5)

flatten_6 = FlattenTree(Tree=graft_15, Path="{0}")
tstat_6 = TreeStatistics(Tree=pt_5)  # -> Paths, Length, Count
tstat_7 = TreeStatistics(Tree=graft_15)  # -> Paths, Length, Count
ma_3 = MassAddition(Input=tstat_6.Length)  # -> Result, PartialResults
series_9 = Series(Start=0, Step=1, Count=tstat_7.Count)
stack_4 = StackData(Data=ma_3.PartialResults, Stack=tstat_6.Length)
shift_6 = ShiftList(List=series_9, Shift=stack_4, Wrap=False)
item_14 = ListItem(List=flatten_6, Index=shift_6, Wrap=True)  # -> simplify(Item)

panel_49 = Panel(tstat_6.Length)
lng_3 = ListLength(List=item_14)
panel_50 = Panel(graft_15)
stack_5 = StackData(Data=graft_15, Stack=lng_3)

bang = ExplodeTree(Data=graft_15)  # -> Branch0, Branch1, Branch2, Branch3, Branch4, Branch5
merge_3 = Merge(Data1=bang.Branch1, Data2=bang.Branch2, Data3=bang.Branch3, Data4=bang.Branch4, Data5=bang.Branch5)
entwine = Entwine(
    Branch00=merge_3,
    Branch01=bang.Branch5,
    Branch02=bang.Branch5,
    Branch03=bang.Branch5,
    Branch04=bang.Branch5,
    FlattenInputs=True)

shift_7 = ShiftList(List=ins_14, Shift="1", Wrap=False)  # -> simplify(List)
graft_16 = GraftTree(Tree=stack_5, IncludeEmptyLists=True, IncludeNullItems=True)
graft_17 = GraftTree(Tree=shift_5, IncludeEmptyLists=True, IncludeNullItems=True)

flatten_7 = FlattenTree(Tree=graft_17, Path="{0}")
tstat_8 = TreeStatistics(Tree=shift_5)  # -> Paths, Length, Count
tstat_9 = TreeStatistics(Tree=graft_17)  # -> Paths, Length, Count
ma_4 = MassAddition(Input=tstat_8.Length)  # -> Result, PartialResults
series_10 = Series(Start=0, Step=1, Count=tstat_9.Count)
stack_6 = StackData(Data=ma_4.PartialResults, Stack=tstat_8.Length)
shift_8 = ShiftList(List=series_10, Shift=stack_6, Wrap=False)
viewer_6 = ParamViewer()
item_15 = ListItem(List=flatten_7, Index=shift_8, Wrap=True)  # -> simplify(Item)
replace_5 = ReplacePaths(Data=item_15, Search=viewer_6)

graft_18 = GraftTree(Tree=shift_7, IncludeEmptyLists=True, IncludeNullItems=True)

# ----
# kernel tree data
flatten_8 = FlattenTree(Tree=graft_18, Path="{0}")
tstat_10 = TreeStatistics(Tree=shift_7)  # -> Paths, Length, Count
tstat_11 = TreeStatistics(Tree=graft_18)  # -> Paths, Length, Count
ma_5 = MassAddition(Input=tstat_10.Length)  # -> Result, PartialResults
series_11 = Series(Start=0, Step=1, Count=tstat_11.Count)
stack_7 = StackData(Data=ma_5.PartialResults, Stack=tstat_10.Length)
shift_9 = ShiftList(List=series_11, Shift=stack_7, Wrap=False)
item_16 = ListItem(List=flatten_8, Index=shift_9, Wrap=True)  # -> simplify(Item)
viewer_7 = ParamViewer()
replace_6 = ReplacePaths(Data=item_16, Search=viewer_7)

panel_51 = Panel(item_14)
addition_8 = Addition(A=pt_3)

viewer_8 = ParamViewer()
replace_7 = ReplacePaths(Data=item_14, Search=viewer_8)

firstpt_line0 = Point(graft_17)
firstpt_line1 = Point(item_15)
endpt_line0 = Point(graft_18)
endpt_line1 = Point(item_16)

panel_52 = Panel(item_15)
graft_19 = GraftTree(Tree=item_14, IncludeEmptyLists=True, IncludeNullItems=True)
panel_54 = Panel(graft_19)

# ----
# explore a point position in space
line_8 = Line([Line((120.4046894, -60.83579072, 0), (120.4046894, -60.79145643, 0)), Line((120.3917346, -60.82485109, 0), (120.420811, -60.82485109, 0))])
panel_56 = Panel("""处理k不存在的情况

写成函数
把坐标在相减后就分开来算

对实交和虚交的算法 不够缜密""")
# debug:可以做，但是要改动很多，先放放，出现问题了再来
linelist_2 = Curve(line_8)
end_4 = EndPoints(Curve=linelist_2)  # -> Start, End
subtraction_5 = Subtraction(A=end_4.End, B=end_4.Start)
xy = XYPlane(Origin=Point(0, 0, 0))

startpoint_3 = Point(end_4.Start)
vec_4 = Vector(subtraction_5)

# ----
# 计算点到边界的垂直向量
# describe space by (point;index) of vector
# 问题在于，当某一path缺少时，替换的内容仍然会配对，造成数据多余错误
# 要探测出缺少的路径
# statistics-->DePath
# 最后拍平后替换路径
line_length_5 = Panel("""3.2
5.1
3.2
5.1
6.4
10.2""")
panel_57 = Panel("""0
1
0
1
2
3""")
md_slider_3 = MDSlider(
    slider_value=Point(0.4899997711, 0.4549980164, 0.5),
    SliderMode=0,
    x_domain=Domain(0, 1),
    y_domain=Domain(0, 1),
    z_domain=Domain(0, 1))
panel_58 = Panel("""0
1
2
3""")
line_length_6 = Panel("""3.2
5.1
3.2
5.1""")
panel_59 = Panel("""用字符串的方法表示还差最后一步，那么先拆开来用判断的方法做
拆开的方法很繁琐，索性还是用字符串替换的方法
检查目前的替换方法是否可以简化
并且找出到各个边的距离最近点""")
line_length_7 = Number(line_length_6)
panel_60 = Panel("""1,0
0,1
-1,0
0,-1""")
vec_5 = Vector(panel_60)
int_8 = Integer(panel_58)
lng_4 = ListLength(List=int_8)
series_12 = Series(Start=0, Step=1, Count=lng_4)
item_17 = ListItem(List=vec_5, Index=int_8, Wrap=True)
panel_61 = Panel(item_17)
item_18 = ListItem(List=line_length_7, Index=series_12, Wrap=True)
basicvectorunit_2 = Vector(item_17)
amp_4 = Amplitude(Vector=basicvectorunit_2, Amplitude=item_18)
ma_6 = MassAddition(Input=amp_4)  # -> Result, PartialResults
addition_9 = Addition(A=md_slider_3, B=ma_6.PartialResults)
shift_10 = ShiftList(List=ma_6.PartialResults, Shift=-1, Wrap=True)
complex_6 = ComplexComponents(Complex=shift_10)  # -> Real, Imaginary
concat_3 = Concatenate(FragmentA=complex_6.Real, FragmentB=complex_6.Imaginary, JoinSeparator=",")
item_19 = ListItem(List=amp_4, Index=graft(series_12), Wrap=True)
panel_62 = Panel(ma_6.PartialResults)
concat_4 = Concatenate(FragmentA=concat_3, FragmentB=int_8, JoinSeparator=";")
item_20 = ListItem(List=concat_4, Index=series_12, Wrap=True)
split = TextSplit(Text=item_20, Separators=";")  # -> simplify(Result)
item_21 = ListItem(List=split, Index=0, Wrap=True)  # -> Item, Item1
pt_6 = Point(item_21.Item)
addition_10 = Addition(A=pt_6, B=item_19)
firstpt0 = Point(item_21.Item)
endpt0 = Point(addition_10)
panel_63 = Panel(concat_4)
complex_7 = ComplexComponents(Complex=endpt0)  # -> Real, Imaginary
complex_8 = ComplexComponents(Complex=firstpt0)  # -> Real, Imaginary
pt_7 = Point(Point(1.488717773, 12.13872048, 0))
subtraction_6 = Subtraction(A=complex_8.Imaginary, B=complex_7.Imaginary)
subtraction_7 = Subtraction(A=complex_8.Real, B=complex_7.Real)
complex_9 = ComplexComponents(Complex=pt_7)  # -> Real, Imaginary
division_3 = Division(A=subtraction_6, B=subtraction_7)
k1 = Number(division_3)
multiplication = Multiplication(A=k1, B=complex_7.Real)
subtraction_8 = Subtraction(A=complex_7.Imaginary, B=multiplication)
b1 = Number(subtraction_8)
panel_64 = Panel("abs(k*x0-y0+b)/sqrt(k*k+1)")
panel_65 = Panel("(k*x0-y0+b)/sqrt(k*k+1)")
panel_66 = Panel("-(k*x0-y0+b)/sqrt(k*k+1)")

x = Number(complex_9.Real)
y = Number(complex_9.Imaginary)
larger_3 = LargerThan(FirstNumber=complex_8.Real, SecondNumber=x)  # -> LargerThan, OrEqualTo
larger_4 = LargerThan(FirstNumber=complex_8.Imaginary, SecondNumber=y)  # -> LargerThan, OrEqualTo
int_9 = Integer(larger_3.LargerThan)
int_10 = Integer(larger_4.LargerThan)
concat_5 = Concatenate(FragmentA=int_9, FragmentB=int_10)

# ---- group: vector match concept Error
panel_67 = Panel("""101
103
111
113""")
panel_68 = Panel("""010
012
110
112""")
panel_69 = Panel("""001
003
011
013""")
panel_70 = Panel("""000
002
100
102""")
merge_4 = Merge(Data1=panel_67, Data2=panel_68, Data3=panel_69, Data4=panel_70)
entwine_2 = Entwine(Branch00=panel_67, Branch01=panel_68, Branch02=panel_69, Branch03=panel_70, FlattenInputs=True)  # -> simplify(Result)
concat_6 = Concatenate(FragmentA=concat_5, FragmentB=item_21.Item1)
flatten_9 = FlattenTree(Tree=concat_6, Path="{0}")
mindex_5 = MemberIndex(Set=merge_4, Member=flatten_9)  # -> Index, Count
division_4 = Division(A=mindex_5.Index, B="4")
int_11 = Integer(division_4)
item_22 = ListItem(List=vec_5, Index=int_11, Wrap=True)

# ----
pt_8 = Point(ma_6.PartialResults)
pline_2 = PolyLine(Vertices=pt_8, Closed=True)

# ---- group: vector match concept Error
mindex_6 = MemberIndex(Set=entwine_2, Member=flatten_9)  # -> Index, Count
clean_6 = CleanTree(RemoveNulls=True, RemoveInvalid=True, RemoveEmpty=True, Tree=mindex_6.Index)
tstat_12 = TreeStatistics(Tree=clean_6)  # -> Paths, Length, Count
split_2 = TextSplit(Text=tstat_12.Paths, Separators=";")
item_23 = ListItem(List=split_2, Index="0", Wrap=True)
split_3 = TextSplit(Text=item_23, Separators="{")
item_24 = ListItem(List=split_3, Index="1", Wrap=True)  # -> simplify(Item)

equals_5 = Equality(FirstNumber=graft(flatten_9), SecondNumber=merge_4)  # -> Equality, Inequality
mindex_7 = MemberIndex(Set=equals_5.Equality, Member=Toggle(True))  # -> Index, Count

# ----
# distances between points and space boundary
null_2 = NullItem(Item=k1)  # -> NullFlags, InvalidFlags, Description
sift_6 = SiftPattern(List=pt_6, SiftPattern=null_2.NullFlags)  # -> Output0, Output1
complex_10 = ComplexComponents(Complex=sift_6.Output1)  # -> Real, Imaginary
eval = Evaluate(F="abs(k*x0-y0+b)/sqrt(k*k+1)", k=k1, b=b1, x0=complex_9.Real, y0=complex_9.Imaginary)
subtraction_9 = Subtraction(A=complex_9.Real, B=complex_10.Real)  # -> simplify(Result)
distance = Number(eval)
abs = Absolute(Value=subtraction_9)  # -> simplify(Result)
combine = CombineData(Input0=distance, Input1=abs)  # -> Result, Index

# ---- group: vector match method 1
concat_7 = Concatenate(FragmentA=concat_5, FragmentB=item_21.Item1)
flatten_10 = FlattenTree(Tree=concat_7, Path="{0}")
panel_71 = Panel("""000
002
100
102""")
panel_72 = Panel("""101
103
111
113""")
panel_73 = Panel("""010
012
110
112""")
panel_74 = Panel("""001
003
011
013""")
mindex_8 = MemberIndex(Set=panel_74, Member=flatten_10)  # -> Index, Count
mindex_9 = MemberIndex(Set=panel_71, Member=flatten_10)  # -> Index, Count
mindex_10 = MemberIndex(Set=panel_72, Member=flatten_10)  # -> Index, Count
mindex_11 = MemberIndex(Set=panel_73, Member=flatten_10)  # -> Index, Count
clean_7 = CleanTree(RemoveNulls=True, RemoveInvalid=True, RemoveEmpty=True, Tree=mindex_11.Index)
clean_8 = CleanTree(RemoveNulls=True, RemoveInvalid=True, RemoveEmpty=True, Tree=mindex_9.Index)
clean_9 = CleanTree(RemoveNulls=True, RemoveInvalid=True, RemoveEmpty=True, Tree=mindex_10.Index)
clean_10 = CleanTree(RemoveNulls=True, RemoveInvalid=True, RemoveEmpty=True, Tree=mindex_8.Index)
replace_8 = ReplaceItems(List=clean_9, Item="0", Indices="0", Wrap=False)
replace_9 = ReplaceItems(List=clean_7, Item="1", Indices="0", Wrap=False)
replace_10 = ReplaceItems(List=clean_10, Item="2", Indices="0", Wrap=False)
replace_11 = ReplaceItems(List=clean_8, Item="3", Indices="0", Wrap=False)
merge_5 = Merge(Data1=replace_8, Data2=replace_9, Data3=replace_10, Data4=replace_11)
item_25 = ListItem(List=vec_5, Index=merge_5, Wrap=True)
amp_5 = Amplitude(Vector=item_25, Amplitude=combine.Result)
vdis_2 = VectorDisplay(Anchor=pt_7, Vector=amp_5)

# ---- group: vector match method 0 Error
# left-down;x-axis
# left-up;y-axis
y_2 = Number(complex_9.Imaginary)
a = Number(complex_8.Real)
b = Number(complex_8.Imaginary)
x_2 = Number(complex_9.Real)
item_26 = ListItem(List=vec_5, Index=item_21.Item1, Wrap=True)
smaller_3 = SmallerThan(FirstNumber=b, SecondNumber=y_2)  # -> SmallerThan, OrEqualTo
not = GateNot(A=smaller_3.SmallerThan)
smaller_4 = SmallerThan(FirstNumber=a, SecondNumber=x_2)  # -> SmallerThan, OrEqualTo
and_3 = GateAnd(A=smaller_4.SmallerThan, B=not)
equals_6 = Equality(FirstNumber="0", SecondNumber=graft(int_8))  # -> Equality, Inequality
equals_7 = Equality(FirstNumber="2", SecondNumber=graft(int_8))  # -> Equality, Inequality
and_4 = GateAnd(A=smaller_4.SmallerThan, B=smaller_3.SmallerThan)
equals_8 = Equality(FirstNumber="1", SecondNumber=graft(int_8))  # -> Equality, Inequality
equals_9 = Equality(FirstNumber="3", SecondNumber=graft(int_8))  # -> Equality, Inequality
or = GateOr(A=equals_6.Equality, B=equals_7.Equality)
or_2 = GateOr(A=equals_8.Equality, B=equals_9.Equality)
and_5 = GateAnd(A=or_2, B=and_4)
and_6 = GateAnd(A=or, B=and_3)
or_3 = GateOr(A=and_5, B=and_6)
sift_7 = SiftPattern(List=item_26, SiftPattern=or_3)  # -> Output0, Output1
pi_7 = Pi(Factor="0.5")
Z = UnitZ(Factor=1)
neg_8 = Negative(Value=pi_7)
vrot = Rotate(Vector=sift_7.Output0, Axis=Z, Angle=neg_8)
vrot_2 = Rotate(Vector=sift_7.Output1, Axis=Z, Angle=pi_7)
combine_2 = CombineData(Input0=vrot, Input1=vrot_2)  # -> Result, Index
amp_6 = Amplitude(Vector=combine_2.Result, Amplitude=combine.Result)
vdis_3 = VectorDisplay(Anchor=pt_7, Vector=amp_6)

# ----
# vectors between points and space boundary
panel_75 = Panel("0.5")  # disabled
item_27 = ListItem(List=vec_5, Index=item_21.Item1, Wrap=True)  # disabled
pi_8 = Pi(Factor=panel_75)  # disabled
neg_9 = Negative(Value=pi_8)  # disabled
Z_2 = UnitZ(Factor=1)  # disabled
vrot_3 = Rotate(Vector=item_27, Axis=Z_2, Angle=neg_9)  # disabled
amp_7 = Amplitude(Vector=vrot_3, Amplitude=combine.Result)  # disabled

panel_76 = Panel(eval)
panel_77 = Panel(combine.Result)

# ----
# kernel intersection algorithm 002_trial
# explore a point position in space
# curve convert to direction and length
# 0 --> extend one line to intersect two lines
# 1 --> extend two lines
# 2 --> extend three lines
line_9 = Line([Line((-24.40860271, -49.55265212, 0), (8.180806958, -33.66531491, 0)), Line((-1.799699753, -27.75848441, 0), (-1.799699753, -50.36738737, 0))])  # disabled
panel_78 = Panel("1")  # disabled
linelist_3 = Curve(line_9)  # disabled
lng_5 = ListLength(List=linelist_3)  # disabled
subtraction_10 = Subtraction(A=lng_5, B=panel_78)  # disabled
series_13 = Series(Start=0, Step=1, Count=subtraction_10)  # disabled
addition_11 = Addition(A=series_13, B=panel_78)  # disabled
item_28 = ListItem(List=linelist_3, Index=series_13, Wrap=False)  # -> simplify(graft(Item)); disabled
shift_11 = ShiftList(List=linelist_3, Shift=addition_11, Wrap=False)  # -> simplify(List); disabled
end_5 = EndPoints(Curve=item_28)  # -> Start, End; disabled
end_6 = EndPoints(Curve=shift_11)  # -> Start, End; disabled
end_7 = EndPoints(Curve=linelist_3)  # -> Start, End; disabled
panel_79 = Panel("1")  # disabled
panel_80 = Panel("1")  # disabled
number_slider_5 = Slider(6, range=0..100)  # disabled
panel_81 = Panel("0")  # disabled
panel_82 = Panel("0")  # disabled
panel_83 = Panel("处理k不存在的情况")  # disabled
equals_10 = Equality()  # -> Equality, Inequality; disabled
panel_84 = Panel("2")  # disabled
xy_2 = XYPlane(Origin=Point(0, 0, 0))  # disabled

subtraction_11 = Subtraction(A=end_7.End, B=end_7.Start)  # disabled
startpoint_4 = Point(end_7.Start)  # disabled

vec_6 = Vector(subtraction_11)  # disabled
addition_12 = Addition(A=startpoint_4, B=vec_6)  # disabled
endpoint_2 = Point(addition_12)  # disabled
lng_6 = ListLength(List=addition_12)  # disabled
lng_7 = ListLength(List=startpoint_4)  # disabled
panel_85 = Panel(startpoint_4)  # disabled
subtraction_12 = Subtraction(A=lng_6, B=panel_79)  # disabled
subtraction_13 = Subtraction(A=lng_7, B=panel_80)  # disabled
series_14 = Series(Start=0, Step=1, Count=subtraction_13)  # disabled
series_15 = Series(Start=0, Step=1, Count=subtraction_12)  # disabled
addition_13 = Addition(A=series_15, B=panel_79)  # disabled
addition_14 = Addition(A=series_14, B=panel_80)  # disabled
item_29 = ListItem(List=startpoint_4, Index=series_14, Wrap=False)  # -> simplify(graft(Item)); disabled
item_30 = ListItem(List=addition_12, Index=series_15, Wrap=False)  # -> simplify(graft(Item)); disabled
shift_12 = ShiftList(List=addition_12, Shift=addition_13, Wrap=False)  # -> simplify(List); disabled
shift_13 = ShiftList(List=startpoint_4, Shift=addition_14, Wrap=False)  # -> simplify(List); disabled
firstpt1 = Point(shift_13)  # disabled
firstpt0_2 = Point(item_29)  # disabled
endpt0_2 = Point(item_30)  # disabled
endpt1 = Point(shift_12)  # disabled
points = PointList(Points=flatten(firstpt0_2), Size=number_slider_5)  # disabled
panel_86 = Panel(firstpt0_2)  # disabled
complex_11 = ComplexComponents(Complex=firstpt1)  # -> Real, Imaginary; disabled
complex_12 = ComplexComponents(Complex=endpt1)  # -> Real, Imaginary; disabled
complex_13 = ComplexComponents(Complex=firstpt0_2)  # -> Real, Imaginary; disabled
complex_14 = ComplexComponents(Complex=endpt0_2)  # -> Real, Imaginary; disabled
subtraction_14 = Subtraction(A=complex_11.Imaginary, B=complex_12.Imaginary)  # disabled
subtraction_15 = Subtraction(A=complex_13.Real, B=complex_14.Real)  # disabled
equals_11 = Equality(FirstNumber=subtraction_15, SecondNumber=panel_82)  # -> Equality, Inequality; disabled
sift_8 = SiftPattern(List=complex_13.Real, SiftPattern=equals_11.Equality)  # -> Output0, Output1; disabled
subtraction_16 = Subtraction(A=complex_11.Real, B=complex_12.Real)  # disabled
equals_12 = Equality(FirstNumber=subtraction_16, SecondNumber=panel_81)  # -> Equality, Inequality; disabled
sift_9 = SiftPattern(List=complex_12.Real, SiftPattern=equals_12.Equality)  # -> Output0, Output1; disabled
subtraction_17 = Subtraction(A=complex_13.Imaginary, B=complex_14.Imaginary)  # disabled
combine_3 = CombineData(Input0=sift_8.Output1, Input1=sift_9.Output1)  # -> Result, Index; disabled
panel_87 = Panel(complex_13.Real)  # disabled
division_5 = Division(A=subtraction_14, B=subtraction_16)  # disabled
division_6 = Division(A=subtraction_17, B=subtraction_15)  # disabled
panel_88 = Panel(subtraction_16)  # disabled
panel_89 = Panel(equals_12.Equality)  # disabled
k1_2 = Number(division_6)  # disabled
multiplication_2 = Multiplication(A=k1_2, B=complex_14.Real)  # disabled
k2 = Number(division_5)  # disabled
multiplication_3 = Multiplication(A=k2, B=complex_12.Real)  # disabled
subtraction_18 = Subtraction(A=complex_14.Imaginary, B=multiplication_2)  # disabled
panel_90 = Panel(k1_2)  # disabled
subtraction_19 = Subtraction(A=complex_12.Imaginary, B=multiplication_3)  # disabled
subtraction_20 = Subtraction(A=k1_2, B=k2)  # disabled
b1_2 = Number(subtraction_18)  # disabled
dom = ConstructDomain(DomainStart=complex_13.Real, DomainEnd=complex_14.Real)  # disabled
b2 = Number(subtraction_19)  # disabled
dom_2 = ConstructDomain(DomainStart=complex_11.Real, DomainEnd=complex_12.Real)  # disabled
subtraction_21 = Subtraction(A=b2, B=b1_2)  # disabled
nullrep = ReplaceNulls(Items=k1_2, Replacements=complex_13.Real)  # -> Items, Count; disabled
division_7 = Division(A=subtraction_21, B=subtraction_20)  # disabled
panel_91 = Panel(division_7)  # disabled
inc = Includes(Value=division_7, Domain=dom)  # -> Includes, Deviation; disabled
inc_2 = Includes(Value=division_7, Domain=dom_2)  # -> Includes, Deviation; disabled
multiplication_4 = Multiplication(A=division_7, B=k2)  # disabled
panel_92 = Panel(nullrep.Items)  # disabled
nullrep_2 = ReplaceNulls(Items=division_7, Replacements=combine_3.Result)  # -> Items, Count; disabled
int_12 = Integer(inc.Includes)  # disabled
addition_15 = Addition(A=multiplication_4, B=b2)  # disabled
int_13 = Integer(inc_2.Includes)  # disabled
addition_16 = Addition(A=int_12, B=int_13)  # disabled
subtraction_22 = Subtraction(A=panel_84, B=addition_16)  # disabled
extendlinecount = Integer(subtraction_22)  # disabled
intersection_x = Number(division_7)  # disabled
intersection_y = Number(addition_15)  # disabled
pt_9 = PointOriented(BasePlane=xy_2, UComponent=intersection_x, VComponent=intersection_y, WComponent=0)  # disabled
panel_93 = Panel(extendlinecount)  # disabled
sift_10 = SiftPattern(List=pt_9, SiftPattern=extendlinecount)  # -> Output0, Output1, Output2; disabled
intersectionontwolines = Point(sift_10.Output0)  # disabled
intersectionononeline = Point(sift_10.Output1)  # disabled
intersectiononextend = Point(sift_10.Output2)  # disabled

xy_3 = XYPlane(Origin=Point(0, 0, 0))  # disabled
sift_11 = SiftPattern(List=division_7, SiftPattern=extendlinecount)  # -> Output0, Output1, Output2; disabled
sift_12 = SiftPattern(List=addition_15, SiftPattern=extendlinecount)  # -> Output0, Output1, Output2; disabled
pt_10 = PointOriented(BasePlane=xy_3, UComponent=sift_11.Output0, VComponent=sift_12.Output0, WComponent=0)  # disabled
flatten_11 = FlattenTree(Tree=pt_10, Path="{0}")  # disabled
clean_11 = CleanTree(RemoveNulls=True, RemoveInvalid=True, RemoveEmpty=False, Tree=flatten_11)  # disabled
pt_11 = Point(Point(-2.015690168, -16.36521091, 0))  # disabled
panel_94 = Panel("2")  # disabled
partition_2 = PartitionList(List=clean_11, Size=panel_94)  # disabled
bang_2 = ExplodeTree(Data=partition_2)  # -> Branch0, Branch1; disabled
rev = ReverseList(List=bang_2.Branch1)  # disabled
merge_6 = Merge(Data1=bang_2.Branch0, Data2=rev)  # -> flatten(Result); disabled
pline_3 = PolyLine(Vertices=merge_6, Closed=True)  # disabled

end_8 = EndPoints(Curve=linelist)  # -> Start, End; disabled
subtraction_23 = Subtraction(A=end_8.End, B=end_8.Start)  # disabled
startpoint_5 = Point(end_8.Start)  # disabled
vec_7 = Vector(subtraction_23)  # disabled
addition_17 = Addition(A=startpoint_5, B=vec_7)  # disabled
endpoint_3 = Point(addition_17)  # disabled
lng_8 = ListLength(List=addition_17)  # disabled
lng_9 = ListLength(List=startpoint_5)  # disabled
panel_95 = Panel("1")  # disabled
panel_96 = Panel(startpoint_5)  # disabled
panel_97 = Panel("1")  # disabled
subtraction_24 = Subtraction(A=lng_8, B=panel_95)  # disabled
subtraction_25 = Subtraction(A=lng_9, B=panel_97)  # disabled
series_16 = Series(Start=0, Step=1, Count=subtraction_25)  # disabled
series_17 = Series(Start=0, Step=1, Count=subtraction_24)  # disabled
addition_18 = Addition(A=series_17, B=panel_95)  # disabled
addition_19 = Addition(A=series_16, B=panel_97)  # disabled
number_slider_6 = Slider(6, range=0..100)  # disabled
item_31 = ListItem(List=startpoint_5, Index=series_16, Wrap=False)  # -> simplify(graft(Item)); disabled
item_32 = ListItem(List=addition_17, Index=series_17, Wrap=False)  # -> simplify(graft(Item)); disabled
shift_14 = ShiftList(List=addition_17, Shift=addition_18, Wrap=False)  # -> simplify(List); disabled
shift_15 = ShiftList(List=startpoint_5, Shift=addition_19, Wrap=False)  # -> simplify(List); disabled
firstpt0_3 = Point(item_31)  # disabled
firstpt1_2 = Point(shift_15)  # disabled
endpt0_3 = Point(item_32)  # disabled
endpt1_2 = Point(shift_14)  # disabled
points_2 = PointList(Points=flatten(firstpt0_3), Size=number_slider_6)  # disabled
complex_15 = ComplexComponents(Complex=endpt1_2)  # -> Real, Imaginary; disabled
complex_16 = ComplexComponents(Complex=endpt0_3)  # -> Real, Imaginary; disabled
complex_17 = ComplexComponents(Complex=firstpt1_2)  # -> Real, Imaginary; disabled
complex_18 = ComplexComponents(Complex=firstpt0_3)  # -> Real, Imaginary; disabled
subtraction_26 = Subtraction(A=complex_18.Real, B=complex_16.Real)  # disabled
subtraction_27 = Subtraction(A=complex_18.Imaginary, B=complex_16.Imaginary)  # disabled
subtraction_28 = Subtraction(A=complex_17.Real, B=complex_15.Real)  # disabled
subtraction_29 = Subtraction(A=complex_17.Imaginary, B=complex_15.Imaginary)  # disabled
division_8 = Division(A=subtraction_27, B=subtraction_26)  # disabled
division_9 = Division(A=subtraction_29, B=subtraction_28)  # disabled
k2_2 = Number(division_9)  # disabled
multiplication_5 = Multiplication(A=k2_2, B=complex_15.Real)  # disabled
k1_3 = Number(division_8)  # disabled
multiplication_6 = Multiplication(A=k1_3, B=complex_16.Real)  # disabled
subtraction_30 = Subtraction(A=complex_16.Imaginary, B=multiplication_6)  # disabled
subtraction_31 = Subtraction(A=complex_15.Imaginary, B=multiplication_5)  # disabled
subtraction_32 = Subtraction(A=k1_3, B=k2_2)  # disabled
b1_3 = Number(subtraction_30)  # disabled
b2_2 = Number(subtraction_31)  # disabled
subtraction_33 = Subtraction(A=b2_2, B=b1_3)  # disabled
division_10 = Division(A=subtraction_33, B=subtraction_32)  # disabled
multiplication_7 = Multiplication(A=division_10, B=k2_2)  # disabled
addition_20 = Addition(A=multiplication_7, B=b2_2)  # disabled
xy_4 = XYPlane(Origin=Point(0, 0, 0))  # disabled
intersection_x_2 = Number(division_10)  # disabled
intersection_y_2 = Number(addition_20)  # disabled
xy_5 = XYPlane(Origin=Point(0, 0, 0))  # disabled
pt_12 = PointOriented(BasePlane=xy_5, UComponent=intersection_x_2, VComponent=intersection_y_2, WComponent=0)  # disabled

# ----
# 0 --> extend one line to intersect two lines
# 1 --> extend two lines
# 2 --> extend three lines
dom_3 = ConstructDomain(DomainStart=complex_17.Real, DomainEnd=complex_15.Real)  # disabled
dom_4 = ConstructDomain(DomainStart=complex_18.Real, DomainEnd=complex_16.Real)  # disabled
inc_3 = Includes(Value=division_10, Domain=dom_4)  # -> Includes, Deviation; disabled
inc_4 = Includes(Value=division_10, Domain=dom_3)  # -> Includes, Deviation; disabled
int_14 = Integer(inc_3.Includes)  # disabled
int_15 = Integer(inc_4.Includes)  # disabled
addition_21 = Addition(A=int_14, B=int_15)  # disabled
panel_98 = Panel("2")  # disabled
subtraction_34 = Subtraction(A=panel_98, B=addition_21)  # disabled
extendlinecount_2 = Integer(subtraction_34)  # disabled

sift_13 = SiftPattern(List=addition_20, SiftPattern=extendlinecount_2)  # -> Output0, Output1, Output2; disabled
sift_14 = SiftPattern(List=division_10, SiftPattern=extendlinecount_2)  # -> Output0, Output1, Output2; disabled
pt_13 = PointOriented(BasePlane=xy_4, UComponent=sift_14.Output0, VComponent=sift_13.Output0, WComponent=0)  # disabled
flatten_12 = FlattenTree(Tree=pt_13, Path="{0}")  # disabled
clean_12 = CleanTree(RemoveNulls=True, RemoveInvalid=True, RemoveEmpty=False, Tree=flatten_12)  # disabled
panel_99 = Panel(extendlinecount_2)  # disabled
sift_15 = SiftPattern(List=pt_12, SiftPattern=extendlinecount_2)  # -> Output0, Output1, Output2; disabled
intersectionontwolines_2 = Point(sift_15.Output0)  # disabled
intersectionononeline_2 = Point(sift_15.Output1)  # disabled
intersectiononextend_2 = Point(sift_15.Output2)  # disabled

# ---- group: vector match method 1 simplify
entwine_3 = Entwine(Branch00=panel_67, Branch01=panel_68, Branch02=panel_69, Branch03=panel_70, FlattenInputs=True)  # -> simplify(Result)
flatten_13 = FlattenTree(Tree=concat_7, Path="{0}")
mindex_12 = MemberIndex(Set=entwine_3, Member=flatten_13)  # -> Index, Count
clean_13 = CleanTree(RemoveNulls=True, RemoveInvalid=True, RemoveEmpty=True, Tree=mindex_12.Index)
pshift_4 = ShiftPaths(Data=clean_13, Offset=-1)
viewer_9 = ParamViewer(clean_13)

tstat_13 = TreeStatistics(Tree=pshift_4)  # -> Paths, Length, Count
dpath_4 = DeconstructPath(Branch=tstat_13.Paths)  # -> simplify(Indices)

graft_20 = GraftTree(Tree=tstat_13.Length, IncludeEmptyLists=True, IncludeNullItems=True)
series_18 = Series(Start=0, Step=1, Count=graft_20)
int_16 = Integer(simplify(series_18))
replace_12 = ReplaceItems(List=pshift_4, Item=dpath_4, Indices=int_16, Wrap=False)
graft_21 = GraftTree(Tree=flatten(replace_12), IncludeEmptyLists=True, IncludeNullItems=True)
viewer_10 = ParamViewer(graft_21)
replace_13 = ReplacePaths(Data=graft_21, Search=viewer_10, Replace=viewer_9)
pshift_5 = ShiftPaths(Data=replace_13, Offset="1")
item_33 = ListItem(List=vec_5, Index=pshift_5, Wrap=True)
amp_8 = Amplitude(Vector=item_33, Amplitude=combine.Result)
vdis_4 = VectorDisplay(Anchor=pt_7, Vector=amp_8)

# ----
addition_22 = Addition(A=startpoint_3, B=vec_4)
endpoint_4 = Point(addition_22)
lng_10 = ListLength(List=addition_22)
lng_11 = ListLength(List=startpoint_3)
subtraction_35 = Subtraction(A=lng_10, B="1")
subtraction_36 = Subtraction(A=lng_11, B="1")
series_19 = Series(Start=0, Step=1, Count=subtraction_36)
series_20 = Series(Start=0, Step=1, Count=subtraction_35)
addition_23 = Addition(A=series_19, B="1")
addition_24 = Addition(A=series_20, B="1")
item_34 = ListItem(List=startpoint_3, Index=series_19, Wrap=False)  # -> simplify(graft(Item))
item_35 = ListItem(List=addition_22, Index=series_20, Wrap=False)  # -> simplify(graft(Item))
shift_16 = ShiftList(List=addition_22, Shift=addition_24, Wrap=False)  # -> simplify(List)
shift_17 = ShiftList(List=startpoint_3, Shift=addition_23, Wrap=False)  # -> simplify(List)

firstpt_line0_2 = Point(item_34)
firstpt_line1_2 = Point(shift_17)
endpt1_line1 = Point(shift_16)
endpt_line0_2 = Point(item_35)

points_3 = PointList(Points=flatten(firstpt_line0_2), Size=Slider(6, range=0..100))

complex_19 = ComplexComponents(Complex=firstpt_line0_2)  # -> Real, Imaginary
complex_20 = ComplexComponents(Complex=endpt_line0_2)  # -> Real, Imaginary
complex_21 = ComplexComponents(Complex=firstpt_line1_2)  # -> Real, Imaginary
complex_22 = ComplexComponents(Complex=endpt1_line1)  # -> Real, Imaginary
subtraction_37 = Subtraction(A=complex_21.Imaginary, B=complex_22.Imaginary)
subtraction_38 = Subtraction(A=complex_21.Real, B=complex_22.Real)
subtraction_39 = Subtraction(A=complex_19.Real, B=complex_20.Real)
subtraction_40 = Subtraction(A=complex_19.Imaginary, B=complex_20.Imaginary)
division_11 = Division(A=subtraction_37, B=subtraction_38)
division_12 = Division(A=subtraction_40, B=subtraction_39)
k1_4 = Number(division_12)
k2_3 = Number(division_11)
multiplication_8 = Multiplication(A=k2_3, B=complex_21.Real)
subtraction_41 = Subtraction(A=complex_21.Imaginary, B=multiplication_8)
b2_3 = Number(subtraction_41)
subtraction_42 = Subtraction(A=k1_4, B=k2_3)

multiplication_9 = Multiplication(A=k1_4, B=complex_19.Real)
subtraction_43 = Subtraction(A=complex_19.Imaginary, B=multiplication_9)

equals_13 = Equality(FirstNumber=subtraction_38, SecondNumber="0")  # -> Equality, Inequality
equals_14 = Equality(FirstNumber=subtraction_39, SecondNumber="0")  # -> Equality, Inequality
sift_16 = SiftPattern(List=complex_22.Real, SiftPattern=equals_13.Equality)  # -> Output0, Output1
sift_17 = SiftPattern(List=complex_19.Real, SiftPattern=equals_14.Equality)  # -> Output0, Output1
or_4 = GateOr(A=equals_14.Equality, B=equals_13.Equality)
combine_4 = CombineData(Input0=sift_17.Output1, Input1=sift_16.Output1)  # -> Result, Index
sift_18 = SiftPattern(List=k2_3, SiftPattern=equals_13.Equality)  # -> Output0, Output1
sift_19 = SiftPattern(List=b2_3, SiftPattern=equals_13.Equality)  # -> Output0, Output1
sift_20 = SiftPattern(List=k1_4, SiftPattern=equals_14.Equality)  # -> Output0, Output1
combine_5 = CombineData(Input0=sift_20.Output0, Input1=sift_18.Output0)  # -> Result, Index
a_2 = Number(combine_4.Result)
k = Number(combine_5.Result)
multiplication_10 = Multiplication(A=a_2, B=k)
intersection_x_3 = Number(a_2)

b1_4 = Number(subtraction_43)
subtraction_44 = Subtraction(A=b2_3, B=b1_4)
division_13 = Division(A=subtraction_44, B=subtraction_42)
multiplication_11 = Multiplication(A=division_13, B=k2_3)
addition_25 = Addition(A=multiplication_11, B=b2_3)
sift_21 = SiftPattern(List=addition_25, SiftPattern=or_4)  # -> Output0, Output1

sift_22 = SiftPattern(List=b1_4, SiftPattern=equals_14.Equality)  # -> Output0, Output1
combine_6 = CombineData(Input0=sift_22.Output0, Input1=sift_19.Output0)  # -> Result, Index
b_2 = Number(combine_6.Result)
sift_23 = SiftPattern(List=b_2, SiftPattern=or_4)  # -> Output0, Output1
addition_26 = Addition(A=multiplication_10, B=sift_23.Output1)
intersection_y_3 = Number(addition_26)

combine_7 = CombineData(Input0=sift_21.Output0, Input1=intersection_y_3)  # -> Result, Index
combine_8 = CombineData(Input0=division_13, Input1=intersection_x_3)  # -> Result, Index

panel_100 = Panel(equals_14.Equality)
intersection_x_4 = Number(combine_8.Result)
intersection_y_4 = Number(combine_7.Result)
pt_14 = PointOriented(BasePlane=xy, UComponent=intersection_x_4, VComponent=intersection_y_4, WComponent=0)

# ----
# true --> real insection
# false --> extend
# 10,11 --> real insection
# 01       --> extend one line
# 00       --> extend two lines
# true   -- > extend one line
# false -->  extend two lines
dom_5 = ConstructDomain(DomainStart=complex_19.Imaginary, DomainEnd=complex_20.Imaginary)
dom_6 = ConstructDomain(DomainStart=complex_19.Real, DomainEnd=complex_20.Real)
dom_7 = ConstructDomain(DomainStart=complex_21.Real, DomainEnd=complex_22.Real)
dom_8 = ConstructDomain(DomainStart=complex_21.Imaginary, DomainEnd=complex_22.Imaginary)
firstpty_domain = Domain(dom_5)
firstptx_domain = Domain(dom_6)
endpty_domain = Domain(dom_8)
endptx_domain = Domain(dom_7)
inc_5 = Includes(Value=intersection_y_4, Domain=firstpty_domain)  # -> Includes, Deviation
inc_6 = Includes(Value=intersection_x_4, Domain=endptx_domain)  # -> Includes, Deviation
inc_7 = Includes(Value=intersection_y_4, Domain=endpty_domain)  # -> Includes, Deviation
inc_8 = Includes(Value=intersection_x_4, Domain=firstptx_domain)  # -> Includes, Deviation
or_5 = GateOr(A=inc_8.Includes, B=inc_5.Includes, C=inc_6.Includes, D=inc_7.Includes)
and_7 = GateAnd(A=inc_8.Includes, B=inc_5.Includes, C=inc_6.Includes, D=inc_7.Includes)
int_17 = Integer(and_7)
int_18 = Integer(or_5)
concat_8 = Concatenate(FragmentA=int_17, FragmentB=int_18)
panel_101 = Panel("""10
11
01
00""")
panel_102 = Panel("""0
0
1
2""")
keysearch = KeyValueSearch(Keys=panel_101, Values=panel_102, Search=concat_8)
extendlinecount_3 = Integer(keysearch)

# ----
# k1=k2,b1=b2 --> common line -->point or line
equals_15 = Equality(FirstNumber=k1_4, SecondNumber=k2_3)  # -> Equality, Inequality; disabled
equals_16 = Equality(FirstNumber=b1_4, SecondNumber=b2_3)  # -> Equality, Inequality; disabled
and_8 = GateAnd(A=equals_15.Equality, B=equals_16.Equality)  # disabled
dedomain_3 = DeconstructDomain(Domain=firstptx_domain)  # -> Start, End; disabled
dedomain_4 = DeconstructDomain(Domain=firstpty_domain)  # -> Start, End; disabled
dedomain_5 = DeconstructDomain(Domain=endptx_domain)  # -> Start, End; disabled
dedomain_6 = DeconstructDomain(Domain=endpty_domain)  # -> Start, End; disabled
merge_7 = Merge(Data1=dedomain_3.Start, Data2=dedomain_3.End, Data3=dedomain_5.Start, Data4=dedomain_5.End)  # disabled
merge_8 = Merge(Data1=dedomain_4.Start, Data2=dedomain_4.End, Data3=dedomain_6.Start, Data4=dedomain_6.End)  # disabled
sort_3 = SortList(Keys=merge_7)  # -> Keys, ValuesA; disabled
sort_4 = SortList(Keys=merge_8)  # -> Keys, ValuesA; disabled
panel_103 = Panel("1")  # disabled
panel_104 = Panel("1")  # disabled
item_36 = ListItem(List=sort_3.Keys, Index=panel_103, Wrap=False)  # -> Item, Item1; disabled
item_37 = ListItem(List=sort_4.Keys, Index=panel_104, Wrap=False)  # -> Item, Item1; disabled
panel_105 = Panel("2")  # disabled
panel_106 = Panel("2")  # disabled
addition_27 = Addition(A=item_37.Item, B=item_37.Item1)  # disabled
addition_28 = Addition(A=item_36.Item, B=item_36.Item1)  # disabled
division_14 = Division(A=addition_27, B=panel_106)  # disabled
division_15 = Division(A=addition_28, B=panel_105)  # disabled

sift_24 = SiftPattern(List=pt_14, SiftPattern=extendlinecount_3)  # -> Output0, Output1, Output2
intersectionontwolines_3 = Point(sift_24.Output0)
intersectionononeline_3 = Point(sift_24.Output1)
intersectiononextend_3 = Point(sift_24.Output2)
panel_107 = Panel(intersectionontwolines_3)

firstpt0_4 = Point(firstpt_line0)
firstpt1_3 = Point(firstpt_line1)
endpt0_4 = Point(endpt_line0)
endpt1_3 = Point(endpt_line1)
points_4 = PointList(Points=flatten(firstpt0_4), Size=Slider(0.109, range=0..3))
complex_23 = ComplexComponents(Complex=firstpt0_4)  # -> Real, Imaginary
complex_24 = ComplexComponents(Complex=firstpt1_3)  # -> Real, Imaginary
complex_25 = ComplexComponents(Complex=endpt1_3)  # -> Real, Imaginary
complex_26 = ComplexComponents(Complex=endpt0_4)  # -> Real, Imaginary
subtraction_45 = Subtraction(A=complex_24.Imaginary, B=complex_25.Imaginary)
subtraction_46 = Subtraction(A=complex_24.Real, B=complex_25.Real)
equals_17 = Equality(FirstNumber=subtraction_46, SecondNumber="0")  # -> Equality, Inequality
sift_25 = SiftPattern(List=complex_25.Real, SiftPattern=equals_17.Equality)  # -> Output0, Output1
subtraction_47 = Subtraction(A=complex_23.Imaginary, B=complex_26.Imaginary)
subtraction_48 = Subtraction(A=complex_23.Real, B=complex_26.Real)
equals_18 = Equality(FirstNumber=subtraction_48, SecondNumber="0")  # -> Equality, Inequality
sift_26 = SiftPattern(List=complex_23.Real, SiftPattern=equals_18.Equality)  # -> Output0, Output1
or_6 = GateOr(A=equals_18.Equality, B=equals_17.Equality)
combine_9 = CombineData(Input0=sift_26.Output1, Input1=sift_25.Output1)  # -> Result, Index
division_16 = Division(A=subtraction_45, B=subtraction_46)
division_17 = Division(A=subtraction_47, B=subtraction_48)
panel_108 = Panel("""处理k不存在的情况

写成函数
把坐标在相减后就分开来算""")
k2_4 = Number(division_16)
multiplication_12 = Multiplication(A=k2_4, B=complex_24.Real)
sift_27 = SiftPattern(List=k2_4, SiftPattern=equals_17.Equality)  # -> Output0, Output1
subtraction_49 = Subtraction(A=complex_24.Imaginary, B=multiplication_12)
k1_5 = Number(division_17)
multiplication_13 = Multiplication(A=k1_5, B=complex_23.Real)
sift_28 = SiftPattern(List=k1_5, SiftPattern=equals_18.Equality)  # -> Output0, Output1
subtraction_50 = Subtraction(A=complex_23.Imaginary, B=multiplication_13)
combine_10 = CombineData(Input0=sift_28.Output0, Input1=sift_27.Output0)  # -> Result, Index
b1_5 = Number(subtraction_50)
sift_29 = SiftPattern(List=b1_5, SiftPattern=equals_18.Equality)  # -> Output0, Output1
b2_4 = Number(subtraction_49)
sift_30 = SiftPattern(List=b2_4, SiftPattern=equals_17.Equality)  # -> Output0, Output1
combine_11 = CombineData(Input0=sift_29.Output0, Input1=sift_30.Output0)  # -> Result, Index
subtraction_51 = Subtraction(A=b2_4, B=b1_5)
b_3 = Number(combine_11.Result)
a_3 = Number(combine_9.Result)
k_2 = Number(combine_10.Result)
subtraction_52 = Subtraction(A=k1_5, B=k2_4)
sift_31 = SiftPattern(List=b_3, SiftPattern=or_6)  # -> Output0, Output1
multiplication_14 = Multiplication(A=a_3, B=k_2)
division_18 = Division(A=subtraction_51, B=subtraction_52)
multiplication_15 = Multiplication(A=division_18, B=k2_4)
addition_29 = Addition(A=multiplication_15, B=b2_4)
sift_32 = SiftPattern(List=addition_29, SiftPattern=or_6)  # -> Output0, Output1
addition_30 = Addition(A=multiplication_14, B=sift_31.Output1)
intersection_x_5 = Number(a_3)
intersection_y_5 = Number(addition_30)
combine_12 = CombineData(Input0=sift_32.Output0, Input1=intersection_y_5)  # -> Result, Index
combine_13 = CombineData(Input0=division_18, Input1=intersection_x_5)  # -> Result, Index
intersection_x_6 = Number(combine_13.Result)
intersection_y_6 = Number(combine_12.Result)
xy_6 = XYPlane(Origin=Point(0, 0, 0))
pt_15 = PointOriented(BasePlane=xy_6, UComponent=intersection_x_6, VComponent=intersection_y_6, WComponent=0)

# ----
# true --> real insection
# false --> extend
# 10,11 --> real insection
# 01       --> extend one line
# 00       --> extend two lines
# true   -- > extend one line
# false -->  extend two lines
dom_9 = ConstructDomain(DomainStart=complex_23.Imaginary, DomainEnd=complex_26.Imaginary)
dom_10 = ConstructDomain(DomainStart=complex_23.Real, DomainEnd=complex_26.Real)
dom_11 = ConstructDomain(DomainStart=complex_24.Real, DomainEnd=complex_25.Real)
dom_12 = ConstructDomain(DomainStart=complex_24.Imaginary, DomainEnd=complex_25.Imaginary)
firstpty_domain_2 = Domain(dom_9)
firstptx_domain_2 = Domain(dom_10)
endpty_domain_2 = Domain(dom_12)
endptx_domain_2 = Domain(dom_11)
inc_9 = Includes(Value=intersection_y_6, Domain=firstpty_domain_2)  # -> Includes, Deviation
inc_10 = Includes(Value=intersection_x_6, Domain=endptx_domain_2)  # -> Includes, Deviation
inc_11 = Includes(Value=intersection_y_6, Domain=endpty_domain_2)  # -> Includes, Deviation
inc_12 = Includes(Value=intersection_x_6, Domain=firstptx_domain_2)  # -> Includes, Deviation
or_7 = GateOr(A=inc_12.Includes, B=inc_9.Includes, C=inc_10.Includes, D=inc_11.Includes)
and_9 = GateAnd(A=inc_12.Includes, B=inc_9.Includes, C=inc_10.Includes, D=inc_11.Includes)
int_19 = Integer(and_9)
int_20 = Integer(or_7)
concat_9 = Concatenate(FragmentA=int_19, FragmentB=int_20)
panel_109 = Panel("""10
11
01
00""")
panel_110 = Panel("""0
0
1
2""")
keysearch_2 = KeyValueSearch(Keys=panel_109, Values=panel_110, Search=concat_9)
extendlinecount_4 = Integer(keysearch_2)

sift_33 = SiftPattern(List=pt_15, SiftPattern=extendlinecount_4)  # -> Output0, Output1, Output2
# each line first point
# each line end point
intersectiononextend_4 = Point(sift_33.Output2)
intersectionontwolines_4 = Point(sift_33.Output0)
intersectionononeline_4 = Point(sift_33.Output1)
