# Grasshopper definition 20161017_PE_points_intersection_011_lineDatabase.gh (Grasshopper 0.9.76)

databaseparameters = Panel("""A
B
C
k
a
b
[x0,y0]
[x1,y1]
[A0,B0,C0]
[A1,B1,C1]
m
[A2,B2,C2]
angle
p
vector
normal_vector""")
txt = Text("A")
txt_2 = Text(databaseparameters)
keysearch = KeyValueSearch(Keys=txt_2, Search=txt)
panel = Panel("""0;0;0_3.2/1_1.0/3_2.2/5_4.0
1;0;2_2.5/3_4.0/4_8.2/5_1.2/7_2,3.2
2;0;1_2.2/7_2,1.9/11_3.222
3;0;4_8.2/6_4,2.2/14_2.442,3.442""")
line = Line([Line((-9, 0, 1), (7, 0, 7)), Line((8, 0, 5), (0, 0, -9)), Line((-8, 0, -6), (1, 0, -1)), Line((4, 0, 3), (-3, 0, -2))])
lng = ListLength(List=line)

# ----
# log:
# 20161010
# 设计向量方向与数据结构之间的映射关系
# 数据结构用集合运算然后替换
# 替换树形结构的时候需要拍平
# 无论什么情况都留出0123正交的位置为Null
# 如果0123存在，没关系，不存在，插入一个空值
# 20161011
# 角度和path之间的映射关系，以及角度的识别
# 线交的算法与path之间多对多的关系
pi = Pi(Factor="2")
# {0,0}-->0/2*pi
# 0/2*pi <= a< 1/2*pi
# {1,0}-->1/2*pi
# 1/2*pi <= a < 2/2*pi
# {2,0}-->2/2*pi
# 2/2*pi <= a < 3/2*pi
# {3,0}-->3/2*pi
# 3/2*pi <= a < 4/2*pi
# log:
# 20161010
# 如果0123存在，没关系，不存在，插入一个空值
# 光是插入一个空值也是不行，修改标签运算的算法使其更合理:原因是set的时候把null去掉了
# 应该是插入不是替换
# 不是插入一个Null就能解决问题的，问题处在了member的寻找上，寻找时候把null数据给删除了，结果找不到对应的path
random = Random(Range=pi, Number="20", Seed=Slider(33.222, range=0..100))

panel_2 = Panel("""2,1,2
3,2,2
3,3,4
1,2,2""")

pi_2 = Pi(Factor=1)
ins = InsertItems(List=random, Item=pi_2, Indices="0", Wrap=True)

series = Series(Start=0, Step=1, Count=lng)
panel_3 = Panel("""0
1
2""")
panel_4 = Panel("""0
0
0
0""")
# log:
# 20161017
# 给定相应的数据，去匹配相应的算法
# 考虑是否要反馈数据
# path在后面匹配时，相同path的被放在一起，真tm尴尬...
# 完成一个基本的模板，明天按照这样继续做下去
split = TextSplit(Text=panel, Separators=";")
# kernel intersection algorithm 002_siftPoint
panel_5 = Panel("""0
0.4
1
1.5
1.5
1.92

2.05
2.1
2.4
2.3
2.3
2.1
3
3.12
3.11
3.12""")
vec = Vector(panel_2)
int = Integer(flatten(series))
curvetype = Integer(panel_4)
int_2 = Integer(panel_3)
# Point:indicate a position in space
# Line:length,direction,position
# Point
# two ends of the line
# the intersection of two lines
# the meeting of lines at the corner of a space or volumn
# the center of field
panel_6 = Panel("""0
0.4
1
1.5
1.5
1.92

2.05
2.1
2.4
2.3
2.3
2.1
3
3.12
3.11
3.12""")
item = ListItem(List=split, Index=0, Wrap=True)  # -> Item, Item1, Item2
split_2 = TextSplit(Text=item.Item2, Separators="/")
pdecon = Deconstruct(Point=vec)  # -> XComponent, YComponent, ZComponent
lng_2 = ListLength(List=int_2)
split_3 = TextSplit(Text=split_2, Separators="_")

# ----
# mapping between angle and path
# {0;0} --> 0
# {1;0} --> 1/2*pi
# {2;0} --> pi
# {3;0} --> 3/2*pi
# 当向量中不存在某正交方向时候为Null
# vectorPath00_can't identify reverse vectors
panel_7 = Panel("2")
pi_3 = Pi(Factor=panel_7)
num = Number(panel_5)
remap = RemapNumbers(Value=num, Source="4", Target=pi_3)  # -> Mapped, Clipped
pi_4 = Pi(Factor=1)
sort = SortList(Keys=remap.Mapped)  # -> Keys, ValuesA
division = Division(A=pi_4, B="2")
series_2 = Series(Start=0, Step=division, Count="5")
consec = ConsecutiveDomains(Numbers=series_2, Additive=False)  # -> simplify(Domains)
domain = Domain(graft(consec))
angle = Number(sort.Keys)
dedomain = DeconstructDomain(Domain=domain)  # -> Start, End
larger = LargerThan(FirstNumber=angle, SecondNumber=dedomain.Start)  # -> LargerThan, OrEqualTo
smaller = SmallerThan(FirstNumber=angle, SecondNumber=dedomain.End)  # -> SmallerThan, OrEqualTo
and = GateAnd(A=larger.OrEqualTo, B=smaller.SmallerThan)
sift = SiftPattern(List=angle, SiftPattern=and)  # -> Output0, Output1
clean = CleanTree(RemoveNulls=True, RemoveInvalid=True, RemoveEmpty=False, Tree=sift.Output1)  # -> simplify(Tree)
item_2 = ListItem(List=clean, Index="0", Wrap=True)
equals = Equality(FirstNumber=item_2, SecondNumber=simplify(dedomain.Start))  # -> Equality, Inequality
int_3 = Integer(equals.Inequality)
ins_2 = InsertItems(List=clean, Indices="0", Wrap=True)
neg = Negative(Value=int_3)
cull_i = CullIndex(List=ins_2, Indices=neg, Wrap=False)  # -> simplify(List)
num_2 = Number(cull_i)
cset = CreateSet(List=num_2)  # -> Set, Map
addition = Addition(A=cset.Map, B=int_3)
tstat = TreeStatistics(Tree=addition)  # -> Paths, Length, Count
dpath = DeconstructPath(Branch=tstat.Paths)
graft = GraftTree(Tree=addition, IncludeEmptyLists=True, IncludeNullItems=True)
stack = StackData(Data=dpath, Stack=graft(tstat.Length))
graft_2 = GraftTree(Tree=cull_i, IncludeEmptyLists=True, IncludeNullItems=True)
graft_3 = GraftTree(Tree=stack, IncludeEmptyLists=True, IncludeNullItems=True)  # -> simplify(Tree)
ins_3 = InsertItems(List=graft_3, Item=graft, Indices="-1", Wrap=True)
path = ConstructPath(Indices=ins_3)  # -> simplify(Branch)
viewer = ParamViewer(graft_2)
flatten = FlattenTree(Tree=path, Path="{0}")
flatten_2 = FlattenTree(Tree=cull_i, Path="{0}")
replace = ReplacePaths(Data=graft_2, Search=viewer, Replace=flatten)
graft_4 = GraftTree(Tree=sort.Keys, IncludeEmptyLists=True, IncludeNullItems=True)  # -> simplify(Tree)
keysearch_2 = KeyValueSearch(Keys=flatten_2, Values=flatten, Search=graft_4)

panel_8 = Panel("""0
1
2
3
2
2
3
1
2
1
0
0
2
0
1
3""")
item_3 = ListItem(List=split_3, Index=0, Wrap=True)  # -> simplify(Item), Item1
stack_2 = StackData(Data=curvetype, Stack=lng_2)
panel_9 = Panel(pdecon.ZComponent)
stack_3 = StackData(Data=int, Stack=lng_2)
panel_10 = Panel(pdecon.YComponent)
panel_11 = Panel(pdecon.XComponent)
multiplication = Multiplication(A=lng, B=lng_2)
split_4 = TextSplit(Text=item_3.Item1, Separators=",")  # -> simplify(Result)
repeat = RepeatData(Data=int_2, Length=multiplication)  # -> flatten(Data)
pshift = ShiftPaths(Data=item_3.Item, Offset=-1)
graft_5 = GraftTree(Tree=stack_3, IncludeEmptyLists=True, IncludeNullItems=True)
graft_6 = GraftTree(Tree=stack_2, IncludeEmptyLists=True, IncludeNullItems=True)
graft_7 = GraftTree(Tree=repeat, IncludeEmptyLists=True, IncludeNullItems=True)
entwine = Entwine(Branch00=pdecon.XComponent, Branch01=pdecon.YComponent, Branch02=pdecon.ZComponent, FlattenInputs=True)
lng_3 = ListLength(List=pshift)
stack_4 = StackData(Data=item.Item1, Stack=lng_3)
stack_5 = StackData(Data=item.Item, Stack=lng_3)
graft_8 = GraftTree(Tree=stack_4, IncludeEmptyLists=True, IncludeNullItems=True)
graft_9 = GraftTree(Tree=stack_5, IncludeEmptyLists=True, IncludeNullItems=True)

# ----
# log:
# 20161011
# 增强path的排序的算法前馈，可通过path运算直接得到向量关系:
# 排序前后问题：
# 先精确控制还是先离散问题
# 应该是把排序前的原始数据进行path替换，而不是排序之后的数据：结果竟然是一样的。。。！
# 20161017
# 修改好排序过后path下为空值产生的错误
# vectorPath01
# mapping between angle and path
# {0;0} --> 0
# {1;0} --> 1/2*pi
# {2;0} --> pi
# {3;0} --> 3/2*pi
# 无所谓正交向量存不存在
panel_12 = Panel("""0
1
0
1.3
3
1
2.3
2""")
jitter = Jitter(List=panel_8, Jitter=1, Seed=2)  # -> Values, Indices
pi_5 = Pi(Factor=1)
pi_6 = Pi(Factor="2")
num_3 = Number(jitter.Values)
division_2 = Division(A=pi_5, B="2")
# log:
# 20161010
# 不是插入一个Null就能解决问题的，问题处在了member的寻找上，寻找时候把null数据给删除了，结果找不到对应的path:
# 找到替换的member的运算器
# 发现前馈需要一大堆的运算器，先做成后馈
panel_13 = Panel("5")
remap_2 = RemapNumbers(Value=num_3, Source="4", Target=pi_6)  # -> Mapped, Clipped
series_3 = Series(Start=0, Step=division_2, Count=panel_13)
consec_2 = ConsecutiveDomains(Numbers=series_3, Additive=False)  # -> simplify(Domains)
angle_2 = Number(remap_2.Mapped)
domain_2 = Domain(graft(consec_2))
dedomain_2 = DeconstructDomain(Domain=domain_2)  # -> simplify(Start), simplify(End)
larger_2 = LargerThan(FirstNumber=angle_2, SecondNumber=dedomain_2.Start)  # -> LargerThan, OrEqualTo
smaller_2 = SmallerThan(FirstNumber=angle_2, SecondNumber=dedomain_2.End)  # -> SmallerThan, OrEqualTo
and_2 = GateAnd(A=larger_2.OrEqualTo, B=smaller_2.SmallerThan)
sift_2 = SiftPattern(List=angle_2, SiftPattern=and_2)  # -> Output0, Output1
clean_2 = CleanTree(RemoveNulls=True, RemoveInvalid=False, RemoveEmpty=True, Tree=sift_2.Output1)  # -> simplify(Tree)
tstat_2 = TreeStatistics(Tree=clean_2)  # -> Paths, Length, Count
branch = TreeBranch(Tree=dedomain_2.Start, Path=tstat_2.Paths, MaintainPaths=True)
subtraction = Subtraction(A=clean_2, B=branch)
num_4 = Number(clean_2)
eval = Evaluate(F="round(x,4)", x=subtraction)
flatten_3 = FlattenTree(Tree=eval, Path="{0}")
cset_2 = CreateSet(List=flatten_3)  # -> Set, Map
sort_2 = SortList(Keys=cset_2.Set)  # -> Keys, ValuesA
mindex = MemberIndex(Set=sort_2.Keys, Member=eval)  # -> Index, Count
pshift_2 = ShiftPaths(Data=mindex.Index, Offset=-1)
flatten_4 = FlattenTree(Tree=mindex.Index, Path="{0}")
tstat_3 = TreeStatistics(Tree=pshift_2)  # -> Paths, Length, Count
dpath_2 = DeconstructPath(Branch=tstat_3.Paths)
graft_10 = GraftTree(Tree=flatten_4, IncludeEmptyLists=True, IncludeNullItems=True)  # -> simplify(Tree)
stack_6 = StackData(Data=dpath_2, Stack=graft(tstat_3.Length))
graft_11 = GraftTree(Tree=angle_2, IncludeEmptyLists=True, IncludeNullItems=True)
flatten_5 = FlattenTree(Tree=stack_6, Path="{0}")
graft_12 = GraftTree(Tree=flatten_5, IncludeEmptyLists=True, IncludeNullItems=True)  # -> simplify(Tree)
merge = Merge(Data1=graft_12, Data2=graft_10)
path_2 = ConstructPath(Indices=merge)
graft_13 = GraftTree(Tree=num_4, IncludeEmptyLists=True, IncludeNullItems=True)
flatten_6 = FlattenTree(Tree=path_2, Path="{0}")
flatten_7 = FlattenTree(Tree=graft_13, Path="{0}")
viewer_2 = ParamViewer(graft_13)
keysearch_3 = KeyValueSearch(Keys=flatten_7, Values=flatten_6, Search=graft_11)  # -> simplify(Result)
replace_2 = ReplacePaths(Data=graft_13, Search=viewer_2, Replace=flatten_6)
panel_14 = Panel(replace_2)
panel_15 = Panel(keysearch_3)

merge_2 = Merge(Data1=graft_5, Data2=graft_6, Data3=graft_7)
int_4 = Integer(simplify(graft_9))
int_5 = Integer(simplify(graft_8))
int_6 = Integer(simplify(item_3.Item))
num_5 = Number(simplify(split_4))
flip = FlipMatrix(Data=entwine)
path_3 = ConstructPath(Indices=merge_2)
databasemapping = Panel("""0,1,2;(0!=zero)and(1!=zero)
3,6;
4,5;(4!=zero)and(5!=zero)
3,5;
6,7;(6[0]!=6[1])and(7[0]!=7[1])
8,9,10;
6,11;
12,13;12=!k*pi,k=1,2,3..
6,14;(14[0]!=zero)and(14[1]!=zero)
6,15;(15[0]!=zero)and(15[1]!=zero)""")
merge_3 = Merge(Data1=int_4, Data2=int_5, Data3=int_6)
graft_14 = GraftTree(Tree=flip, IncludeEmptyLists=True, IncludeNullItems=True)
viewer_3 = ParamViewer(num_5)
path_4 = DataPath(path_3)
path_5 = ConstructPath(Indices=merge_3)
flatten_8 = FlattenTree(Tree=path_5, Path="{0}")
replace_3 = ReplacePaths(Data=num_5, Search=viewer_3, Replace=flatten_8)
flatten_9 = FlattenTree(Tree=path_4, Path="{0}")
viewer_4 = ParamViewer(graft_14)
panel_16 = Panel("""2.5838678
Pi
1.6421
3.212896
1.5*Pi""")
data = Data(replace_3)
tstat_4 = TreeStatistics(Tree=data)  # -> Paths, Length, Count

# ----
# log:
# 20161010
# 应该是插入不是替换：
# 连一个新电池，是True就插入，False就不插入
# 简短的并不需要连接电池
# 插入的应该是一个Null值，而不是正交角度
# instance
panel_17 = Panel("0")
item_4 = ListItem(List=clean, Index=panel_17, Wrap=True)
equals_2 = Equality(FirstNumber=item_4, SecondNumber=simplify(dedomain.Start))  # -> Equality, Inequality
num_6 = Number(clean)
neg_2 = Negative(Value=equals_2.Inequality)
ins_4 = InsertItems(List=num_6, Indices=graft("0"), Wrap=True)
cull_i_2 = CullIndex(List=ins_4, Indices=neg_2, Wrap=False)  # -> simplify(List)

replace_4 = ReplacePaths(Data=graft_14, Search=viewer_4, Replace=flatten_9)
panel_18 = Panel(graft_14)
dpath_3 = DeconstructPath(Branch=tstat_4.Paths)  # -> simplify(Indices)
tstat_5 = TreeStatistics(Tree=replace_4)  # -> simplify(Paths), Length, Count
databasemapping_2 = Panel("""0,1,2
3,6
4,5
3,5
6,7
8,9,10
6,11
12,13
6,14
6,15""")
item_5 = ListItem(List=dpath_3, Index="2", Wrap=False)
viewer_5 = ParamViewer(item_5)

# ----
# log:
# 20161010
# 插入的应该是一个Null值，而不是正交角度:
# 先保留空值，后根据boolean删除Null
# 插入一个空值的方法：
# 运用cull index运算器本身的性质，对布尔值进行negetive后删除不需要的空值
toggle = BooleanToggle(False)
series_4 = Series(Start=0, Step=1, Count=3)  # -> simplify(graft(Series))
graft_15 = GraftTree(Tree="0", IncludeEmptyLists=True, IncludeNullItems=True)  # -> graft(Tree)
panel_19 = Panel([Toggle(False), Toggle(True), toggle])
bool = Boolean(panel_19)
ins_5 = InsertItems(List=series_4, Indices=graft_15, Wrap=True)  # -> simplify(List)
# log:
# 20161010
# 设计向量方向与数据结构之间的映射关系
# 数据结构用集合运算然后替换
# 替换树形结构的时候需要拍平
# 无论什么情况都留出0123正交的位置为Null
# 如果0123存在，没关系，不存在，插入一个空值
# 20161011
# 角度和path之间的映射关系，以及角度的识别:
# 分解basic line的path得到位置位置关系
# 先正交的位置关系，后自由的位置关系
# 考虑先组合line还是先分解path在配对
# 如何识别path知道非正交的相反的向量
# 增强path的排序的算法前馈，可通过path运算直接得到向量关系
# 运用path提取相应的两条交线
# 20161012
# debug时候replacePath爆红
# 精度问题导致set不能去掉原本偏差相同的角度
# 20161017
# 找到了两根交线的关系，先把他放在这，具体怎么用不继续做下去，先考虑其他的大的情况
# 先罗列出方程对应的算法
# 建立数据库，对数据结构进行设计，让每一个数据都有对应的位置
# 给定相应的数据，去匹配相应的算法
# 考虑是否要反馈数据
int_7 = Integer(bool)
neg_3 = Negative(Value=int_7)
cull_i_3 = CullIndex(List=ins_5, Indices=graft(neg_3), Wrap=False)
panel_20 = Panel(cull_i_3)

dpath_4 = DeconstructPath(Branch=tstat_5.Paths)  # -> simplify(Indices)
# log:
# 20161010
# 发现前馈需要一大堆的运算器，先做成后馈
# 如果需要前反馈，可能需要修改标签运算的算法，所以先后馈，至少能做下去
# 重新Partition
# 还是回到前馈
# log:
# 20161010
# 还是回到前馈：
# 用set运算器自带的index记录，与boolean值进行相加，对path运算得到新的path
# log:
# 20161010
# 设计向量方向与数据结构之间的映射关系
# 数据结构用集合运算然后替换
# 替换树形结构的时候需要拍平
# 无论什么情况都留出0123正交的位置为Null
# 如果0123存在，没关系，不存在，插入一个空值
# 20161011
# 角度和path之间的映射关系，以及角度的识别:
# 先正交的位置关系，后自由的位置关系
# 如何识别path知道非正交的相反的向量
# 增强path的排序的算法前馈，可通过path运算直接得到向量关系
panel_21 = Panel(clean)
replace_5 = ReplacePaths(Data=item_5, Search=viewer_5, Replace=flatten_8)
item_6 = ListItem(List=dpath_4, Index="0", Wrap=False)
item_7 = ListItem(List=dpath_4, Index="2", Wrap=False)
panel_22 = Panel(data)

split_5 = TextSplit(Text=databasemapping_2, Separators=",")
pshift_3 = ShiftPaths(Data=replace_5, Offset=-1)

lng_4 = ListLength(List=pshift_3)
sift_3 = SiftPattern(List=replace_4, SiftPattern=item_7)  # -> Output0, Output1, Output2, Output3, Output4, Output5, Output6, Output7, Output8, Output9
flatten_10 = FlattenTree(Tree=split_5, Path="{0}")
tstat_6 = TreeStatistics(Tree=split_5)  # -> Paths, Length, Count
sift_4 = SiftPattern(List=replace_4, SiftPattern=item_6)  # -> Output0, Output1, Output2, Output3
tstat_7 = TreeStatistics(Tree=pshift_3)  # -> Paths, Length, Count
lng_5 = ListLength(List=flatten_10)
multiplication_2 = Multiplication(A=lng_4, B=tstat_6.Count)
multiplication_3 = Multiplication(A=tstat_7.Count, B=lng_5)
panel_23 = Panel(sift_3.Output0)
dataparameterspath = Panel(pshift_3)
panel_24 = Panel(sift_4.Output3)
repeat_2 = RepeatData(Data=pshift_3, Length=multiplication_2)  # -> simplify(Data)
repeat_3 = RepeatData(Data=flatten_10, Length=multiplication_3)

# ----
# sample_treeStatistics
cset_3 = CreateSet(List=num_2)  # -> Set, Map
tstat_8 = TreeStatistics(Tree=cset_3.Map)  # -> Paths, Length, Count
dpath_5 = DeconstructPath(Branch=tstat_8.Paths)
stack_7 = StackData(Data=dpath_5, Stack=graft(tstat_8.Length))
graft_16 = GraftTree(Tree=cset_3.Map, IncludeEmptyLists=True, IncludeNullItems=True)
graft_17 = GraftTree(Tree=stack_7, IncludeEmptyLists=True, IncludeNullItems=True)  # -> simplify(Tree)
ins_6 = InsertItems(List=graft_17, Item=graft_16, Indices="-1", Wrap=True)
path_6 = ConstructPath(Indices=ins_6)  # -> simplify(Branch)
flatten_11 = FlattenTree(Tree=path_6, Path="{0}")

panel_25 = Panel(sift_4.Output0)
partition = PartitionList(List=repeat_3, Size=lng_5)
partition_2 = PartitionList(List=partition, Size=tstat_6.Length)  # -> simplify(Chunks)
partition_3 = PartitionList(List=repeat_2, Size=lng_4)  # -> simplify(Chunks)
functionpath = Panel(split_5)
int_8 = Integer(partition_2)
int_9 = Integer(partition_3)
mindex_2 = MemberIndex(Set=int_8, Member=int_9)  # -> Index, Count
lng_6 = ListLength(List=int_8)
ma = MassAddition(Input=mindex_2.Count)  # -> Result, PartialResults
panel_26 = Panel("""2
3""")
panel_27 = Panel("""2
2""")
panel_28 = Panel("""1
3
5""")
panel_29 = Panel("""1
0
4""")
panel_30 = Panel("""7
2
2""")
panel_31 = Panel("""2,3,1
4,2,3
1,3,2""")
panel_32 = Panel("""3,2,2
2,3,2
4,1,3""")
panel_33 = Panel("""3
2
1""")
panel_34 = Panel("""3,2,2
1,3,4
4,1,3""")
panel_35 = Panel("""3.22133
1.3229
pi""")
panel_36 = Panel("""3.42
5.33
1.44""")
equals_3 = Equality(FirstNumber=lng_6, SecondNumber=ma.Result)  # -> Equality, Inequality
panel_37 = Panel("""3,2
1,3
0,1""")
panel_38 = Panel("""2,3
4,0
1,3""")
databaseparameters_2 = Panel("""A
B
C
k
a
b
pt0(x0,y0)
pt1(x1,y1)
intersection_line0(A0,B0,C0)
intersection_line1(A1,B1,C1)
intersection_m
parallel_line(A2,B2,C2)
angle
distance(p)
vector(u,v)
normal_vector(nu,nv)""")
panel_39 = Panel("""1
3""")
sift_5 = SiftPattern(List=int_9, SiftPattern=equals_3.Equality)  # -> Output0, Output1
sift_6 = SiftPattern(List=int_8, SiftPattern=equals_3.Equality)  # -> Output0, Output1
A = Number(panel_26)
B = Number(panel_27)
C = Number(panel_39)
k = Number(panel_28)
a = Number(panel_29)
b = Number(panel_30)
pt0 = Point([Point(-8, -7, 0), Point(-5, 0, 0), Point(-16, -3, 0)])
pt1 = Point([Point(-8, -10, 0), Point(3, -7, 0), Point(-4, -2, 0)])
intersection_line0_a0_b0_c0 = Vector(panel_31)
intersection_line0_a1_b1_c1 = Vector(panel_32)
intersection_m = Number(panel_33)
parallel_line_a2_b2_c2 = Vector(panel_34)
angle_3 = Number(panel_35)
distance_p = Number(panel_36)
vector_u_v = Vector(panel_37)
normal_vector_nu_nv = Vector(panel_38)

# ----
# path{x;y}表示，索引为x的线可以匹配索引为y算法。
# 如果是相同x下有多个，说明算法上有多个选择
clean_3 = CleanTree(RemoveNulls=True, RemoveInvalid=True, RemoveEmpty=True, Tree=sift_5.Output1)
clean_4 = CleanTree(RemoveNulls=True, RemoveInvalid=True, RemoveEmpty=True, Tree=sift_6.Output1)

tstat_9 = TreeStatistics(Tree=clean_4)  # -> Paths, Length, Count
dpath_6 = DeconstructPath(Branch=tstat_9.Paths)
item_8 = ListItem(List=dpath_6, Index=0, Wrap=True)  # -> Item, Item1
pi_7 = Pi(Factor=1)
viewer_6 = ParamViewer(item_8.Item)
path_7 = FilePath(tstat_9.Paths)
complex = ComplexComponents(Complex=pt0)  # -> Real, Imaginary
complex_2 = ComplexComponents(Complex=pt1)  # -> Real, Imaginary
division_3 = Division(A=angle_3, B=pi_7)
int_10 = Integer(division_3)
replace_6 = ReplacePaths(Data=item_8.Item, Search=viewer_6, Replace=path_7)
replace_7 = ReplacePaths(Data=item_8.Item1, Search=viewer_6, Replace=path_7)
databasefunctions = Panel("""Ax+By+C=0,A!=0 and B!=0
y-y0=k(x-x0),k!=empty
x/a+y/b=1,a!=0andb!=0
y=kx+b,k!=empty
(y-y1)(y2-y1)=(x-x1)(x2-x1),x1!=x2andy1!=y2
f1(x,y)*m+f2(x,y)=0
f(x,y)-f(x0,y0)=0
x*cos(angle)+y*sin(angle)-p=0,angle=!k*pi
(x-x0)/u=(y-y0)/v,u!=0andv!=0
nu*(x-x0)+nv(y-y0)=0,nv!=0andnu!=0""")
complex_3 = ComplexComponents(Complex=vector_u_v)  # -> Real, Imaginary
x0 = Number(complex.Real)
y0 = Number(complex.Imaginary)
x1 = Number(complex_2.Real)
y1 = Number(complex_2.Imaginary)
subtraction_2 = Subtraction(A=division_3, B=int_10)
equals_4 = Equality(FirstNumber=A, SecondNumber="0")  # -> Equality, Inequality
equals_5 = Equality(FirstNumber=B, SecondNumber="0")  # -> Equality, Inequality
abs = Absolute(Value=subtraction_2)
int_11 = Integer(clean_4)
int_12 = Integer(replace_6)
int_13 = Integer(replace_7)
merge_4 = Merge(Data1=graft(A), Data2=graft(B), Data3=graft(C))
equals_6 = Equality(FirstNumber=a, SecondNumber="0")  # -> Equality, Inequality
equals_7 = Equality(FirstNumber=b, SecondNumber="0")  # -> Equality, Inequality
pdecon_2 = Deconstruct(Point=intersection_line0_a0_b0_c0)  # -> XComponent, YComponent, ZComponent
pdecon_3 = Deconstruct(Point=intersection_line0_a1_b1_c1)  # -> XComponent, YComponent, ZComponent
complex_4 = ComplexComponents(Complex=normal_vector_nu_nv)  # -> Real, Imaginary
and_3 = GateAnd(A=graft(equals_4.Inequality), B=graft(equals_5.Inequality))
equals_8 = Equality(FirstNumber=complex_3.Real, SecondNumber="0")  # -> Equality, Inequality
equals_9 = Equality(FirstNumber=complex_3.Imaginary, SecondNumber="0")  # -> Equality, Inequality
larger_3 = LargerThan(FirstNumber=abs, SecondNumber="0.000001")  # -> LargerThan, OrEqualTo

tstat_10 = TreeStatistics(Tree=int_12)  # -> Paths, Length, Count
flatten_12 = FlattenTree(Tree=int_12, Path="{0}")
cset_4 = CreateSet(List=flatten_12)  # -> Set, Map
item_9 = ListItem(List=tstat_10.Paths, Index=cset_4.Set, Wrap=False)

and_4 = GateAnd(A=equals_6.Inequality, B=equals_7.Inequality)
panel_40 = Panel(clean_3)
equals_10 = Equality(FirstNumber=complex_4.Real, SecondNumber="0")  # -> Equality, Inequality
equals_11 = Equality(FirstNumber=complex_4.Imaginary, SecondNumber="0")  # -> Equality, Inequality
and_5 = GateAnd(A=equals_8.Inequality, B=equals_9.Inequality)
pdecon_4 = Deconstruct(Point=parallel_line_a2_b2_c2)  # -> XComponent, YComponent, ZComponent
sift_7 = SiftPattern(List=merge_4, SiftPattern=and_3)  # -> Output0, Output1
sift_8 = SiftPattern(List=angle_3, SiftPattern=larger_3.LargerThan)  # -> Output0, Output1
sift_9 = SiftPattern(List=distance_p, SiftPattern=larger_3.LargerThan)  # -> Output0, Output1
and_6 = GateAnd(A=equals_10.Inequality, B=equals_11.Inequality)
sift_10 = SiftPattern(List=complex_4.Imaginary, SiftPattern=and_6)  # -> Output0, Output1
sift_11 = SiftPattern(List=complex_4.Real, SiftPattern=and_6)  # -> Output0, Output1
sift_12 = SiftPattern(List=complex_3.Imaginary, SiftPattern=and_5)  # -> Output0, Output1
sift_13 = SiftPattern(List=complex_3.Real, SiftPattern=and_5)  # -> Output0, Output1
sift_14 = SiftPattern(List=a, SiftPattern=and_4)  # -> Output0, Output1
sift_15 = SiftPattern(List=b, SiftPattern=and_4)  # -> Output0, Output1
item_10 = ListItem(List=sift_7.Output1, Index=0, Wrap=True)  # -> Item, Item1, Item2
branch_2 = TreeBranch(Tree=int_13, Path=item_9, MaintainPaths=True)
branch_3 = TreeBranch(Tree=int_12, Path=item_9, MaintainPaths=True)
branch_4 = TreeBranch(Tree=int_11, Path=item_9, MaintainPaths=True)
eval_2 = Evaluate(F="{cos(angle),sin(angle),-p}", angle=sift_8.Output1, p=sift_9.Output1)
eval_3 = Evaluate(
    F="{m*A0+A1,m*B0+B1,m*C0+C1}",
    A0=pdecon_2.XComponent,
    B0=pdecon_2.YComponent,
    C0=pdecon_2.ZComponent,
    A1=pdecon_3.XComponent,
    B1=pdecon_3.YComponent,
    C1=pdecon_3.ZComponent,
    m=intersection_m)
eval_4 = Evaluate(F="{A2,B2,-A2*x0-B2*y0}", A2=pdecon_4.XComponent, B2=pdecon_4.YComponent, C2=pdecon_4.ZComponent, x0=x0, y0=y0)
eval_5 = Evaluate(F="{nu,nv,-nu*x0-nv*y0}", x0=x0, y0=y0, nu=sift_11.Output1, nv=sift_10.Output1)

# ----
# 相同path的被放在一起了，真tm尴尬
tstat_11 = TreeStatistics(Tree=clean_4)  # -> Paths, Length, Count
dpath_7 = DeconstructPath(Branch=tstat_11.Paths)
item_11 = ListItem(List=dpath_7, Index=0, Wrap=True)  # -> Item, Item1
viewer_7 = ParamViewer(item_11.Item)
path_8 = FilePath(tstat_11.Paths)
replace_8 = ReplacePaths(Data=item_11.Item, Search=viewer_7, Replace=path_8)
replace_9 = ReplacePaths(Data=item_11.Item1, Search=viewer_7, Replace=path_8)
int_14 = Integer(replace_8)
int_15 = Integer(clean_4)
lng_7 = ListLength(List=int_15)
flatten_13 = FlattenTree(Tree=item.Item1, Path="{0}")
int_16 = Integer(replace_9)
stack_8 = StackData(Data=int_14, Stack=lng_7)
item_12 = ListItem(List=flatten_13, Index=stack_8, Wrap=True)
stack_9 = StackData(Data=int_16, Stack=lng_7)
graft_18 = GraftTree(Tree=int_15, IncludeEmptyLists=True, IncludeNullItems=True)
graft_19 = GraftTree(Tree=stack_8, IncludeEmptyLists=True, IncludeNullItems=True)
graft_20 = GraftTree(Tree=item_12, IncludeEmptyLists=True, IncludeNullItems=True)
graft_21 = GraftTree(Tree=stack_9, IncludeEmptyLists=True, IncludeNullItems=True)
data_2 = Data(data)
merge_5 = Merge(Data1=graft_19, Data2=graft_20, Data3=graft_18)
merge_6 = Merge(Data1=graft_19, Data2=graft_20, Data3=graft_18, Data4=graft_21)
path_9 = ConstructPath(Indices=merge_5)
path_10 = ConstructPath(Indices=merge_6)
flatten_14 = FlattenTree(Tree=path_9, Path="{0}")
panel_41 = Panel(data_2)
flatten_15 = FlattenTree(Tree=path_10, Path="{0}")
panel_42 = Panel(flatten_14)
branch_5 = TreeBranch(Tree=data_2, Path=flatten_14, MaintainPaths=True)
viewer_8 = ParamViewer(branch_5)
replace_10 = ReplacePaths(Data=branch_5, Search=viewer_8, Replace=flatten_15)
panel_43 = Panel(branch_5)
data_3 = Data(branch_5)
data_4 = Data(data_3)
tstat_12 = TreeStatistics(Tree=data_4)  # -> Paths, Length, Count
panel_44 = Panel(data_4)
dpath_8 = DeconstructPath(Branch=tstat_12.Paths)  # -> simplify(Indices)
sift_16 = SiftPattern(List=data_4, SiftPattern=[0, 0, 1, 1])  # -> Output0, Output1
item_13 = ListItem(List=dpath_8, Index=0, Wrap=True)
panel_45 = Panel(item_13)

eval_6 = Evaluate(F="{k,-1,y0-k*x0}", k=k, x0=x0, y0=y0)
eval_7 = Evaluate(F="{x0-x1,y1-y0,x0*x1-y0*y1-x0*x0+y0*y0}", x0=x0, y0=y0, x1=x1, y1=y1)
eval_8 = Evaluate(F="{v,-u,-v*x0+u*y0}", x0=x0, y0=y0, u=sift_13.Output1, v=sift_12.Output1)
eval_9 = Evaluate(F="{A,B,C}", A=item_10.Item, B=item_10.Item1, C=item_10.Item2)
eval_10 = Evaluate(F="{b,a,-a*b}", a=sift_14.Output1, b=sift_15.Output1)
eval_11 = Evaluate(F="{k,-1,b}", k=k, b=b)

int_17 = Integer(branch_3)
int_18 = Integer(branch_2)
int_19 = Integer(branch_4)

panel_46 = Panel(eval_9)
panel_47 = Panel(eval_6)
panel_48 = Panel(eval_10)
panel_49 = Panel(eval_11)
panel_50 = Panel(eval_7)
panel_51 = Panel(eval_3)
panel_52 = Panel(eval_4)
panel_53 = Panel(eval_2)
panel_54 = Panel(eval_8)
panel_55 = Panel(eval_5)

# ----
# {a;b;c;d;e}
# a --> line index
# b --> line type
# c --> line parameter index
# d --> line function mapping
flatten_16 = FlattenTree(Tree=item.Item1, Path="{0}")
lng_8 = ListLength(List=int_19)
stack_10 = StackData(Data=int_17, Stack=lng_8)
item_14 = ListItem(List=flatten_16, Index=stack_10, Wrap=True)
stack_11 = StackData(Data=int_18, Stack=lng_8)
graft_22 = GraftTree(Tree=int_19, IncludeEmptyLists=True, IncludeNullItems=True)
graft_23 = GraftTree(Tree=stack_10, IncludeEmptyLists=True, IncludeNullItems=True)
graft_24 = GraftTree(Tree=item_14, IncludeEmptyLists=True, IncludeNullItems=True)
graft_25 = GraftTree(Tree=stack_11, IncludeEmptyLists=True, IncludeNullItems=True)
merge_7 = Merge(Data1=graft_23, Data2=graft_24, Data3=graft_22)
merge_8 = Merge(Data1=graft_23, Data2=graft_24, Data3=graft_22, Data4=graft_25)
path_11 = ConstructPath(Indices=merge_7)
path_12 = ConstructPath(Indices=merge_8)
data_5 = Data(data)
flatten_17 = FlattenTree(Tree=path_11, Path="{0}")
flatten_18 = FlattenTree(Tree=path_12, Path="{0}")
branch_6 = TreeBranch(Tree=data_5, Path=flatten_17, MaintainPaths=True)
viewer_9 = ParamViewer(branch_6)
replace_11 = ReplacePaths(Data=branch_6, Search=viewer_9, Replace=flatten_18)

panel_56 = Panel("""0
0.4
1
1.5
1.5
1.92
2
2.05
2.1
2.4
2.3
2.3
2.1
3
3.12
3.11
3.12""")
panel_57 = Panel("""0
1
2
3
2
2
3
1
2
1
0
0
2
0
1
3""")
panel_58 = Panel("""0
1
2
1.3
3
2.3
2""")
line_2 = Line(Line((119.3393443, -60.78584412, 0), (119.6525493, -60.78584412, 0)))
panel_59 = Panel("""0
1
0
1.3
3
1
2.3
2""")
line_3 = Line(Line((119.8096632, -60.78584412, 0), (119.4931182, -60.78584412, 0)))
panel_60 = Panel("运算器存在bug")
ccx = CurveCurve(CurveA=line_2, CurveB=line_3)  # -> Points, ParamsA, ParamsB

# ----
# mapping between angle and path
# {0;0} --> 0
# {1;0} --> 1/2*pi
# {2;0} --> pi
# {3;0} --> 3/2*pi
# 无所谓正交向量存不存在
jitter_2 = Jitter(List=panel_58, Jitter=1, Seed=2)  # -> Values, Indices
pi_8 = Pi(Factor=1)
pi_9 = Pi(Factor="2")
division_4 = Division(A=pi_8, B="2")
num_7 = Number(jitter_2.Values)
# log:
# 20161011
# 增强path的排序的算法前馈，可通过path运算直接得到向量关系:
# 排序前后问题：
# 先精确控制还是先离散问题
remap_3 = RemapNumbers(Value=num_7, Source="4", Target=pi_9)  # -> Mapped, Clipped
series_5 = Series(Start=0, Step=division_4, Count="5")
consec_3 = ConsecutiveDomains(Numbers=series_5, Additive=False)  # -> simplify(Domains)
angle_4 = Number(remap_3.Mapped)
domain_3 = Domain(graft(consec_3))
dedomain_3 = DeconstructDomain(Domain=domain_3)  # -> simplify(Start), simplify(End)
# log:
# 20161012
# debug时候replacePath爆红:
# 删除空的树形数据结构，merge的时候数据结构对应
# 精度问题导致set不能去掉原本偏差相同的角度：
# 用round函数取到小数点后几位，关键是排序，这样做就不会对原来的数据产生什么影响，是标签改对了
larger_4 = LargerThan(FirstNumber=angle_4, SecondNumber=dedomain_3.Start)  # -> LargerThan, OrEqualTo
smaller_3 = SmallerThan(FirstNumber=angle_4, SecondNumber=dedomain_3.End)  # -> SmallerThan, OrEqualTo
and_7 = GateAnd(A=larger_4.OrEqualTo, B=smaller_3.SmallerThan)
sift_17 = SiftPattern(List=angle_4, SiftPattern=and_7)  # -> Output0, Output1
clean_5 = CleanTree(RemoveNulls=True, RemoveInvalid=False, RemoveEmpty=True, Tree=sift_17.Output1)  # -> simplify(Tree)
tstat_13 = TreeStatistics(Tree=clean_5)  # -> Paths, Length, Count
branch_7 = TreeBranch(Tree=dedomain_3.Start, Path=tstat_13.Paths, MaintainPaths=True)
subtraction_3 = Subtraction(A=clean_5, B=branch_7)
num_8 = Number(clean_5)
eval_12 = Evaluate(F="round(x,4)", x=subtraction_3)
flatten_19 = FlattenTree(Tree=eval_12, Path="{0}")
cset_5 = CreateSet(List=flatten_19)  # -> Set, Map
sort_3 = SortList(Keys=cset_5.Set)  # -> Keys, ValuesA
mindex_3 = MemberIndex(Set=sort_3.Keys, Member=eval_12)  # -> Index, Count
pshift_4 = ShiftPaths(Data=mindex_3.Index, Offset=-1)
flatten_20 = FlattenTree(Tree=mindex_3.Index, Path="{0}")
tstat_14 = TreeStatistics(Tree=pshift_4)  # -> Paths, Length, Count
dpath_9 = DeconstructPath(Branch=tstat_14.Paths)
graft_26 = GraftTree(Tree=flatten_20, IncludeEmptyLists=True, IncludeNullItems=True)  # -> simplify(Tree)
stack_12 = StackData(Data=dpath_9, Stack=graft(tstat_14.Length))
graft_27 = GraftTree(Tree=angle_4, IncludeEmptyLists=True, IncludeNullItems=True)
flatten_21 = FlattenTree(Tree=stack_12, Path="{0}")
graft_28 = GraftTree(Tree=flatten_21, IncludeEmptyLists=True, IncludeNullItems=True)  # -> simplify(Tree)
merge_9 = Merge(Data1=graft_28, Data2=graft_26)
path_13 = ConstructPath(Indices=merge_9)
graft_29 = GraftTree(Tree=num_8, IncludeEmptyLists=True, IncludeNullItems=True)
flatten_22 = FlattenTree(Tree=path_13, Path="{0}")
flatten_23 = FlattenTree(Tree=graft_29, Path="{0}")
viewer_10 = ParamViewer(graft_29)
keysearch_4 = KeyValueSearch(Keys=flatten_23, Values=flatten_22, Search=graft_27)  # -> simplify(Result)
replace_12 = ReplacePaths(Data=graft_29, Search=viewer_10, Replace=flatten_22)
path_14 = DataPath(keysearch_4)
# log:
# 20161010
# 设计向量方向与数据结构之间的映射关系
# 数据结构用集合运算然后替换
# 替换树形结构的时候需要拍平
# 无论什么情况都留出0123正交的位置为Null
# 如果0123存在，没关系，不存在，插入一个空值
# 20161011
# 角度和path之间的映射关系，以及角度的识别:
# 分解basic line的path得到位置位置关系
# 先正交的位置关系，后自由的位置关系
# 考虑先组合line还是先分解path在配对
# 如何识别path知道非正交的相反的向量
# 增强path的排序的算法前馈，可通过path运算直接得到向量关系
# 运用path提取相应的两条交线
# 20161012
# debug时候replacePath爆红
# 精度问题导致set不能去掉原本偏差相同的角度
# 20161017
# 找到了两根交线的关系，先把他放在这，具体怎么用不继续做下去，先考虑其他的大的情况
ultimateangle_afterelection = Number(replace_12)

line_bug_commonline = Line([Line((119.3540923, -60.56923774, 0), (119.5008735, -60.56923774, 0)), Line((119.5919791, -60.56923774, 0), (119.7404475, -60.56923774, 0))])
# debug:之前判断是实交和虚交的方法是判断交点point的x坐标是否在两线段的值域范围内，但是当上述情况的时候，直线会虚交被误判成实际交点
line_bug_insectiononextend = Line([Line((119.0174668, -60.28107794, 0), (119.4638718, -60.28107794, 0)), Line((119.2255633, -60.35451331, 0), (119.2255633, -61.15203638, 0))])
# log:
# 20161010
# 设计向量方向与数据结构之间的映射关系
# 分离对应的算法，让算法之间有通过也有分离
# 线线重合的问题解决后先放在一旁
# 数据结构的替换，在最后做
line_4 = Line([Line((119.5723897, -60.99532941, 0), (119.5723897, -61.13933165, 0)), Line((119.5723897, -60.99532941, 0), (119.7626783, -60.99532941, 0))])
int_20 = Integer(graft_25)
data_6 = Data(replace_11)
panel_61 = Panel("把正交和斜交的情况分离开来，同时组织数据结构")
tstat_15 = TreeStatistics(Tree=data_6)  # -> Paths, Length, Count
sift_18 = SiftPattern(List=data_6, SiftPattern=int_20)  # -> Output0, Output1, Output2, Output3, Output4, Output5, Output6, Output7, Output8, Output9
dpath_10 = DeconstructPath(Branch=tstat_15.Paths)
clean_6 = CleanTree(RemoveNulls=True, RemoveInvalid=True, RemoveEmpty=True, Tree=sift_18.Output8)
bang = ExplodeTree(Data=clean_6)  # -> _3068, _30148
item_15 = ListItem(List=dpath_10, Index="2", Wrap=True)
viewer_11 = ParamViewer(item_15)
equals_12 = Equality(FirstNumber=bang._30148, SecondNumber="0")  # -> Equality, Inequality
equals_13 = Equality(FirstNumber=bang._30148, SecondNumber="0")  # -> Equality, Inequality
and_8 = GateAnd(A=equals_12.Inequality, B=equals_13.Inequality)
replace_13 = ReplacePaths(Data=item_15, Search=viewer_11, Replace=tstat_15.Paths)
item_16 = ListItem(List=bang._3068, Index=0, Wrap=True)  # -> Item, Item1
sift_19 = SiftPattern(List=bang._30148, SiftPattern=and_8)  # -> Output0, Output1
sift_20 = SiftPattern(List=bang._30148, SiftPattern=and_8)  # -> Output0, Output1
item_17 = ListItem(Index=replace_13, Wrap=True)
eval_13 = Evaluate(F="{v,-u,-v*x0+u*y0}", x0=item_16.Item, y0=item_16.Item1, u=sift_20.Output1, v=sift_19.Output1)
panel_62 = Panel(eval_13)

# ----
# 00 common parallel
# 10 vectical
# 20 reverse parallel
# 30 vectical
path_15 = DataPath(path_14)
flatten_24 = FlattenTree(Tree=path_15, Path="{0}")
tstat_16 = TreeStatistics(Tree=path_15)  # -> Paths, Length, Count
tstat_17 = TreeStatistics(Tree=path_15)  # -> Paths, Length, Count
ma_2 = MassAddition(Input=tstat_16.Length)  # -> Result, PartialResults
series_6 = Series(Start=0, Step=1, Count=tstat_17.Count)
stack_13 = StackData(Data=ma_2.PartialResults, Stack=tstat_16.Length)
shift = ShiftList(List=series_6, Shift=stack_13, Wrap=False)
item_18 = ListItem(List=flatten_24, Index=shift, Wrap=True)  # -> simplify(Item)
lng_9 = ListLength(List=item_18)
# log:
# 20161011
# 如何识别path知道非正交的相反的向量
# 增强path的排序的算法前馈，可通过path运算直接得到向量关系
# 运用path提取相应的两条交线；
# 索引交线，并保留原有树形结构
stack_14 = StackData(Data=path_15, Stack=lng_9)
secondpath = DataPath(item_18)
firstpath = DataPath(stack_14)
dpath_11 = DeconstructPath(Branch=firstpath)
dpath_12 = DeconstructPath(Branch=secondpath)
subtraction_4 = Subtraction(A=dpath_11, B=dpath_12)
abs_2 = Absolute(Value=subtraction_4)
item_19 = ListItem(List=abs_2, Index=0, Wrap=True)  # -> Item, Item1
panel_63 = Panel("""00
10
20
30""")
ultimateangle_afterelection_2 = Number(ultimateangle_afterelection)
concat = Concatenate(FragmentA=item_19.Item, FragmentB=item_19.Item1)
mindex_4 = MemberIndex(Set=panel_63, Member=concat)  # -> simplify(Index), Count
graft_30 = GraftTree(Tree=secondpath, IncludeEmptyLists=True, IncludeNullItems=True)
graft_31 = GraftTree(Tree=firstpath, IncludeEmptyLists=True, IncludeNullItems=True)

panel_64 = Panel(mindex_4.Index)
panel_65 = Panel("描述方法只是数据结构的不同，先用几何代表抽象的数据结构")
panel_66 = Panel("""x0,y0;0,1,2,3
x1,y0;0,3,2""")
panel_67 = Panel("""多条线且含有多折线连线组织数据结构问题
得到交点
交点的path替换""")
crv = Curve([<curve referenced from the Rhino model> x3])
crv_2 = Curve([<curve referenced from the Rhino model> x3])
explode = Explode(Curve=crv_2, Recursive=True)  # -> Segments, Vertices
end = EndPoints(Curve=crv_2)  # -> Start, End
neg_4 = Negative(Value="1")
shift_2 = ShiftList(List=explode.Vertices, Shift="1", Wrap=False)
shift_3 = ShiftList(List=explode.Vertices, Shift=neg_4, Wrap=False)

panel_68 = Panel("""1,0
0,1
-1,0
0,-1""")
vec_2 = Vector(panel_68)

# ----
# describe space by (point;index) of vector
md_slider = MDSlider(
    slider_value=Point(0.5591201782, 0.4691162109, 0.5),
    SliderMode=0,
    x_domain=Domain(-1000, 1000),
    y_domain=Domain(-1000, 1000),
    z_domain=Domain(0, 1))
panel_69 = Panel("""0
1
2
3""")
line_length = Panel("""3.2
5.1
3.2
5.1""")
line_length_2 = Number(line_length)
int_21 = Integer(panel_69)
lng_10 = ListLength(List=int_21)
series_7 = Series(Start=0, Step=1, Count=lng_10)
item_20 = ListItem(List=vec_2, Index=int_21, Wrap=True)
item_21 = ListItem(List=line_length_2, Index=series_7, Wrap=True)
basicvectorunit = Vector(item_20)
amp = Amplitude(Vector=basicvectorunit, Amplitude=item_21)
ma_3 = MassAddition(Input=amp)  # -> Result, PartialResults
addition_2 = Addition(A=md_slider, B=ma_3.PartialResults)
pt = Point(addition_2)
shift_4 = ShiftList(List=ma_3.PartialResults, Shift=-1, Wrap=True)
complex_5 = ComplexComponents(Complex=shift_4)  # -> Real, Imaginary
concat_2 = Concatenate(FragmentA=complex_5.Real, FragmentB=complex_5.Imaginary, JoinSeparator=",")
pline = PolyLine(Vertices=pt, Closed=True)
concat_3 = Concatenate(FragmentA=concat_2, FragmentB=int_21, JoinSeparator=";")

subtraction_5 = Subtraction(A=shift_2, B=shift_3)

graft_32 = GraftTree(Tree=end.Start, IncludeEmptyLists=True, IncludeNullItems=True)  # -> simplify(Tree)
subtraction_6 = Subtraction(A=graft_32, B="{0,0,0}")  # -> flatten(Result)
item_22 = ListItem(List=subtraction_6, Index="0", Wrap=True)
subtraction_7 = Subtraction(A=graft_32, B=item_22)

unit = UnitVector(Vector=subtraction_5)
vec_3 = Vector(subtraction_5)
len = Length(Curve=explode.Segments)  # -> simplify(Length)
pshift_5 = ShiftPaths(Data=unit, Offset=-1)
mindex_5 = MemberIndex(Set=vec_2, Member=pshift_5)  # -> Index, Count
vdis = VectorDisplay(Anchor=shift_3, Vector=vec_3)
pshift_6 = ShiftPaths(Data=mindex_5.Index, Offset=-1)  # -> simplify(Data)

vecdirection = Integer(pshift_6)
veclength = Number(len)
pt_2 = Point(graft_32)

panel_70 = Panel(vec_2)
item_23 = ListItem(List=vec_2, Index=vecdirection, Wrap=True)
amp_2 = Amplitude(Vector=item_23, Amplitude=veclength)
ma_4 = MassAddition(Input=amp_2)  # -> Result, PartialResults
addition_3 = Addition(A=pt_2, B=ma_4.PartialResults)
pt_3 = Point(addition_3)
ins_7 = InsertItems(List=addition_3, Item=pt_2, Indices="0", Wrap=True)
neg_5 = Negative(Value="1")
panel_71 = Panel(pt_2)
panel_72 = Panel(concat_3)
panel_73 = Panel(amp)
shift_5 = ShiftList(List=ins_7, Shift=neg_5, Wrap=False)  # -> simplify(List)

# ----
# tree data trial
# first point 和 end point 的数据结构组织的方式是同一种的
# 
# 先手工傻做，再寻找规律
# 
# 先不管结构如何，把他们放在一起，结构在外部运算，在替换成对的树形数据
# 上升数据结构后手工或者数列
# 上升后全部拍平处理
# 用stack+listItem对拍平的数据处理
# 
# 留下来的问题是数据结构的替换
# 手工
pt_4 = Point(shift_5)
graft_33 = GraftTree(Tree=pt_4, IncludeEmptyLists=True, IncludeNullItems=True)

flatten_25 = FlattenTree(Tree=graft_33, Path="{0}")
tstat_18 = TreeStatistics(Tree=pt_4)  # -> Paths, Length, Count
tstat_19 = TreeStatistics(Tree=graft_33)  # -> Paths, Length, Count
ma_5 = MassAddition(Input=tstat_18.Length)  # -> Result, PartialResults
series_8 = Series(Start=0, Step=1, Count=tstat_19.Count)
stack_15 = StackData(Data=ma_5.PartialResults, Stack=tstat_18.Length)
shift_6 = ShiftList(List=series_8, Shift=stack_15, Wrap=False)
item_24 = ListItem(List=flatten_25, Index=shift_6, Wrap=True)  # -> simplify(Item)

lng_11 = ListLength(List=item_24)

bang_2 = ExplodeTree(Data=graft_33)  # -> Branch0, Branch1, Branch2, Branch3, Branch4, Branch5
merge_10 = Merge(Data1=bang_2.Branch1, Data2=bang_2.Branch2, Data3=bang_2.Branch3, Data4=bang_2.Branch4, Data5=bang_2.Branch5)
entwine_2 = Entwine(
    Branch00=merge_10,
    Branch01=bang_2.Branch5,
    Branch02=bang_2.Branch5,
    Branch03=bang_2.Branch5,
    Branch04=bang_2.Branch5,
    FlattenInputs=True)

stack_16 = StackData(Data=graft_33, Stack=lng_11)
shift_7 = ShiftList(List=ins_7, Shift="1", Wrap=False)  # -> simplify(List)
graft_34 = GraftTree(Tree=stack_16, IncludeEmptyLists=True, IncludeNullItems=True)
graft_35 = GraftTree(Tree=shift_5, IncludeEmptyLists=True, IncludeNullItems=True)

flatten_26 = FlattenTree(Tree=graft_35, Path="{0}")
tstat_20 = TreeStatistics(Tree=shift_5)  # -> Paths, Length, Count
tstat_21 = TreeStatistics(Tree=graft_35)  # -> Paths, Length, Count
ma_6 = MassAddition(Input=tstat_20.Length)  # -> Result, PartialResults
series_9 = Series(Start=0, Step=1, Count=tstat_21.Count)
stack_17 = StackData(Data=ma_6.PartialResults, Stack=tstat_20.Length)
shift_8 = ShiftList(List=series_9, Shift=stack_17, Wrap=False)
viewer_12 = ParamViewer()
item_25 = ListItem(List=flatten_26, Index=shift_8, Wrap=True)  # -> simplify(Item)
replace_14 = ReplacePaths(Data=item_25, Search=viewer_12)

graft_36 = GraftTree(Tree=shift_7, IncludeEmptyLists=True, IncludeNullItems=True)

# ----
# kernel tree data
flatten_27 = FlattenTree(Tree=graft_36, Path="{0}")
tstat_22 = TreeStatistics(Tree=shift_7)  # -> Paths, Length, Count
tstat_23 = TreeStatistics(Tree=graft_36)  # -> Paths, Length, Count
ma_7 = MassAddition(Input=tstat_22.Length)  # -> Result, PartialResults
series_10 = Series(Start=0, Step=1, Count=tstat_23.Count)
stack_18 = StackData(Data=ma_7.PartialResults, Stack=tstat_22.Length)
shift_9 = ShiftList(List=series_10, Shift=stack_18, Wrap=False)
item_26 = ListItem(List=flatten_27, Index=shift_9, Wrap=True)  # -> simplify(Item)
viewer_13 = ParamViewer()
replace_15 = ReplacePaths(Data=item_26, Search=viewer_13)

addition_4 = Addition(A=pt_2)

viewer_14 = ParamViewer()
replace_16 = ReplacePaths(Data=item_24, Search=viewer_14)

firstpt_line0 = Point(graft_35)
firstpt_line1 = Point(item_25)
endpt_line0 = Point(graft_36)
endpt_line1 = Point(item_26)

graft_37 = GraftTree(Tree=item_24, IncludeEmptyLists=True, IncludeNullItems=True)

# ----
# explore a point position in space
line_5 = Line([Line((120.4046894, -60.83579072, 0), (120.4046894, -60.79145643, 0)), Line((120.3917346, -60.82485109, 0), (120.420811, -60.82485109, 0))])
panel_74 = Panel("""处理k不存在的情况

写成函数
把坐标在相减后就分开来算

对实交和虚交的算法 不够缜密""")
# debug:可以做，但是要改动很多，先放放，出现问题了再来
linelist = Curve(line_5)
end_2 = EndPoints(Curve=linelist)  # -> Start, End
subtraction_8 = Subtraction(A=end_2.End, B=end_2.Start)
xy = XYPlane(Origin=Point(0, 0, 0))

startpoint = Point(end_2.Start)
vec_4 = Vector(subtraction_8)

addition_5 = Addition(A=startpoint, B=vec_4)
endpoint = Point(addition_5)
lng_12 = ListLength(List=addition_5)
lng_13 = ListLength(List=startpoint)
subtraction_9 = Subtraction(A=lng_12, B="1")
subtraction_10 = Subtraction(A=lng_13, B="1")
series_11 = Series(Start=0, Step=1, Count=subtraction_10)
series_12 = Series(Start=0, Step=1, Count=subtraction_9)
addition_6 = Addition(A=series_11, B="1")
addition_7 = Addition(A=series_12, B="1")
item_27 = ListItem(List=startpoint, Index=series_11, Wrap=False)  # -> simplify(graft(Item))
item_28 = ListItem(List=addition_5, Index=series_12, Wrap=False)  # -> simplify(graft(Item))
shift_10 = ShiftList(List=addition_5, Shift=addition_7, Wrap=False)  # -> simplify(List)
shift_11 = ShiftList(List=startpoint, Shift=addition_6, Wrap=False)  # -> simplify(List)

firstpt_line0_2 = Point(item_27)
firstpt_line1_2 = Point(shift_11)
endpt1_line1 = Point(shift_10)
endpt_line0_2 = Point(item_28)

points = PointList(Points=flatten(firstpt_line0_2), Size=Slider(6, range=0..100))

complex_6 = ComplexComponents(Complex=firstpt_line0_2)  # -> Real, Imaginary
complex_7 = ComplexComponents(Complex=endpt_line0_2)  # -> Real, Imaginary
complex_8 = ComplexComponents(Complex=firstpt_line1_2)  # -> Real, Imaginary
complex_9 = ComplexComponents(Complex=endpt1_line1)  # -> Real, Imaginary
subtraction_11 = Subtraction(A=complex_8.Imaginary, B=complex_9.Imaginary)
subtraction_12 = Subtraction(A=complex_8.Real, B=complex_9.Real)
subtraction_13 = Subtraction(A=complex_6.Real, B=complex_7.Real)
subtraction_14 = Subtraction(A=complex_6.Imaginary, B=complex_7.Imaginary)
division_5 = Division(A=subtraction_11, B=subtraction_12)
division_6 = Division(A=subtraction_14, B=subtraction_13)
k1 = Number(division_6)
k2 = Number(division_5)
multiplication_4 = Multiplication(A=k2, B=complex_8.Real)
subtraction_15 = Subtraction(A=complex_8.Imaginary, B=multiplication_4)
b2 = Number(subtraction_15)
subtraction_16 = Subtraction(A=k1, B=k2)

multiplication_5 = Multiplication(A=k1, B=complex_6.Real)
subtraction_17 = Subtraction(A=complex_6.Imaginary, B=multiplication_5)

equals_14 = Equality(FirstNumber=subtraction_12, SecondNumber="0")  # -> Equality, Inequality
equals_15 = Equality(FirstNumber=subtraction_13, SecondNumber="0")  # -> Equality, Inequality
sift_21 = SiftPattern(List=complex_9.Real, SiftPattern=equals_14.Equality)  # -> Output0, Output1
sift_22 = SiftPattern(List=complex_6.Real, SiftPattern=equals_15.Equality)  # -> Output0, Output1
or = GateOr(A=equals_15.Equality, B=equals_14.Equality)
combine = CombineData(Input0=sift_22.Output1, Input1=sift_21.Output1)  # -> Result, Index
sift_23 = SiftPattern(List=k2, SiftPattern=equals_14.Equality)  # -> Output0, Output1
sift_24 = SiftPattern(List=b2, SiftPattern=equals_14.Equality)  # -> Output0, Output1
sift_25 = SiftPattern(List=k1, SiftPattern=equals_15.Equality)  # -> Output0, Output1
combine_2 = CombineData(Input0=sift_25.Output0, Input1=sift_23.Output0)  # -> Result, Index
a_2 = Number(combine.Result)
k_2 = Number(combine_2.Result)
multiplication_6 = Multiplication(A=a_2, B=k_2)
intersection_x = Number(a_2)

b1 = Number(subtraction_17)
subtraction_18 = Subtraction(A=b2, B=b1)
division_7 = Division(A=subtraction_18, B=subtraction_16)
multiplication_7 = Multiplication(A=division_7, B=k2)
addition_8 = Addition(A=multiplication_7, B=b2)
sift_26 = SiftPattern(List=addition_8, SiftPattern=or)  # -> Output0, Output1

sift_27 = SiftPattern(List=b1, SiftPattern=equals_15.Equality)  # -> Output0, Output1
combine_3 = CombineData(Input0=sift_27.Output0, Input1=sift_24.Output0)  # -> Result, Index
b_2 = Number(combine_3.Result)
sift_28 = SiftPattern(List=b_2, SiftPattern=or)  # -> Output0, Output1
addition_9 = Addition(A=multiplication_6, B=sift_28.Output1)
intersection_y = Number(addition_9)

combine_4 = CombineData(Input0=sift_26.Output0, Input1=intersection_y)  # -> Result, Index
combine_5 = CombineData(Input0=division_7, Input1=intersection_x)  # -> Result, Index

panel_75 = Panel(equals_15.Equality)
intersection_x_2 = Number(combine_5.Result)
intersection_y_2 = Number(combine_4.Result)
pt_5 = PointOriented(BasePlane=xy, UComponent=intersection_x_2, VComponent=intersection_y_2, WComponent=0)

# ----
# true --> real insection
# false --> extend
# 10,11 --> real insection
# 01       --> extend one line
# 00       --> extend two lines
# true   -- > extend one line
# false -->  extend two lines
dom = ConstructDomain(DomainStart=complex_6.Imaginary, DomainEnd=complex_7.Imaginary)
dom_2 = ConstructDomain(DomainStart=complex_6.Real, DomainEnd=complex_7.Real)
dom_3 = ConstructDomain(DomainStart=complex_8.Real, DomainEnd=complex_9.Real)
dom_4 = ConstructDomain(DomainStart=complex_8.Imaginary, DomainEnd=complex_9.Imaginary)
firstpty_domain = Domain(dom)
firstptx_domain = Domain(dom_2)
endpty_domain = Domain(dom_4)
endptx_domain = Domain(dom_3)
inc = Includes(Value=intersection_y_2, Domain=firstpty_domain)  # -> Includes, Deviation
inc_2 = Includes(Value=intersection_x_2, Domain=endptx_domain)  # -> Includes, Deviation
inc_3 = Includes(Value=intersection_y_2, Domain=endpty_domain)  # -> Includes, Deviation
inc_4 = Includes(Value=intersection_x_2, Domain=firstptx_domain)  # -> Includes, Deviation
or_2 = GateOr(A=inc_4.Includes, B=inc.Includes, C=inc_2.Includes, D=inc_3.Includes)
and_9 = GateAnd(A=inc_4.Includes, B=inc.Includes, C=inc_2.Includes, D=inc_3.Includes)
int_22 = Integer(or_2)
int_23 = Integer(and_9)
concat_4 = Concatenate(FragmentA=int_23, FragmentB=int_22)
panel_76 = Panel("""10
11
01
00""")
panel_77 = Panel("""0
0
1
2""")
keysearch_5 = KeyValueSearch(Keys=panel_76, Values=panel_77, Search=concat_4)
extendlinecount = Integer(keysearch_5)

sift_29 = SiftPattern(List=pt_5, SiftPattern=extendlinecount)  # -> Output0, Output1, Output2
intersectionontwolines = Point(sift_29.Output0)
intersectionononeline = Point(sift_29.Output1)
intersectiononextend = Point(sift_29.Output2)
panel_78 = Panel(intersectionontwolines)

firstpt0 = Point(firstpt_line0)
firstpt1 = Point(firstpt_line1)
endpt0 = Point(endpt_line0)
endpt1 = Point(endpt_line1)
points_2 = PointList(Points=flatten(firstpt0), Size=Slider(0.109, range=0..3))
complex_10 = ComplexComponents(Complex=firstpt0)  # -> Real, Imaginary
complex_11 = ComplexComponents(Complex=firstpt1)  # -> Real, Imaginary
complex_12 = ComplexComponents(Complex=endpt1)  # -> Real, Imaginary
complex_13 = ComplexComponents(Complex=endpt0)  # -> Real, Imaginary
subtraction_19 = Subtraction(A=complex_11.Imaginary, B=complex_12.Imaginary)
subtraction_20 = Subtraction(A=complex_11.Real, B=complex_12.Real)
equals_16 = Equality(FirstNumber=subtraction_20, SecondNumber="0")  # -> Equality, Inequality
sift_30 = SiftPattern(List=complex_12.Real, SiftPattern=equals_16.Equality)  # -> Output0, Output1
subtraction_21 = Subtraction(A=complex_10.Imaginary, B=complex_13.Imaginary)
subtraction_22 = Subtraction(A=complex_10.Real, B=complex_13.Real)
equals_17 = Equality(FirstNumber=subtraction_22, SecondNumber="0")  # -> Equality, Inequality
sift_31 = SiftPattern(List=complex_10.Real, SiftPattern=equals_17.Equality)  # -> Output0, Output1
or_3 = GateOr(A=equals_17.Equality, B=equals_16.Equality)
combine_6 = CombineData(Input0=sift_31.Output1, Input1=sift_30.Output1)  # -> Result, Index
division_8 = Division(A=subtraction_19, B=subtraction_20)
division_9 = Division(A=subtraction_21, B=subtraction_22)
panel_79 = Panel("""处理k不存在的情况

写成函数
把坐标在相减后就分开来算""")
k1_2 = Number(division_9)
multiplication_8 = Multiplication(A=k1_2, B=complex_10.Real)
sift_32 = SiftPattern(List=k1_2, SiftPattern=equals_17.Equality)  # -> Output0, Output1
subtraction_23 = Subtraction(A=complex_10.Imaginary, B=multiplication_8)
b1_2 = Number(subtraction_23)
sift_33 = SiftPattern(List=b1_2, SiftPattern=equals_17.Equality)  # -> Output0, Output1
k2_2 = Number(division_8)
multiplication_9 = Multiplication(A=k2_2, B=complex_11.Real)
sift_34 = SiftPattern(List=k2_2, SiftPattern=equals_16.Equality)  # -> Output0, Output1
subtraction_24 = Subtraction(A=complex_11.Imaginary, B=multiplication_9)
combine_7 = CombineData(Input0=sift_32.Output0, Input1=sift_34.Output0)  # -> Result, Index
b2_2 = Number(subtraction_24)
sift_35 = SiftPattern(List=b2_2, SiftPattern=equals_16.Equality)  # -> Output0, Output1
combine_8 = CombineData(Input0=sift_33.Output0, Input1=sift_35.Output0)  # -> Result, Index
subtraction_25 = Subtraction(A=b2_2, B=b1_2)
b_3 = Number(combine_8.Result)
a_3 = Number(combine_6.Result)
k_3 = Number(combine_7.Result)
subtraction_26 = Subtraction(A=k1_2, B=k2_2)
sift_36 = SiftPattern(List=b_3, SiftPattern=or_3)  # -> Output0, Output1
multiplication_10 = Multiplication(A=a_3, B=k_3)
division_10 = Division(A=subtraction_25, B=subtraction_26)
multiplication_11 = Multiplication(A=division_10, B=k2_2)
addition_10 = Addition(A=multiplication_11, B=b2_2)
sift_37 = SiftPattern(List=addition_10, SiftPattern=or_3)  # -> Output0, Output1
addition_11 = Addition(A=multiplication_10, B=sift_36.Output1)
intersection_x_3 = Number(a_3)
intersection_y_3 = Number(addition_11)
combine_9 = CombineData(Input0=sift_37.Output0, Input1=intersection_y_3)  # -> Result, Index
combine_10 = CombineData(Input0=division_10, Input1=intersection_x_3)  # -> Result, Index
intersection_x_4 = Number(combine_10.Result)
intersection_y_4 = Number(combine_9.Result)
xy_2 = XYPlane(Origin=Point(0, 0, 0))
pt_6 = PointOriented(BasePlane=xy_2, UComponent=intersection_x_4, VComponent=intersection_y_4, WComponent=0)

# ----
# true --> real insection
# false --> extend
# 10,11 --> real insection
# 01       --> extend one line
# 00       --> extend two lines
# true   -- > extend one line
# false -->  extend two lines
dom_5 = ConstructDomain(DomainStart=complex_10.Imaginary, DomainEnd=complex_13.Imaginary)
dom_6 = ConstructDomain(DomainStart=complex_10.Real, DomainEnd=complex_13.Real)
dom_7 = ConstructDomain(DomainStart=complex_11.Real, DomainEnd=complex_12.Real)
dom_8 = ConstructDomain(DomainStart=complex_11.Imaginary, DomainEnd=complex_12.Imaginary)
firstpty_domain_2 = Domain(dom_5)
firstptx_domain_2 = Domain(dom_6)
endpty_domain_2 = Domain(dom_8)
endptx_domain_2 = Domain(dom_7)
inc_5 = Includes(Value=intersection_y_4, Domain=firstpty_domain_2)  # -> Includes, Deviation
inc_6 = Includes(Value=intersection_x_4, Domain=endptx_domain_2)  # -> Includes, Deviation
inc_7 = Includes(Value=intersection_y_4, Domain=endpty_domain_2)  # -> Includes, Deviation
inc_8 = Includes(Value=intersection_x_4, Domain=firstptx_domain_2)  # -> Includes, Deviation
or_4 = GateOr(A=inc_8.Includes, B=inc_5.Includes, C=inc_6.Includes, D=inc_7.Includes)
and_10 = GateAnd(A=inc_8.Includes, B=inc_5.Includes, C=inc_6.Includes, D=inc_7.Includes)
int_24 = Integer(or_4)
int_25 = Integer(and_10)
concat_5 = Concatenate(FragmentA=int_25, FragmentB=int_24)
panel_80 = Panel("""10
11
01
00""")
panel_81 = Panel("""0
0
1
2""")
keysearch_6 = KeyValueSearch(Keys=panel_80, Values=panel_81, Search=concat_5)
extendlinecount_2 = Integer(keysearch_6)

sift_38 = SiftPattern(List=pt_6, SiftPattern=extendlinecount_2)  # -> Output0, Output1, Output2
intersectionontwolines_2 = Point(sift_38.Output0)
intersectionononeline_2 = Point(sift_38.Output1)
intersectiononextend_2 = Point(sift_38.Output2)

# ----
# 计算点到边界的垂直向量
# describe space by (point;index) of vector
# 问题在于，当某一path缺少时，替换的内容仍然会配对，造成数据多余错误
# 要探测出缺少的路径
# statistics-->DePath
# 最后拍平后替换路径
line_length_3 = Panel("""3.2
5.1
3.2
5.1
6.4
10.2""")
panel_82 = Panel("""0
1
0
1
2
3""")
md_slider_2 = MDSlider(
    slider_value=Point(0.4899997711, 0.4549980164, 0.5),
    SliderMode=0,
    x_domain=Domain(0, 1),
    y_domain=Domain(0, 1),
    z_domain=Domain(0, 1))
panel_83 = Panel("""0
1
2
3""")
line_length_4 = Panel("""3.2
5.1
3.2
5.1""")
panel_84 = Panel("""用字符串的方法表示还差最后一步，那么先拆开来用判断的方法做
拆开的方法很繁琐，索性还是用字符串替换的方法
检查目前的替换方法是否可以简化
并且找出到各个边的距离最近点""")
line_length_5 = Number(line_length_4)
panel_85 = Panel("""1,0
0,1
-1,0
0,-1""")
vec_5 = Vector(panel_85)
int_26 = Integer(panel_83)
lng_14 = ListLength(List=int_26)
series_13 = Series(Start=0, Step=1, Count=lng_14)
item_29 = ListItem(List=vec_5, Index=int_26, Wrap=True)
panel_86 = Panel(item_29)
item_30 = ListItem(List=line_length_5, Index=series_13, Wrap=True)
basicvectorunit_2 = Vector(item_29)
amp_3 = Amplitude(Vector=basicvectorunit_2, Amplitude=item_30)
ma_8 = MassAddition(Input=amp_3)  # -> Result, PartialResults
addition_12 = Addition(A=md_slider_2, B=ma_8.PartialResults)
shift_12 = ShiftList(List=ma_8.PartialResults, Shift=-1, Wrap=True)
complex_14 = ComplexComponents(Complex=shift_12)  # -> Real, Imaginary
concat_6 = Concatenate(FragmentA=complex_14.Real, FragmentB=complex_14.Imaginary, JoinSeparator=",")
item_31 = ListItem(List=amp_3, Index=graft(series_13), Wrap=True)
panel_87 = Panel(ma_8.PartialResults)
concat_7 = Concatenate(FragmentA=concat_6, FragmentB=int_26, JoinSeparator=";")
item_32 = ListItem(List=concat_7, Index=series_13, Wrap=True)
split_6 = TextSplit(Text=item_32, Separators=";")  # -> simplify(Result)
item_33 = ListItem(List=split_6, Index=0, Wrap=True)  # -> Item, Item1
pt_7 = Point(item_33.Item)
addition_13 = Addition(A=pt_7, B=item_31)
firstpt0_2 = Point(item_33.Item)
endpt0_2 = Point(addition_13)
panel_88 = Panel(concat_7)
complex_15 = ComplexComponents(Complex=endpt0_2)  # -> Real, Imaginary
complex_16 = ComplexComponents(Complex=firstpt0_2)  # -> Real, Imaginary
pt_8 = Point(Point(1.488717773, 12.13872048, 0))
subtraction_27 = Subtraction(A=complex_16.Imaginary, B=complex_15.Imaginary)
subtraction_28 = Subtraction(A=complex_16.Real, B=complex_15.Real)
complex_17 = ComplexComponents(Complex=pt_8)  # -> Real, Imaginary
division_11 = Division(A=subtraction_27, B=subtraction_28)
k1_3 = Number(division_11)
multiplication_12 = Multiplication(A=k1_3, B=complex_15.Real)
subtraction_29 = Subtraction(A=complex_15.Imaginary, B=multiplication_12)
b1_3 = Number(subtraction_29)
panel_89 = Panel("abs(k*x0-y0+b)/sqrt(k*k+1)")
panel_90 = Panel("(k*x0-y0+b)/sqrt(k*k+1)")
panel_91 = Panel("-(k*x0-y0+b)/sqrt(k*k+1)")

y = Number(complex_17.Imaginary)
x = Number(complex_17.Real)
larger_5 = LargerThan(FirstNumber=complex_16.Real, SecondNumber=x)  # -> LargerThan, OrEqualTo
larger_6 = LargerThan(FirstNumber=complex_16.Imaginary, SecondNumber=y)  # -> LargerThan, OrEqualTo
int_27 = Integer(larger_5.LargerThan)
int_28 = Integer(larger_6.LargerThan)
concat_8 = Concatenate(FragmentA=int_27, FragmentB=int_28)

# ---- group: vector match concept Error
panel_92 = Panel("""010
012
110
112""")
panel_93 = Panel("""101
103
111
113""")
panel_94 = Panel("""001
003
011
013""")
panel_95 = Panel("""000
002
100
102""")
merge_11 = Merge(Data1=panel_93, Data2=panel_92, Data3=panel_94, Data4=panel_95)
entwine_3 = Entwine(Branch00=panel_93, Branch01=panel_92, Branch02=panel_94, Branch03=panel_95, FlattenInputs=True)  # -> simplify(Result)
concat_9 = Concatenate(FragmentA=concat_8, FragmentB=item_33.Item1)
flatten_28 = FlattenTree(Tree=concat_9, Path="{0}")
mindex_6 = MemberIndex(Set=merge_11, Member=flatten_28)  # -> Index, Count
division_12 = Division(A=mindex_6.Index, B="4")
int_29 = Integer(division_12)
item_34 = ListItem(List=vec_5, Index=int_29, Wrap=True)

# ----
pt_9 = Point(ma_8.PartialResults)
pline_2 = PolyLine(Vertices=pt_9, Closed=True)

# ---- group: vector match concept Error
mindex_7 = MemberIndex(Set=entwine_3, Member=flatten_28)  # -> Index, Count
clean_7 = CleanTree(RemoveNulls=True, RemoveInvalid=True, RemoveEmpty=True, Tree=mindex_7.Index)
tstat_24 = TreeStatistics(Tree=clean_7)  # -> Paths, Length, Count
split_7 = TextSplit(Text=tstat_24.Paths, Separators=";")
item_35 = ListItem(List=split_7, Index="0", Wrap=True)
split_8 = TextSplit(Text=item_35, Separators="{")
item_36 = ListItem(List=split_8, Index="1", Wrap=True)  # -> simplify(Item)

equals_18 = Equality(FirstNumber=graft(flatten_28), SecondNumber=merge_11)  # -> Equality, Inequality
mindex_8 = MemberIndex(Set=equals_18.Equality, Member=Toggle(True))  # -> Index, Count

# ----
# distances between points and space boundary
null = NullItem(Item=k1_3)  # -> NullFlags, InvalidFlags, Description
sift_39 = SiftPattern(List=pt_7, SiftPattern=null.NullFlags)  # -> Output0, Output1
complex_18 = ComplexComponents(Complex=sift_39.Output1)  # -> Real, Imaginary
eval_14 = Evaluate(F="abs(k*x0-y0+b)/sqrt(k*k+1)", k=k1_3, b=b1_3, x0=complex_17.Real, y0=complex_17.Imaginary)
subtraction_30 = Subtraction(A=complex_17.Real, B=complex_18.Real)  # -> simplify(Result)
distance = Number(eval_14)
abs_3 = Absolute(Value=subtraction_30)  # -> simplify(Result)
combine_11 = CombineData(Input0=distance, Input1=abs_3)  # -> Result, Index

# ---- group: vector match method 1
concat_10 = Concatenate(FragmentA=concat_8, FragmentB=item_33.Item1)
flatten_29 = FlattenTree(Tree=concat_10, Path="{0}")
panel_96 = Panel("""000
002
100
102""")
panel_97 = Panel("""010
012
110
112""")
panel_98 = Panel("""101
103
111
113""")
panel_99 = Panel("""001
003
011
013""")
mindex_9 = MemberIndex(Set=panel_99, Member=flatten_29)  # -> Index, Count
mindex_10 = MemberIndex(Set=panel_96, Member=flatten_29)  # -> Index, Count
mindex_11 = MemberIndex(Set=panel_98, Member=flatten_29)  # -> Index, Count
mindex_12 = MemberIndex(Set=panel_97, Member=flatten_29)  # -> Index, Count
clean_8 = CleanTree(RemoveNulls=True, RemoveInvalid=True, RemoveEmpty=True, Tree=mindex_12.Index)
clean_9 = CleanTree(RemoveNulls=True, RemoveInvalid=True, RemoveEmpty=True, Tree=mindex_10.Index)
clean_10 = CleanTree(RemoveNulls=True, RemoveInvalid=True, RemoveEmpty=True, Tree=mindex_11.Index)
clean_11 = CleanTree(RemoveNulls=True, RemoveInvalid=True, RemoveEmpty=True, Tree=mindex_9.Index)
replace_17 = ReplaceItems(List=clean_10, Item="0", Indices="0", Wrap=False)
replace_18 = ReplaceItems(List=clean_8, Item="1", Indices="0", Wrap=False)
replace_19 = ReplaceItems(List=clean_11, Item="2", Indices="0", Wrap=False)
replace_20 = ReplaceItems(List=clean_9, Item="3", Indices="0", Wrap=False)
merge_12 = Merge(Data1=replace_17, Data2=replace_18, Data3=replace_19, Data4=replace_20)
item_37 = ListItem(List=vec_5, Index=merge_12, Wrap=True)
amp_4 = Amplitude(Vector=item_37, Amplitude=combine_11.Result)
vdis_2 = VectorDisplay(Anchor=pt_8, Vector=amp_4)

# ---- group: vector match method 0 Error
# left-down;x-axis
# left-up;y-axis
a_4 = Number(complex_16.Real)
b_4 = Number(complex_16.Imaginary)
y_2 = Number(complex_17.Imaginary)
x_2 = Number(complex_17.Real)
item_38 = ListItem(List=vec_5, Index=item_33.Item1, Wrap=True)
smaller_4 = SmallerThan(FirstNumber=b_4, SecondNumber=y_2)  # -> SmallerThan, OrEqualTo
not = GateNot(A=smaller_4.SmallerThan)
smaller_5 = SmallerThan(FirstNumber=a_4, SecondNumber=x_2)  # -> SmallerThan, OrEqualTo
and_11 = GateAnd(A=smaller_5.SmallerThan, B=not)
equals_19 = Equality(FirstNumber="0", SecondNumber=graft(int_26))  # -> Equality, Inequality
equals_20 = Equality(FirstNumber="2", SecondNumber=graft(int_26))  # -> Equality, Inequality
and_12 = GateAnd(A=smaller_5.SmallerThan, B=smaller_4.SmallerThan)
equals_21 = Equality(FirstNumber="1", SecondNumber=graft(int_26))  # -> Equality, Inequality
equals_22 = Equality(FirstNumber="3", SecondNumber=graft(int_26))  # -> Equality, Inequality
or_5 = GateOr(A=equals_19.Equality, B=equals_20.Equality)
or_6 = GateOr(A=equals_21.Equality, B=equals_22.Equality)
and_13 = GateAnd(A=or_6, B=and_12)
and_14 = GateAnd(A=or_5, B=and_11)
or_7 = GateOr(A=and_13, B=and_14)
sift_40 = SiftPattern(List=item_38, SiftPattern=or_7)  # -> Output0, Output1
pi_10 = Pi(Factor="0.5")
Z = UnitZ(Factor=1)
neg_6 = Negative(Value=pi_10)
vrot = Rotate(Vector=sift_40.Output0, Axis=Z, Angle=neg_6)
vrot_2 = Rotate(Vector=sift_40.Output1, Axis=Z, Angle=pi_10)
combine_12 = CombineData(Input0=vrot, Input1=vrot_2)  # -> Result, Index
amp_5 = Amplitude(Vector=combine_12.Result, Amplitude=combine_11.Result)
vdis_3 = VectorDisplay(Anchor=pt_8, Vector=amp_5)

# ----
# vectors between points and space boundary
panel_100 = Panel("0.5")  # disabled
item_39 = ListItem(List=vec_5, Index=item_33.Item1, Wrap=True)  # disabled
pi_11 = Pi(Factor=panel_100)  # disabled
neg_7 = Negative(Value=pi_11)  # disabled
Z_2 = UnitZ(Factor=1)  # disabled
vrot_3 = Rotate(Vector=item_39, Axis=Z_2, Angle=neg_7)  # disabled
amp_6 = Amplitude(Vector=vrot_3, Amplitude=combine_11.Result)  # disabled

panel_101 = Panel(eval_14)
panel_102 = Panel(combine_11.Result)

# ---- group: vector match method 1 simplify
entwine_4 = Entwine(Branch00=panel_93, Branch01=panel_92, Branch02=panel_94, Branch03=panel_95, FlattenInputs=True)  # -> simplify(Result)
flatten_30 = FlattenTree(Tree=concat_10, Path="{0}")
mindex_13 = MemberIndex(Set=entwine_4, Member=flatten_30)  # -> Index, Count
clean_12 = CleanTree(RemoveNulls=True, RemoveInvalid=True, RemoveEmpty=True, Tree=mindex_13.Index)
pshift_7 = ShiftPaths(Data=clean_12, Offset=-1)
viewer_15 = ParamViewer(clean_12)

tstat_25 = TreeStatistics(Tree=pshift_7)  # -> Paths, Length, Count
dpath_13 = DeconstructPath(Branch=tstat_25.Paths)  # -> simplify(Indices)

graft_38 = GraftTree(Tree=tstat_25.Length, IncludeEmptyLists=True, IncludeNullItems=True)
series_14 = Series(Start=0, Step=1, Count=graft_38)
int_30 = Integer(simplify(series_14))
replace_21 = ReplaceItems(List=pshift_7, Item=dpath_13, Indices=int_30, Wrap=False)
graft_39 = GraftTree(Tree=flatten(replace_21), IncludeEmptyLists=True, IncludeNullItems=True)
viewer_16 = ParamViewer(graft_39)
replace_22 = ReplacePaths(Data=graft_39, Search=viewer_16, Replace=viewer_15)
pshift_8 = ShiftPaths(Data=replace_22, Offset="1")
item_40 = ListItem(List=vec_5, Index=pshift_8, Wrap=True)
amp_7 = Amplitude(Vector=item_40, Amplitude=combine_11.Result)
vdis_4 = VectorDisplay(Anchor=pt_8, Vector=amp_7)
