# Grasshopper definition 20161023_PE_points_intersection_014_lineDatabase_reconstructPath.gh (Grasshopper 0.9.76)

databaseparameters = Panel("""A
B
C
k
a
b
x0_pt0
y0_pt0
x1_pt1
y1_pt1
A0_intersectionLine0
B0_intersectionLine0
C0_intersectionLine0
A1_intersectionLine1
B1_intersectionLine1
C1_intersectionLine1
m_intersection
A2_parallelLine
B2_parallelLine
C2_parallelLine
angle
distance(p)
u_vector
v_vector
nu_normalVector
nv_normalVector""")
databaseparameters_2 = Panel("""A
B
C
k
a
b
pt0(x0,y0)
pt1(x1,y1)
intersection_line0(A0,B0,C0)
intersection_line1(A1,B1,C1)
intersection_m
parallel_line(A2,B2,C2)
angle
distance(p)
vector(u,v)
normal_vector(nu,nv)""")
panel = Panel("""0;0;0_3.2/1_1.0/3_2.2/5_4.0
1;0;2_2.5/3_4.0/4_8.2/5_1.2/7_2,3.2
2;0;1_2.2/7_2,1.9/11_3.222
3;0;4_8.2/6_4,2.2/14_2.442,3.442
4;0;4_8.2/6_1.2,4.2/14_3.56,4.23
5;0;3_3.2/6_1.2,4.2
6;0;0_2/2_2.3/1_3.2
7;0;6_3.2,1.2/7_1.2,3.2
8;0;8_3.2,2.2,1.2/9_3.4,1.3,1.2/10_2
9;0;6_2.2,3.1/11_4,3,2.2
10;0;12_3.221/13_4
11;0;6_3.21,2.22/15_4.23,5.43""")
debug01_constraintsituation_a_0 = Panel("""0;0;0_3.2/1_1.0/3_2.2/5_4.0
1;0;2_2.5/3_4.0/4_8.2/5_1.2/8_2/9_3.2
2;0;1_2.2/8_2/9_1.9/11_3.222
3;0;4_8.2/6_4/7_2.2/22_2.442/23_3.442
4;0;4_8.2/6_1.2/7_4.2/22_3.56/23_4.23
5;0;3_3.2/6_1.2/7_4.2
6;0;0_2/2_2.3/1_3.2
7;0;6_3.2/7_1.2/8_1.2/9_3.2
8;0;10_3.2/11_2.2/12_1.2/13_3.4/14_1.3/15_1.2/16_2
9;0;6_2.2/7_3.1/17_4/18_3/19_2.2
10;0;20_3.221/21_4
11;0;6_3.21/7_2.22/24_4.23/25_5.43
12;0;0_0/1_1.2/2_3.1""")
panel_2 = Panel("""0;0;0_3.2/1_1.0/3_2.2/5_4.0
1;0;2_2.5/3_4.0/4_8.2/5_1.2/8_2/9_3.2
2;0;1_2.2/8_2/9_1.9/11_3.222
3;0;4_8.2/6_4/7_2.2/22_2.442/23_3.442
4;0;4_8.2/6_1.2/7_4.2/22_3.56/23_4.23
5;0;3_3.2/6_1.2/7_4.2
6;0;0_2/2_2.3/1_3.2
7;0;6_3.2/7_1.2/8_1.2/9_3.2
8;0;10_3.2/11_2.2/12_1.2/13_3.4/14_1.3/15_1.2/16_2
9;0;6_2.2/7_3.1/17_4/18_3/19_2.2
10;0;20_3.221/21_4
11;0;6_3.21/7_2.22/24_4.23/25_5.43""")
databaseparameters_3 = Panel("""A
B
C
k
a
b
x0_pt0
y0_pt0
x1_pt1
y1_pt1
A0_intersectionLine0
B0_intersectionLine0
C0_intersectionLine0
A1_intersectionLine1
B1_intersectionLine1
C1_intersectionLine1
m_intersection
A2_parallelLine
B2_parallelLine
C2_parallelLine
angle
distance(p)
u_vector
n_vector
nu_normalVector
nv_normalVector""")
panel_4 = Panel("""0;0;0_3.2/1_1.0/3_2.2/5_4.0
1;0;2_2.5/3_4.0/4_8.2/5_1.2/7_2,3.2
2;0;1_2.2/7_2,1.9/11_3.222
3;0;4_8.2/6_4,2.2/14_2.442,3.442""")
panel_5 = Panel("""0;0%0:0_2.2/1_3.1/2_1.3*1%1:0_2
1;0%1:0_4.3/2_3.1*1%0:0_3.2/1_3.2/14_2.1*2%0:3_1.1/2_9.2
2;0%0:0_2/1_1.2/2_3.2*1%1:24_5/2_4.3""")
databasefunctions = Panel("""Ax+By+C=0,A!=0 and B!=0
y-y0=k(x-x0),k!=empty
x/a+y/b=1,a!=0andb!=0
y=kx+b,k!=empty
(y-y1)(y2-y1)=(x-x1)(x2-x1),x1!=x2andy1!=y2
f1(x,y)*m+f2(x,y)=0
f(x,y)-f(x0,y0)=0
x*cos(angle)+y*sin(angle)-p=0,angle=!k*pi
(x-x0)/u=(y-y0)/v,u!=0andv!=0
nu*(x-x0)+nv(y-y0)=0,nv!=0andnu!=0""")

# ----
# feed data and store data
panel_6 = Panel("/")
txt = Text(panel)
# log:
# 20161017
# 给定相应的数据，去匹配相应的算法
# 考虑是否要反馈数据
# path在后面匹配时，相同path的被放在一起，真tm尴尬...
# 完成一个基本的模板，明天按照这样继续做下去
# 20161018
# 算法和对应的参数进行匹配
# 对数据结构的处理进行简化，避免重复计算
# 数据的过滤和储存方式
split = TextSplit(Text=txt, Separators=";")
item = ListItem(List=split, Index=0, Wrap=True)  # -> Item, Item1, Item2
split_2 = TextSplit(Text=item.Item2, Separators=panel_6)
split_3 = TextSplit(Text=split_2, Separators="_")
item_2 = ListItem(List=split_3, Index=0, Wrap=True)  # -> simplify(Item), Item1
pshift = ShiftPaths(Data=item_2.Item, Offset=-1)
split_4 = TextSplit(Text=item_2.Item1, Separators=",")  # -> simplify(Result)
tstat = TreeStatistics(Tree=pshift)  # -> Paths, Length, Count
initialparasdepathlist = Integer(pshift)
initiallinecount = Integer(tstat.Count)
graft = GraftTree(Tree=tstat.Length, IncludeEmptyLists=True, IncludeNullItems=True)  # -> simplify(Tree)
initialparascounts = Integer(graft)
# log:
# 20161010
# 设计向量方向与数据结构之间的映射关系
# 数据结构用集合运算然后替换
# 替换树形结构的时候需要拍平
# 无论什么情况都留出0123正交的位置为Null
# 如果0123存在，没关系，不存在，插入一个空值
# 20161011
# 角度和path之间的映射关系，以及角度的识别:
# 分解basic line的path得到位置位置关系
# 先正交的位置关系，后自由的位置关系
# 考虑先组合line还是先分解path在配对
# 如何识别path知道非正交的相反的向量
# 增强path的排序的算法前馈，可通过path运算直接得到向量关系
# 运用path提取相应的两条交线
# 20161012
# debug时候replacePath爆红
# 精度问题导致set不能去掉原本偏差相同的角度
# 20161017
# 找到了两根交线的关系，先把他放在这，具体怎么用不继续做下去，先考虑其他的大的情况
# 20161018
# 算法和对应的参数进行匹配
# 对数据结构的处理进行简化，避免重复计算
# 数据的过滤和储存方式
# 20161023
# 对线的识别方法以及数据的缺省情况
# 数据分流计算的方法是否合适
# 重建数据结构，把他铺平
# 20161024
# 仍旧用了傻逼的分流数据的方法
# 设计能够包容其他线以及多线的数据结构
# debug程序
stack = StackData(Data=item.Item, Stack=initialparascounts)
stack_2 = StackData(Data=item.Item1, Stack=initialparascounts)
graft_2 = GraftTree(Tree=stack_2, IncludeEmptyLists=True, IncludeNullItems=True)
graft_3 = GraftTree(Tree=stack, IncludeEmptyLists=True, IncludeNullItems=True)
int = Integer(simplify(graft_3))
int_2 = Integer(simplify(item_2.Item))
int_3 = Integer(simplify(graft_2))
merge = Merge(Data1=int, Data2=int_3, Data3=int_2)
path = ConstructPath(Indices=merge)
flatten = FlattenTree(Tree=path, Path="{0}")
initialparaspaths = DataPath(path)
viewer = ParamViewer(split_4)
replace = ReplacePaths(Data=split_4, Search=viewer, Replace=flatten)
data = Data(replace)

# ----
# log:
# 20161023
# 对线的识别方法以及数据的缺省情况
# 数据分流计算的方法是否合适：
# 进行f(x)的修改
# 重建数据结构，把他铺平
# 对bug进行检测加入合适的限制条件
# 补充缺省值的接口
txt_2 = Text(debug01_constraintsituation_a_0)
panel_7 = Panel("""{0;0;0;0}
{0;0;0;1}
{0;0;0;2}
{0;1;1;0}
{1;0;1;0}
{1;0;1;2}
{1;1;0;0}
{1;1;0;1}
{1;1;0;14}
{1;2;0;3}
{1;2;0;2}
{2;0;0;0}
{2;0;0;1}
{2;0;0;2}
{2;1;0;24}
{2;1;0;2}""")
# construct the method of feeding data
split_5 = TextSplit(Text=txt_2, Separators=";")

# ----
# log:
# 20161010
# 设计向量方向与数据结构之间的映射关系
# 数据结构用集合运算然后替换
# 替换树形结构的时候需要拍平
# 无论什么情况都留出0123正交的位置为Null
# 如果0123存在，没关系，不存在，插入一个空值
# 20161011
# 角度和path之间的映射关系，以及角度的识别
# 线交的算法与path之间多对多的关系
pi = Pi(Factor="2")
# {0,0}-->0/2*pi
# 0/2*pi <= a< 1/2*pi
# {1,0}-->1/2*pi
# 1/2*pi <= a < 2/2*pi
# {2,0}-->2/2*pi
# 2/2*pi <= a < 3/2*pi
# {3,0}-->3/2*pi
# 3/2*pi <= a < 4/2*pi
# log:
# 20161010
# 如果0123存在，没关系，不存在，插入一个空值
# 光是插入一个空值也是不行，修改标签运算的算法使其更合理:原因是set的时候把null去掉了
# 应该是插入不是替换
# 不是插入一个Null就能解决问题的，问题处在了member的寻找上，寻找时候把null数据给删除了，结果找不到对应的path
random = Random(Range=pi, Number="20", Seed=Slider(33.222, range=0..100))

item_3 = ListItem(List=split_5, Index=0, Wrap=True)  # -> Item, Item1, Item2
split_6 = TextSplit(Text=item_3.Item2, Separators="/")
split_7 = TextSplit(Text=split_6, Separators="_")
item_4 = ListItem(List=split_7, Index=0, Wrap=True)  # -> simplify(Item), Item1

pi_2 = Pi(Factor=1)
ins = InsertItems(List=random, Item=pi_2, Indices="0", Wrap=True)

pathmanual = Panel("""{a;b;c;d;e;f}
a:lineIndex
b:segmentIndex
c:segmentLineType
d:parametersIndex
e:feedback_seg
f:feedback_line""")
# kernel intersection algorithm 002_siftPoint
panel_8 = Panel("""0
0.4
1
1.5
1.5
1.92

2.05
2.1
2.4
2.3
2.3
2.1
3
3.12
3.11
3.12""")
pshift_2 = ShiftPaths(Data=item_4.Item, Offset=-1)
databasemapping = Panel("""0,1,2;(0!=zero)and(1!=zero) A=0-->y-axis B=0-->x-x-axis
3,6,7;
4,5;(4!=zero)and(5!=zero)
3,5;
6,7,8,9;(6!=8)and(7!=9)
10,11,12,13,14,15,16;
6,7,17,18,19;
20,21;20=!k*pi,k=1,2,3..
6;7;22,23;(22!=zero)and(23!=zero)
6;7;24,25;(24!=zero)and(25!=zero)""")
split_8 = TextSplit(Text=item_4.Item1, Separators=",")  # -> simplify(Result)
# Point:indicate a position in space
# Line:length,direction,position
# Point
# two ends of the line
# the intersection of two lines
# the meeting of lines at the corner of a space or volumn
# the center of field
panel_9 = Panel("""0
0.4
1
1.5
1.5
1.92

2.05
2.1
2.4
2.3
2.3
2.1
3
3.12
3.11
3.12""")
txt_3 = Text(panel_5)
databasemapping_2 = Panel("""0,1,2;(0!=zero)and(1!=zero)
3,6;
4,5;(4!=zero)and(5!=zero)
3,5;
6,7;(6[0]!=6[1])and(7[0]!=7[1])
8,9,10;
6,11;
12,13;12=!k*pi,k=1,2,3..
6,14;(14[0]!=zero)and(14[1]!=zero)
6,15;(15[0]!=zero)and(15[1]!=zero)""")
tstat_2 = TreeStatistics(Tree=pshift_2)  # -> Paths, Length, Count
split_9 = TextSplit(Text=txt_3, Separators=";")

# ----
# mapping between angle and path
# {0;0} --> 0
# {1;0} --> 1/2*pi
# {2;0} --> pi
# {3;0} --> 3/2*pi
# 当向量中不存在某正交方向时候为Null
# vectorPath00_can't identify reverse vectors
panel_10 = Panel("2")
pi_3 = Pi(Factor=panel_10)
num = Number(panel_8)
remap = RemapNumbers(Value=num, Source="4", Target=pi_3)  # -> Mapped, Clipped
pi_4 = Pi(Factor=1)
sort = SortList(Keys=remap.Mapped)  # -> Keys, ValuesA
division = Division(A=pi_4, B="2")
series = Series(Start=0, Step=division, Count="5")
consec = ConsecutiveDomains(Numbers=series, Additive=False)  # -> simplify(Domains)
domain = Domain(graft(consec))
angle = Number(sort.Keys)
dedomain = DeconstructDomain(Domain=domain)  # -> Start, End
larger = LargerThan(FirstNumber=angle, SecondNumber=dedomain.Start)  # -> LargerThan, OrEqualTo
smaller = SmallerThan(FirstNumber=angle, SecondNumber=dedomain.End)  # -> SmallerThan, OrEqualTo
and = GateAnd(A=larger.OrEqualTo, B=smaller.SmallerThan)
sift = SiftPattern(List=angle, SiftPattern=and)  # -> Output0, Output1
clean = CleanTree(RemoveNulls=True, RemoveInvalid=True, RemoveEmpty=False, Tree=sift.Output1)  # -> simplify(Tree)
item_5 = ListItem(List=clean, Index="0", Wrap=True)
equals = Equality(FirstNumber=item_5, SecondNumber=simplify(dedomain.Start))  # -> Equality, Inequality
int_4 = Integer(equals.Inequality)
ins_2 = InsertItems(List=clean, Indices="0", Wrap=True)
neg = Negative(Value=int_4)
cull_i = CullIndex(List=ins_2, Indices=neg, Wrap=False)  # -> simplify(List)
num_2 = Number(cull_i)
cset = CreateSet(List=num_2)  # -> Set, Map
addition = Addition(A=cset.Map, B=int_4)
tstat_3 = TreeStatistics(Tree=addition)  # -> Paths, Length, Count
dpath = DeconstructPath(Branch=tstat_3.Paths)
graft_4 = GraftTree(Tree=addition, IncludeEmptyLists=True, IncludeNullItems=True)
stack_3 = StackData(Data=dpath, Stack=graft(tstat_3.Length))
graft_5 = GraftTree(Tree=cull_i, IncludeEmptyLists=True, IncludeNullItems=True)
graft_6 = GraftTree(Tree=stack_3, IncludeEmptyLists=True, IncludeNullItems=True)  # -> simplify(Tree)
ins_3 = InsertItems(List=graft_6, Item=graft_4, Indices="-1", Wrap=True)
path_2 = ConstructPath(Indices=ins_3)  # -> simplify(Branch)
viewer_2 = ParamViewer(graft_5)
flatten_2 = FlattenTree(Tree=path_2, Path="{0}")
flatten_3 = FlattenTree(Tree=cull_i, Path="{0}")
replace_2 = ReplacePaths(Data=graft_5, Search=viewer_2, Replace=flatten_2)
graft_7 = GraftTree(Tree=sort.Keys, IncludeEmptyLists=True, IncludeNullItems=True)  # -> simplify(Tree)
keysearch = KeyValueSearch(Keys=flatten_3, Values=flatten_2, Search=graft_7)

panel_11 = Panel("""0
1
2
3
2
2
3
1
2
1
0
0
2
0
1
3""")
# feed data and store data
initialparasdepathlist_2 = Integer(pshift_2)
item_6 = ListItem(List=split_9, Index=0, Wrap=True)  # -> Item, Item1
initiallinecount_2 = Integer(tstat_2.Count)
graft_8 = GraftTree(Tree=tstat_2.Length, IncludeEmptyLists=True, IncludeNullItems=True)  # -> simplify(Tree)
split_10 = TextSplit(Text=item_6.Item1, Separators="*")
initialparascounts_2 = Integer(graft_8)
split_11 = TextSplit(Text=split_10, Separators="%")

# ----
# log:
# 20161011
# 增强path的排序的算法前馈，可通过path运算直接得到向量关系:
# 排序前后问题：
# 先精确控制还是先离散问题
# 应该是把排序前的原始数据进行path替换，而不是排序之后的数据：结果竟然是一样的。。。！
# 20161017
# 修改好排序过后path下为空值产生的错误
# vectorPath01
# mapping between angle and path
# {0;0} --> 0
# {1;0} --> 1/2*pi
# {2;0} --> pi
# {3;0} --> 3/2*pi
# 无所谓正交向量存不存在
panel_12 = Panel("""0
1
0
1.3
3
1
2.3
2""")
jitter = Jitter(List=panel_11, Jitter=1, Seed=2)  # -> Values, Indices
pi_5 = Pi(Factor=1)
pi_6 = Pi(Factor="2")
num_3 = Number(jitter.Values)
division_2 = Division(A=pi_5, B="2")
# log:
# 20161010
# 不是插入一个Null就能解决问题的，问题处在了member的寻找上，寻找时候把null数据给删除了，结果找不到对应的path:
# 找到替换的member的运算器
# 发现前馈需要一大堆的运算器，先做成后馈
panel_13 = Panel("5")
remap_2 = RemapNumbers(Value=num_3, Source="4", Target=pi_6)  # -> Mapped, Clipped
series_2 = Series(Start=0, Step=division_2, Count=panel_13)
consec_2 = ConsecutiveDomains(Numbers=series_2, Additive=False)  # -> simplify(Domains)
angle_2 = Number(remap_2.Mapped)
domain_2 = Domain(graft(consec_2))
dedomain_2 = DeconstructDomain(Domain=domain_2)  # -> simplify(Start), simplify(End)
larger_2 = LargerThan(FirstNumber=angle_2, SecondNumber=dedomain_2.Start)  # -> LargerThan, OrEqualTo
smaller_2 = SmallerThan(FirstNumber=angle_2, SecondNumber=dedomain_2.End)  # -> SmallerThan, OrEqualTo
and_2 = GateAnd(A=larger_2.OrEqualTo, B=smaller_2.SmallerThan)
sift_2 = SiftPattern(List=angle_2, SiftPattern=and_2)  # -> Output0, Output1
clean_2 = CleanTree(RemoveNulls=True, RemoveInvalid=False, RemoveEmpty=True, Tree=sift_2.Output1)  # -> simplify(Tree)
tstat_4 = TreeStatistics(Tree=clean_2)  # -> Paths, Length, Count
branch = TreeBranch(Tree=dedomain_2.Start, Path=tstat_4.Paths, MaintainPaths=True)
subtraction = Subtraction(A=clean_2, B=branch)
num_4 = Number(clean_2)
eval = Evaluate(F="round(x,4)", x=subtraction)
flatten_4 = FlattenTree(Tree=eval, Path="{0}")
cset_2 = CreateSet(List=flatten_4)  # -> Set, Map
sort_2 = SortList(Keys=cset_2.Set)  # -> Keys, ValuesA
mindex = MemberIndex(Set=sort_2.Keys, Member=eval)  # -> Index, Count
pshift_3 = ShiftPaths(Data=mindex.Index, Offset=-1)
flatten_5 = FlattenTree(Tree=mindex.Index, Path="{0}")
tstat_5 = TreeStatistics(Tree=pshift_3)  # -> Paths, Length, Count
dpath_2 = DeconstructPath(Branch=tstat_5.Paths)
graft_9 = GraftTree(Tree=flatten_5, IncludeEmptyLists=True, IncludeNullItems=True)  # -> simplify(Tree)
stack_4 = StackData(Data=dpath_2, Stack=graft(tstat_5.Length))
graft_10 = GraftTree(Tree=angle_2, IncludeEmptyLists=True, IncludeNullItems=True)
flatten_6 = FlattenTree(Tree=stack_4, Path="{0}")
graft_11 = GraftTree(Tree=flatten_6, IncludeEmptyLists=True, IncludeNullItems=True)  # -> simplify(Tree)
merge_2 = Merge(Data1=graft_11, Data2=graft_9)
path_3 = ConstructPath(Indices=merge_2)
graft_12 = GraftTree(Tree=num_4, IncludeEmptyLists=True, IncludeNullItems=True)
flatten_7 = FlattenTree(Tree=path_3, Path="{0}")
flatten_8 = FlattenTree(Tree=graft_12, Path="{0}")
viewer_3 = ParamViewer(graft_12)
keysearch_2 = KeyValueSearch(Keys=flatten_8, Values=flatten_7, Search=graft_10)  # -> simplify(Result)
replace_3 = ReplacePaths(Data=graft_12, Search=viewer_3, Replace=flatten_7)
panel_14 = Panel(replace_3)
panel_15 = Panel(keysearch_2)

stack_5 = StackData(Data=item_3.Item, Stack=initialparascounts_2)
item_7 = ListItem(List=split_11, Index=0, Wrap=True)  # -> Item, Item1
split_12 = TextSplit(Text=item_7.Item1, Separators=":")
stack_6 = StackData(Data=item_3.Item1, Stack=initialparascounts_2)
panel_16 = Panel(data)
panel_17 = Panel(item_6.Item)
item_8 = ListItem(List=split_12, Index=0, Wrap=True)  # -> Item, Item1
graft_13 = GraftTree(Tree=stack_6, IncludeEmptyLists=True, IncludeNullItems=True)
graft_14 = GraftTree(Tree=stack_5, IncludeEmptyLists=True, IncludeNullItems=True)
split_13 = TextSplit(Text=item_8.Item1, Separators="/")
simplify = SimplifyTree(Tree=split_13, Front=False)
pshift_4 = ShiftPaths(Data=simplify, Offset=-1)
lng = ListLength(List=pshift_4)
stack_7 = StackData(Data=item_6.Item, Stack=lng)
split_14 = TextSplit(Text=split_13, Separators="_")  # -> simplify(Result)
lng_2 = ListLength(List=split_13)
stack_8 = StackData(Data=item_7.Item, Stack=lng_2)
int_5 = Integer(simplify(graft_14))
int_6 = Integer(simplify(item_4.Item))
int_7 = Integer(simplify(graft_13))
stack_9 = StackData(Data=item_8.Item, Stack=lng_2)
flatten_9 = FlattenTree(Tree=stack_7, Path="{0}")
flatten_10 = FlattenTree(Tree=stack_8, Path="{0}")
panel_18 = Panel(split_9)
item_9 = ListItem(List=split_14, Index=0, Wrap=True)  # -> Item, Item1
merge_3 = Merge(Data1=int_5, Data2=int_7, Data3=int_6)
path_4 = ConstructPath(Indices=merge_3)
flatten_11 = FlattenTree(Tree=path_4, Path="{0}")
panel_19 = Panel("""2.5838678
Pi
1.6421
3.212896
1.5*Pi""")
viewer_4 = ParamViewer(split_8)
initialparaspaths_2 = DataPath(path_4)
flatten_12 = FlattenTree(Tree=stack_9, Path="{0}")
graft_15 = GraftTree(Tree=flatten_9, IncludeEmptyLists=True, IncludeNullItems=True)
graft_16 = GraftTree(Tree=flatten_10, IncludeEmptyLists=True, IncludeNullItems=True)
flatten_13 = FlattenTree(Tree=item_9.Item, Path="{0}")
graft_17 = GraftTree(Tree=flatten_12, IncludeEmptyLists=True, IncludeNullItems=True)

# ----
# log:
# 20161010
# 应该是插入不是替换：
# 连一个新电池，是True就插入，False就不插入
# 简短的并不需要连接电池
# 插入的应该是一个Null值，而不是正交角度
# instance
panel_20 = Panel("0")
item_10 = ListItem(List=clean, Index=panel_20, Wrap=True)
equals_2 = Equality(FirstNumber=item_10, SecondNumber=simplify(dedomain.Start))  # -> Equality, Inequality
num_5 = Number(clean)
neg_2 = Negative(Value=equals_2.Inequality)
ins_4 = InsertItems(List=num_5, Indices=graft("0"), Wrap=True)
cull_i_2 = CullIndex(List=ins_4, Indices=neg_2, Wrap=False)  # -> simplify(List)

replace_4 = ReplacePaths(Data=split_8, Search=viewer_4, Replace=flatten_11)
graft_18 = GraftTree(Tree=flatten_13, IncludeEmptyLists=True, IncludeNullItems=True)
data_2 = Data(replace_4)
panel_21 = Panel(data_2)
merge_4 = Merge(Data1=graft_15, Data2=graft_16, Data3=graft_17, Data4=graft_18)
path_5 = ConstructPath(Indices=merge_4)
flatten_14 = FlattenTree(Tree=path_5, Path="{0}")
viewer_5 = ParamViewer(item_9.Item1)

# ----
# log:
# 20161010
# 插入的应该是一个Null值，而不是正交角度:
# 先保留空值，后根据boolean删除Null
# 插入一个空值的方法：
# 运用cull index运算器本身的性质，对布尔值进行negetive后删除不需要的空值
toggle = BooleanToggle(False)
series_3 = Series(Start=0, Step=1, Count=3)  # -> simplify(graft(Series))
graft_19 = GraftTree(Tree="0", IncludeEmptyLists=True, IncludeNullItems=True)  # -> graft(Tree)
panel_22 = Panel([Toggle(False), Toggle(True), toggle])
bool = Boolean(panel_22)
ins_5 = InsertItems(List=series_3, Indices=graft_19, Wrap=True)  # -> simplify(List)
# log:
# 20161010
# 设计向量方向与数据结构之间的映射关系
# 数据结构用集合运算然后替换
# 替换树形结构的时候需要拍平
# 无论什么情况都留出0123正交的位置为Null
# 如果0123存在，没关系，不存在，插入一个空值
# 20161011
# 角度和path之间的映射关系，以及角度的识别:
# 分解basic line的path得到位置位置关系
# 先正交的位置关系，后自由的位置关系
# 考虑先组合line还是先分解path在配对
# 如何识别path知道非正交的相反的向量
# 增强path的排序的算法前馈，可通过path运算直接得到向量关系
# 运用path提取相应的两条交线
# 20161012
# debug时候replacePath爆红
# 精度问题导致set不能去掉原本偏差相同的角度
# 20161017
# 找到了两根交线的关系，先把他放在这，具体怎么用不继续做下去，先考虑其他的大的情况
# 先罗列出方程对应的算法
# 建立数据库，对数据结构进行设计，让每一个数据都有对应的位置
# 给定相应的数据，去匹配相应的算法
# 考虑是否要反馈数据
int_8 = Integer(bool)
neg_3 = Negative(Value=int_8)
cull_i_3 = CullIndex(List=ins_5, Indices=graft(neg_3), Wrap=False)
panel_23 = Panel(cull_i_3)

# ----
# path{x;y}表示，索引为x的线可以匹配索引为y算法。
# 如果是相同x下有多个，说明算法上有多个选择
# path{x;y}
# x         --> line index
# y         --> function index
# value  -->  parameters index
# each line choose first function
databasemapping_3 = Panel("""0,1,2
3,6,7
4,5
3,5
6,7,8,9
10,11,12,13,14,15,16
6,7,17,18,19
20,21
6,7,22,23
6,7,24,25""")
initialparasdepathlist_3 = Integer(initialparasdepathlist_2)
split_15 = TextSplit(Text=databasemapping_3, Separators=",")  # -> simplify(Result)
functionparasdepathlist = Integer(split_15)
tstat_6 = TreeStatistics(Tree=functionparasdepathlist)  # -> Paths, Length, Count
initialparascounts_3 = Integer(initialparascounts_2)
flatten_15 = FlattenTree(Tree=functionparasdepathlist, Path="{0}")
initiallinecount_3 = Integer(initiallinecount_2)
functionsmatchparascounts = Integer(tstat_6.Length)
functionscount = Integer(tstat_6.Count)
lng_3 = ListLength(List=flatten_15)
multiplication = Multiplication(A=initialparascounts_3, B=functionscount)
multiplication_2 = Multiplication(A=initiallinecount_3, B=lng_3)
repeat = RepeatData(Data=initialparasdepathlist_3, Length=multiplication)  # -> simplify(Data)
repeat_2 = RepeatData(Data=flatten_15, Length=multiplication_2)
partition = PartitionList(List=repeat, Size=initialparascounts_3)  # -> simplify(Chunks)
partition_2 = PartitionList(List=repeat_2, Size=lng_3)
partition_3 = PartitionList(List=partition_2, Size=functionsmatchparascounts)  # -> simplify(Chunks)
int_9 = Integer(partition_3)
int_10 = Integer(partition)
mindex_2 = MemberIndex(Set=int_9, Member=int_10)  # -> Index, Count
lng_4 = ListLength(List=int_9)
ma = MassAddition(Input=mindex_2.Count)  # -> Result, PartialResults
equals_3 = Equality(FirstNumber=lng_4, SecondNumber=ma.Result)  # -> Equality, Inequality
sift_3 = SiftPattern(List=int_9, SiftPattern=equals_3.Equality)  # -> Output0, Output1
clean_3 = CleanTree(RemoveNulls=True, RemoveInvalid=True, RemoveEmpty=True, Tree=sift_3.Output1)
tstat_7 = TreeStatistics(Tree=clean_3)  # -> Paths, Length, Count
path_6 = DataPath(tstat_7.Paths)
dpath_3 = DeconstructPath(Branch=tstat_7.Paths)
item_11 = ListItem(List=dpath_3, Index=0, Wrap=True)
flatten_16 = FlattenTree(Tree=item_11, Path="{0}")
cset_3 = CreateSet(List=flatten_16)  # -> Set, Map
item_12 = ListItem(List=path_6, Index=cset_3.Set, Wrap=False)
branch_2 = TreeBranch(Tree=clean_3, Path=item_12, MaintainPaths=True)
int_11 = Integer(branch_2)

# ----
# log:
# 20161010
# 发现前馈需要一大堆的运算器，先做成后馈
# 如果需要前反馈，可能需要修改标签运算的算法，所以先后馈，至少能做下去
# 重新Partition
# 还是回到前馈
# log:
# 20161010
# 还是回到前馈：
# 用set运算器自带的index记录，与boolean值进行相加，对path运算得到新的path
# log:
# 20161010
# 设计向量方向与数据结构之间的映射关系
# 数据结构用集合运算然后替换
# 替换树形结构的时候需要拍平
# 无论什么情况都留出0123正交的位置为Null
# 如果0123存在，没关系，不存在，插入一个空值
# 20161011
# 角度和path之间的映射关系，以及角度的识别:
# 先正交的位置关系，后自由的位置关系
# 如何识别path知道非正交的相反的向量
# 增强path的排序的算法前馈，可通过path运算直接得到向量关系
panel_24 = Panel(clean)
databasemapping_4 = Panel("""0,1,2
3,6
4,5
3,5
6,7
8,9,10
6,11
12,13
6,14
6,15""")
replace_5 = ReplacePaths(Data=item_9.Item1, Search=viewer_5, Replace=flatten_14)
data_3 = Data(replace_5)
split_16 = TextSplit(Text=databasemapping_4, Separators=",")  # -> simplify(Result)

functionparasdepathlist_2 = Integer(split_16)
initialparasdepathlist_4 = Integer(initialparasdepathlist)

dataparameterspath = Panel(initialparasdepathlist_4)
functionpath = Panel(functionparasdepathlist_2)
panel_25 = Panel(data_3)
tstat_8 = TreeStatistics(Tree=functionparasdepathlist_2)  # -> Paths, Length, Count
initialparascounts_4 = Integer(initialparascounts)
flatten_17 = FlattenTree(Tree=functionparasdepathlist_2, Path="{0}")

# ----
# sample_treeStatistics
cset_4 = CreateSet(List=num_2)  # -> Set, Map
tstat_9 = TreeStatistics(Tree=cset_4.Map)  # -> Paths, Length, Count
dpath_4 = DeconstructPath(Branch=tstat_9.Paths)
stack_10 = StackData(Data=dpath_4, Stack=graft(tstat_9.Length))
graft_20 = GraftTree(Tree=cset_4.Map, IncludeEmptyLists=True, IncludeNullItems=True)
graft_21 = GraftTree(Tree=stack_10, IncludeEmptyLists=True, IncludeNullItems=True)  # -> simplify(Tree)
ins_6 = InsertItems(List=graft_21, Item=graft_20, Indices="-1", Wrap=True)
path_7 = ConstructPath(Indices=ins_6)  # -> simplify(Branch)
flatten_18 = FlattenTree(Tree=path_7, Path="{0}")

functionsmatchparascounts_2 = Integer(tstat_8.Length)
initiallinecount_4 = Integer(initiallinecount)
functionscount_2 = Integer(tstat_8.Count)
lng_5 = ListLength(List=flatten_17)
multiplication_3 = Multiplication(A=initialparascounts_4, B=functionscount_2)
panel_27 = Panel(initialparascounts_4)
multiplication_4 = Multiplication(A=initiallinecount_4, B=lng_5)
repeat_3 = RepeatData(Data=initialparasdepathlist_4, Length=multiplication_3)  # -> simplify(Data)
repeat_4 = RepeatData(Data=flatten_17, Length=multiplication_4)
partition_4 = PartitionList(List=repeat_3, Size=initialparascounts_4)  # -> simplify(Chunks)
partition_5 = PartitionList(List=repeat_4, Size=lng_5)
partition_6 = PartitionList(List=partition_5, Size=functionsmatchparascounts_2)  # -> simplify(Chunks)
# path{x;y}表示，索引为x的线可以匹配索引为y算法。
# 如果是相同x下有多个，说明算法上有多个选择
int_12 = Integer(partition_6)
int_13 = Integer(partition_4)
mindex_3 = MemberIndex(Set=int_12, Member=int_13)  # -> Index, Count
lng_6 = ListLength(List=int_12)
ma_2 = MassAddition(Input=mindex_3.Count)  # -> Result, PartialResults
equals_4 = Equality(FirstNumber=lng_6, SecondNumber=ma_2.Result)  # -> Equality, Inequality
panel_28 = Panel("""2
3""")
panel_29 = Panel("""2
2""")
panel_30 = Panel("""1
3
5""")
panel_31 = Panel("""1
0
4""")
panel_32 = Panel("""7
2
2""")
panel_33 = Panel("""2,3,1
4,2,3
1,3,2""")
panel_34 = Panel("""3,2,2
2,3,2
4,1,3""")
panel_35 = Panel("""3
2
1""")
panel_36 = Panel("""3,2,2
1,3,4
4,1,3""")
panel_37 = Panel("""3.22133
1.3229
pi""")
panel_38 = Panel("""3.42
5.33
1.44""")
panel_39 = Panel("""3,2
1,3
0,1""")
panel_40 = Panel("""2,3
4,0
1,3""")
panel_41 = Panel("""1
3""")
sift_4 = SiftPattern(List=int_12, SiftPattern=equals_4.Equality)  # -> Output0, Output1
clean_4 = CleanTree(RemoveNulls=True, RemoveInvalid=True, RemoveEmpty=True, Tree=sift_4.Output1)
tstat_10 = TreeStatistics(Tree=clean_4)  # -> Paths, Length, Count
A = Number(panel_28)
B = Number(panel_29)
C = Number(panel_41)
k = Number(panel_30)
a = Number(panel_31)
b = Number(panel_32)
pt0 = Point([Point(-8, -7, 0), Point(-5, 0, 0), Point(-16, -3, 0)])
pt1 = Point([Point(-8, -10, 0), Point(3, -7, 0), Point(-4, -2, 0)])
intersection_line0_a0_b0_c0 = Vector(panel_33)
intersection_line0_a1_b1_c1 = Vector(panel_34)
intersection_m = Number(panel_35)
parallel_line_a2_b2_c2 = Vector(panel_36)
angle_3 = Number(panel_37)
distance_p = Number(panel_38)
vector_u_v = Vector(panel_39)
normal_vector_nu_nv = Vector(panel_40)
dpath_5 = DeconstructPath(Branch=tstat_10.Paths)
pi_7 = Pi(Factor=1)
complex = ComplexComponents(Complex=pt0)  # -> Real, Imaginary
complex_2 = ComplexComponents(Complex=pt1)  # -> Real, Imaginary
item_13 = ListItem(List=dpath_5, Index=0, Wrap=True)

# ----
# path{x;y}
# x         --> line index
# y         --> function index
# value  -->  parameters index
# each line choose first function
flatten_19 = FlattenTree(Tree=item_13, Path="{0}")
path_8 = DataPath(tstat_10.Paths)
cset_5 = CreateSet(List=flatten_19)  # -> Set, Map
item_14 = ListItem(List=path_8, Index=cset_5.Set, Wrap=False)
branch_3 = TreeBranch(Tree=clean_4, Path=item_14, MaintainPaths=True)
int_14 = Integer(branch_3)

division_3 = Division(A=angle_3, B=pi_7)
int_15 = Integer(division_3)
complex_3 = ComplexComponents(Complex=vector_u_v)  # -> Real, Imaginary
x0 = Number(complex.Real)
y0 = Number(complex.Imaginary)
x1 = Number(complex_2.Real)
y1 = Number(complex_2.Imaginary)
subtraction_2 = Subtraction(A=division_3, B=int_15)
equals_5 = Equality(FirstNumber=A, SecondNumber="0")  # -> Equality, Inequality
equals_6 = Equality(FirstNumber=B, SecondNumber="0")  # -> Equality, Inequality
abs = Absolute(Value=subtraction_2)
merge_5 = Merge(Data1=graft(A), Data2=graft(B), Data3=graft(C))
equals_7 = Equality(FirstNumber=a, SecondNumber="0")  # -> Equality, Inequality
equals_8 = Equality(FirstNumber=b, SecondNumber="0")  # -> Equality, Inequality
pdecon = Deconstruct(Point=intersection_line0_a0_b0_c0)  # -> XComponent, YComponent, ZComponent
pdecon_2 = Deconstruct(Point=intersection_line0_a1_b1_c1)  # -> XComponent, YComponent, ZComponent
complex_4 = ComplexComponents(Complex=normal_vector_nu_nv)  # -> Real, Imaginary
and_3 = GateAnd(A=graft(equals_5.Inequality), B=graft(equals_6.Inequality))
equals_9 = Equality(FirstNumber=complex_3.Real, SecondNumber="0")  # -> Equality, Inequality
equals_10 = Equality(FirstNumber=complex_3.Imaginary, SecondNumber="0")  # -> Equality, Inequality
larger_3 = LargerThan(FirstNumber=abs, SecondNumber="0.000001")  # -> LargerThan, OrEqualTo
and_4 = GateAnd(A=equals_7.Inequality, B=equals_8.Inequality)
panel_42 = Panel(int_14)
equals_11 = Equality(FirstNumber=complex_4.Real, SecondNumber="0")  # -> Equality, Inequality
equals_12 = Equality(FirstNumber=complex_4.Imaginary, SecondNumber="0")  # -> Equality, Inequality
and_5 = GateAnd(A=equals_9.Inequality, B=equals_10.Inequality)
pdecon_3 = Deconstruct(Point=parallel_line_a2_b2_c2)  # -> XComponent, YComponent, ZComponent
sift_5 = SiftPattern(List=merge_5, SiftPattern=and_3)  # -> Output0, Output1
sift_6 = SiftPattern(List=angle_3, SiftPattern=larger_3.LargerThan)  # -> Output0, Output1
sift_7 = SiftPattern(List=distance_p, SiftPattern=larger_3.LargerThan)  # -> Output0, Output1
and_6 = GateAnd(A=equals_11.Inequality, B=equals_12.Inequality)
sift_8 = SiftPattern(List=complex_4.Imaginary, SiftPattern=and_6)  # -> Output0, Output1
sift_9 = SiftPattern(List=complex_4.Real, SiftPattern=and_6)  # -> Output0, Output1
sift_10 = SiftPattern(List=complex_3.Imaginary, SiftPattern=and_5)  # -> Output0, Output1
sift_11 = SiftPattern(List=complex_3.Real, SiftPattern=and_5)  # -> Output0, Output1
tstat_11 = TreeStatistics(Tree=int_11)  # -> Paths, Length, Count
dpath_6 = DeconstructPath(Branch=tstat_11.Paths)
sift_12 = SiftPattern(List=a, SiftPattern=and_4)  # -> Output0, Output1
sift_13 = SiftPattern(List=b, SiftPattern=and_4)  # -> Output0, Output1
functionsmatchparascounts_3 = Integer(functionsmatchparascounts)
item_15 = ListItem(List=sift_5.Output1, Index=0, Wrap=True)  # -> Item, Item1, Item2
data_4 = Data(data_2)

tstat_12 = TreeStatistics(Tree=int_14)  # -> Paths, Length, Count
dpath_7 = DeconstructPath(Branch=tstat_12.Paths)
data_5 = Data(data)
functionsmatchparascounts_4 = Integer(functionsmatchparascounts_2)
viewer_6 = ParamViewer(dpath_7)
replace_6 = ReplacePaths(Data=dpath_7, Search=viewer_6, Replace=tstat_12.Paths)
item_16 = ListItem(List=replace_6, Index=0, Wrap=True)  # -> Item, Item1
item_17 = ListItem(List=functionsmatchparascounts_4, Index=item_16.Item1, Wrap=False)
stack_11 = StackData(Data=item_16.Item, Stack=item_17)
stack_12 = StackData(Data=item_16.Item1, Stack=item_17)
graft_22 = GraftTree(Tree=int_14, IncludeEmptyLists=True, IncludeNullItems=True)
graft_23 = GraftTree(Tree=stack_11, IncludeEmptyLists=True, IncludeNullItems=True)
graft_24 = GraftTree(Tree=stack_12, IncludeEmptyLists=True, IncludeNullItems=True)
merge_6 = Merge(Data1=graft_23, Data3=graft_22)
ins_7 = InsertItems(List=merge_6, Item="0", Indices="1", Wrap=True)  # -> simplify(List)
path_9 = ConstructPath(Indices=ins_7)
branch_4 = TreeBranch(Tree=data_5, Path=path_9, MaintainPaths=True)

viewer_7 = ParamViewer(dpath_6)
eval_2 = Evaluate(F="{cos(angle),sin(angle),-p}", angle=sift_6.Output1, p=sift_7.Output1)
eval_3 = Evaluate(
    F="{m*A0+A1,m*B0+B1,m*C0+C1}",
    A0=pdecon.XComponent,
    B0=pdecon.YComponent,
    C0=pdecon.ZComponent,
    A1=pdecon_2.XComponent,
    B1=pdecon_2.YComponent,
    C1=pdecon_2.ZComponent,
    m=intersection_m)
eval_4 = Evaluate(F="{A2,B2,-A2*x0-B2*y0}", A2=pdecon_3.XComponent, B2=pdecon_3.YComponent, C2=pdecon_3.ZComponent, x0=x0, y0=y0)
eval_5 = Evaluate(F="{nu,nv,-nu*x0-nv*y0}", x0=x0, y0=y0, nu=sift_9.Output1, nv=sift_8.Output1)
eval_6 = Evaluate(F="{k,-1,y0-k*x0}", k=k, x0=x0, y0=y0)
eval_7 = Evaluate(F="{x0-x1,y1-y0,x0*x1-y0*y1-x0*x0+y0*y0}", x0=x0, y0=y0, x1=x1, y1=y1)
eval_8 = Evaluate(F="{v,-u,-v*x0+u*y0}", x0=x0, y0=y0, u=sift_11.Output1, v=sift_10.Output1)
eval_9 = Evaluate(F="{A,B,C}", A=item_15.Item, B=item_15.Item1, C=item_15.Item2)
eval_10 = Evaluate(F="{b,a,-a*b}", a=sift_12.Output1, b=sift_13.Output1)
eval_11 = Evaluate(F="{k,-1,b}", k=k, b=b)
replace_7 = ReplacePaths(Data=dpath_6, Search=viewer_7, Replace=tstat_11.Paths)
item_18 = ListItem(List=replace_7, Index=0, Wrap=True)  # -> Item, Item1
panel_43 = Panel(eval_9)
panel_44 = Panel(eval_6)
panel_45 = Panel(eval_10)
panel_46 = Panel(eval_11)
panel_47 = Panel(eval_7)
panel_48 = Panel(eval_3)
panel_49 = Panel(eval_4)
panel_50 = Panel(eval_2)
panel_51 = Panel(eval_8)
panel_52 = Panel(eval_5)
item_19 = ListItem(List=functionsmatchparascounts_3, Index=item_18.Item1, Wrap=False)
functionindex = Integer(item_18.Item1)

# ----
# function called times
functionscount_3 = Integer(functionscount)
series_4 = Series(Start=0, Step=1, Count=functionscount_3)
flatten_20 = FlattenTree(Tree=functionindex, Path="{0}")
int_16 = Integer(series_4)
mindex_4 = MemberIndex(Set=flatten(flatten_20), Member=int_16)  # -> Index, Count
pshift_5 = ShiftPaths(Data=mindex_4.Count, Offset=-1)

lineindex = Integer(item_18.Item)

panel_53 = Panel("""3
4
12""")
panel_54 = Panel("""12
3
4""")
item_20 = ListItem(List=panel_53, Index="0", Wrap=True)  # -> Item, Item1, Item2
panel_55 = Panel("""{A,B,C}
{x,x+y}
{A,B,C}""")
panel_56 = Panel("""2.1
0""")
panel_57 = Panel("""3
4.3""")
panel_58 = Panel("""1.3
9.2""")
graft_25 = GraftTree(Tree=panel_54, IncludeEmptyLists=True, IncludeNullItems=True)
path_10 = ConstructPath(Indices=item_20.Item1)
path_11 = ConstructPath(Indices=graft_25)
graft_26 = GraftTree(Tree=panel_55, IncludeEmptyLists=True, IncludeNullItems=True)
path_12 = ConstructPath(Indices=item_20.Item2)
path_13 = ConstructPath(Indices=item_20.Item)
flatten_21 = FlattenTree(Tree=path_11, Path="{0}")
graft_27 = GraftTree(Tree=panel_58, IncludeEmptyLists=True, IncludeNullItems=True)
viewer_8 = ParamViewer("5")
graft_28 = GraftTree(Tree=panel_56, IncludeEmptyLists=True, IncludeNullItems=True)
graft_29 = GraftTree(Tree=panel_57, IncludeEmptyLists=True, IncludeNullItems=True)
viewer_9 = ParamViewer("2.32")
viewer_10 = ParamViewer(graft_26)
merge_7 = Merge(Data1=path_13, Data2=path_12)
replace_8 = ReplacePaths(Data="5", Search=viewer_8, Replace=path_10)
replace_9 = ReplacePaths(Data="2.32", Search=viewer_9, Replace=path_10)
replace_10 = ReplacePaths(Data=graft_26, Search=viewer_10, Replace=flatten_21)
viewer_11 = ParamViewer(graft_28)
viewer_12 = ParamViewer(graft_29)
viewer_13 = ParamViewer(graft_28)
replace_11 = ReplacePaths(Data=graft_28, Search=viewer_11, Replace=merge_7)
replace_12 = ReplacePaths(Data=graft_29, Search=viewer_12, Replace=merge_7)
replace_13 = ReplacePaths(Data=graft_27, Search=viewer_13, Replace=merge_7)
num_6 = Number(replace_8)
num_7 = Number(replace_9)
num_8 = Number(replace_11)
num_9 = Number(replace_12)
num_10 = Number(replace_13)
panel_59 = Panel(replace_10)
panel_60 = Panel(num_10)
panel_61 = Panel(num_9)
panel_62 = Panel(num_8)
eval_12 = Evaluate(F=replace_10, x=num_6, y=num_7, A=num_8, B=num_9, C=num_10)
panel_63 = Panel(eval_12)

graft_30 = GraftTree(Tree=int_11, IncludeEmptyLists=True, IncludeNullItems=True)
stack_13 = StackData(Data=lineindex, Stack=item_19)
stack_14 = StackData(Data=functionindex, Stack=item_19)
parametersindex_tree = Integer(graft_30)
graft_31 = GraftTree(Tree=stack_13, IncludeEmptyLists=True, IncludeNullItems=True)
graft_32 = GraftTree(Tree=stack_14, IncludeEmptyLists=True, IncludeNullItems=True)
panel_64 = Panel("""2
0
1""")
functionindex_tree = Integer(graft_32)
panel_65 = Panel("""{A,B,C}
{k,-1,y0-k*x0}
{b,a,-a*b}
{k,-1,b}
{x0-x1,y1-y0,x0*x1-y0*y1-x0*x0+y0*y0}
{m*A0+A1,m*B0+B1,m*C0+C1}
{A2,B2,-A2*x0-B2*y0}
{cos(angle),sin(angle),-p}
{v,-u,-v*x0+u*y0}
{nu,nv,-nu*x0-nv*y0}""")
merge_8 = Merge(Data1=graft_31, Data3=parametersindex_tree)
ins_8 = InsertItems(List=merge_8, Item="0", Indices="1", Wrap=True)  # -> simplify(List)
merge_9 = Merge(Data1=ins_8, Data2=graft_32)
panel_66 = Panel("""{A,B,C}
{k,-1,y0-k*x0}
{b,a,-a*b}
{k,-1,b}
{x0-x1,y1-y0,x0*x1-y0*y1-x0*x0+y0*y0}
{m*A0+A1,m*B0+B1,m*C0+C1}
{A2,B2,-A2*x0-B2*y0}
{cos(angle),sin(angle),-p}
{v,-u,-v*x0+u*y0}
{nu,nv,-nu*x0-nv*y0}""")
item_21 = ListItem(List=panel_55, Index=panel_64, Wrap=True)  # -> Item, Item1
path_14 = ConstructPath(Indices=merge_9)
path_15 = ConstructPath(Indices=ins_8)
branch_5 = TreeBranch(Tree=data_4, Path=path_15, MaintainPaths=True)
panel_67 = Panel("""0
0.4
1
1.5
1.5
1.92
2
2.05
2.1
2.4
2.3
2.3
2.1
3
3.12
3.11
3.12""")
flatten_22 = FlattenTree(Tree=path_14, Path="{0}")
flatten_23 = FlattenTree(Tree=path_15, Path="{0}")
num_11 = Number(branch_5)
panel_68 = Panel("""0
1
2
3
2
2
3
1
2
1
0
0
2
0
1
3""")
panel_69 = Panel("""0
1
2
1.3
3
2.3
2""")
dataaddfunctionindex = Data(num_11)
parametersindex_tree_2 = Integer(parametersindex_tree)
functionindex_tree_2 = Integer(graft_32)
functionparasdepathlist_3 = Integer(functionparasdepathlist)
functionsmatchparascounts_5 = Integer(functionsmatchparascounts)
functioncalledcount = Integer(pshift_5)
txt_4 = Text(panel_65)
line = Line(Line((119.3393443, -60.78584412, 0), (119.6525493, -60.78584412, 0)))
panel_70 = Panel("""0
1
0
1.3
3
1
2.3
2""")
line_2 = Line(Line((119.8096632, -60.78584412, 0), (119.4931182, -60.78584412, 0)))
panel_71 = Panel(item_21.Item)
panel_72 = Panel("运算器存在bug")
replace_14 = ReplacePaths(Data=num_11, Search=flatten_23, Replace=flatten_22)
ccx = CurveCurve(CurveA=line, CurveB=line_2)  # -> Points, ParamsA, ParamsB
sift_14 = SiftPattern(List=branch_4, SiftPattern=graft_24)  # -> Output0, Output1, Output2, Output3, Output4, Output5, Output6, Output7, Output8, Output9
item_22 = ListItem(List=panel_66, Index=item_16.Item1, Wrap=True)
panel_73 = Panel(num_11)
series_5 = Series(Start=0, Step=functionsmatchparascounts_5, Count=functioncalledcount)
panel_74 = Panel(num_7)

# ----
# mapping between angle and path
# {0;0} --> 0
# {1;0} --> 1/2*pi
# {2;0} --> pi
# {3;0} --> 3/2*pi
# 无所谓正交向量存不存在
jitter_2 = Jitter(List=panel_69, Jitter=1, Seed=2)  # -> Values, Indices
pi_8 = Pi(Factor=1)
pi_9 = Pi(Factor="2")
division_4 = Division(A=pi_8, B="2")
num_12 = Number(jitter_2.Values)
# log:
# 20161011
# 增强path的排序的算法前馈，可通过path运算直接得到向量关系:
# 排序前后问题：
# 先精确控制还是先离散问题
remap_3 = RemapNumbers(Value=num_12, Source="4", Target=pi_9)  # -> Mapped, Clipped
series_6 = Series(Start=0, Step=division_4, Count="5")
consec_3 = ConsecutiveDomains(Numbers=series_6, Additive=False)  # -> simplify(Domains)
angle_4 = Number(remap_3.Mapped)
domain_3 = Domain(graft(consec_3))
dedomain_3 = DeconstructDomain(Domain=domain_3)  # -> simplify(Start), simplify(End)
# log:
# 20161012
# debug时候replacePath爆红:
# 删除空的树形数据结构，merge的时候数据结构对应
# 精度问题导致set不能去掉原本偏差相同的角度：
# 用round函数取到小数点后几位，关键是排序，这样做就不会对原来的数据产生什么影响，是标签改对了
larger_4 = LargerThan(FirstNumber=angle_4, SecondNumber=dedomain_3.Start)  # -> LargerThan, OrEqualTo
smaller_3 = SmallerThan(FirstNumber=angle_4, SecondNumber=dedomain_3.End)  # -> SmallerThan, OrEqualTo
and_7 = GateAnd(A=larger_4.OrEqualTo, B=smaller_3.SmallerThan)
sift_15 = SiftPattern(List=angle_4, SiftPattern=and_7)  # -> Output0, Output1
clean_5 = CleanTree(RemoveNulls=True, RemoveInvalid=False, RemoveEmpty=True, Tree=sift_15.Output1)  # -> simplify(Tree)
tstat_13 = TreeStatistics(Tree=clean_5)  # -> Paths, Length, Count
branch_6 = TreeBranch(Tree=dedomain_3.Start, Path=tstat_13.Paths, MaintainPaths=True)
subtraction_3 = Subtraction(A=clean_5, B=branch_6)
num_13 = Number(clean_5)
eval_13 = Evaluate(F="round(x,4)", x=subtraction_3)
flatten_24 = FlattenTree(Tree=eval_13, Path="{0}")
cset_6 = CreateSet(List=flatten_24)  # -> Set, Map
sort_3 = SortList(Keys=cset_6.Set)  # -> Keys, ValuesA
mindex_5 = MemberIndex(Set=sort_3.Keys, Member=eval_13)  # -> Index, Count
pshift_6 = ShiftPaths(Data=mindex_5.Index, Offset=-1)
flatten_25 = FlattenTree(Tree=mindex_5.Index, Path="{0}")
tstat_14 = TreeStatistics(Tree=pshift_6)  # -> Paths, Length, Count
dpath_8 = DeconstructPath(Branch=tstat_14.Paths)
graft_33 = GraftTree(Tree=flatten_25, IncludeEmptyLists=True, IncludeNullItems=True)  # -> simplify(Tree)
stack_15 = StackData(Data=dpath_8, Stack=graft(tstat_14.Length))
graft_34 = GraftTree(Tree=angle_4, IncludeEmptyLists=True, IncludeNullItems=True)
flatten_26 = FlattenTree(Tree=stack_15, Path="{0}")
graft_35 = GraftTree(Tree=flatten_26, IncludeEmptyLists=True, IncludeNullItems=True)  # -> simplify(Tree)
merge_10 = Merge(Data1=graft_35, Data2=graft_33)
path_16 = ConstructPath(Indices=merge_10)
graft_36 = GraftTree(Tree=num_13, IncludeEmptyLists=True, IncludeNullItems=True)
flatten_27 = FlattenTree(Tree=path_16, Path="{0}")
flatten_28 = FlattenTree(Tree=graft_36, Path="{0}")
viewer_14 = ParamViewer(graft_36)
keysearch_3 = KeyValueSearch(Keys=flatten_28, Values=flatten_27, Search=graft_34)  # -> simplify(Result)
replace_15 = ReplacePaths(Data=graft_36, Search=viewer_14, Replace=flatten_27)
path_17 = DataPath(keysearch_3)
# log:
# 20161010
# 设计向量方向与数据结构之间的映射关系
# 数据结构用集合运算然后替换
# 替换树形结构的时候需要拍平
# 无论什么情况都留出0123正交的位置为Null
# 如果0123存在，没关系，不存在，插入一个空值
# 20161011
# 角度和path之间的映射关系，以及角度的识别:
# 分解basic line的path得到位置位置关系
# 先正交的位置关系，后自由的位置关系
# 考虑先组合line还是先分解path在配对
# 如何识别path知道非正交的相反的向量
# 增强path的排序的算法前馈，可通过path运算直接得到向量关系
# 运用path提取相应的两条交线
# 20161012
# debug时候replacePath爆红
# 精度问题导致set不能去掉原本偏差相同的角度
# 20161017
# 找到了两根交线的关系，先把他放在这，具体怎么用不继续做下去，先考虑其他的大的情况
# 20161023
# 对线的识别方法以及数据的缺省情况
# 数据分流的方法是否合适
ultimateangle_afterelection = Number(replace_15)

panel_75 = Panel(num_6)
panel_76 = Panel(functionsmatchparascounts_5)
clean_6 = CleanTree(RemoveNulls=True, RemoveInvalid=True, RemoveEmpty=True, Tree=sift_14.Output0)
clean_7 = CleanTree(RemoveNulls=True, RemoveInvalid=True, RemoveEmpty=True, Tree=sift_14.Output1)
clean_8 = CleanTree(RemoveNulls=True, RemoveInvalid=True, RemoveEmpty=True, Tree=sift_14.Output2)
clean_9 = CleanTree(RemoveNulls=True, RemoveInvalid=True, RemoveEmpty=True, Tree=sift_14.Output3)
clean_10 = CleanTree(RemoveNulls=True, RemoveInvalid=True, RemoveEmpty=True, Tree=sift_14.Output4)
clean_11 = CleanTree(RemoveNulls=True, RemoveInvalid=True, RemoveEmpty=True, Tree=sift_14.Output5)
clean_12 = CleanTree(RemoveNulls=True, RemoveInvalid=True, RemoveEmpty=True, Tree=sift_14.Output6)
clean_13 = CleanTree(RemoveNulls=True, RemoveInvalid=True, RemoveEmpty=True, Tree=sift_14.Output7)
clean_14 = CleanTree(RemoveNulls=True, RemoveInvalid=True, RemoveEmpty=True, Tree=sift_14.Output8)
clean_15 = CleanTree(RemoveNulls=True, RemoveInvalid=True, RemoveEmpty=True, Tree=sift_14.Output9)
line_bug_commonline = Line([Line((119.3540923, -60.56923774, 0), (119.5008735, -60.56923774, 0)), Line((119.5919791, -60.56923774, 0), (119.7404475, -60.56923774, 0))])
# debug:之前判断是实交和虚交的方法是判断交点point的x坐标是否在两线段的值域范围内，但是当上述情况的时候，直线会虚交被误判成实际交点
line_bug_insectiononextend = Line([Line((119.0174668, -60.28107794, 0), (119.4638718, -60.28107794, 0)), Line((119.2255633, -60.35451331, 0), (119.2255633, -61.15203638, 0))])
# log:
# 20161010
# 设计向量方向与数据结构之间的映射关系
# 分离对应的算法，让算法之间有通过也有分离
# 线线重合的问题解决后先放在一旁
# 数据结构的替换，在最后做
line_3 = Line([Line((119.5723897, -60.99532941, 0), (119.5723897, -61.13933165, 0)), Line((119.5723897, -60.99532941, 0), (119.7626783, -60.99532941, 0))])
eval_14 = Evaluate(F=item_21.Item, x=num_6, y=num_7, A=num_8, B=num_9, C=num_10)
item_23 = ListItem(List=txt_4, Index=0, Wrap=True)  # -> Item, Item1, Item2, Item3, Item4, Item5, Item6, Item7, Item8, Item9
sift_16 = SiftPattern(List=dataaddfunctionindex, SiftPattern=functionindex_tree_2)  # -> Output0, Output1, Output2, Output3, Output4, Output5, Output6, Output7, Output8, Output9
bang = ExplodeTree(Data=series_5)  # -> Branch0, Branch1, Branch2, Branch3, Branch4, Branch5, Branch6, Branch7, Branch8, Branch9
tstat_15 = TreeStatistics(Tree=clean_14)  # -> Paths, Length, Count
panel_77 = Panel(clean_8)
panel_78 = Panel(eval_14)
panel_79 = Panel("把正交和斜交的情况分离开来，同时组织数据结构")
panel_80 = Panel("""{A,B,C}
{k,-1,y0-k*x0}
{b,a,-a*b}
{k,-1,b}
{x0-x1,y1-y0,x0*x1-y0*y1-x0*x0+y0*y0}
{m*A0+A1,m*B0+B1,m*C0+C1}
{A2,B2,-A2*x0-B2*y0}
{cos(angle),sin(angle),-p}
{v,-u,-v*x0+u*y0}
{nu,nv,-nu*x0-nv*y0}""")
clean_16 = CleanTree(RemoveNulls=True, RemoveInvalid=True, RemoveEmpty=True, Tree=sift_16.Output2)
clean_17 = CleanTree(RemoveNulls=True, RemoveInvalid=True, RemoveEmpty=True, Tree=sift_16.Output3)
clean_18 = CleanTree(RemoveNulls=True, RemoveInvalid=True, RemoveEmpty=True, Tree=sift_16.Output4)
clean_19 = CleanTree(RemoveNulls=True, RemoveInvalid=True, RemoveEmpty=True, Tree=sift_16.Output5)
clean_20 = CleanTree(RemoveNulls=True, RemoveInvalid=True, RemoveEmpty=True, Tree=sift_16.Output0)
clean_21 = CleanTree(RemoveNulls=True, RemoveInvalid=True, RemoveEmpty=True, Tree=sift_16.Output1)
clean_22 = CleanTree(RemoveNulls=True, RemoveInvalid=True, RemoveEmpty=True, Tree=sift_16.Output6)
clean_23 = CleanTree(RemoveNulls=True, RemoveInvalid=True, RemoveEmpty=True, Tree=sift_16.Output9)
clean_24 = CleanTree(RemoveNulls=True, RemoveInvalid=True, RemoveEmpty=True, Tree=sift_16.Output7)
clean_25 = CleanTree(RemoveNulls=True, RemoveInvalid=True, RemoveEmpty=True, Tree=sift_16.Output8)
tstat_16 = TreeStatistics(Tree=clean_16)  # -> Paths, Length, Count
tstat_17 = TreeStatistics(Tree=clean_17)  # -> Paths, Length, Count
tstat_18 = TreeStatistics(Tree=clean_18)  # -> Paths, Length, Count
tstat_19 = TreeStatistics(Tree=clean_19)  # -> Paths, Length, Count
tstat_20 = TreeStatistics(Tree=clean_20)  # -> Paths, Length, Count
tstat_21 = TreeStatistics(Tree=clean_21)  # -> Paths, Length, Count
functionscount_4 = Integer(functionscount)
tstat_22 = TreeStatistics(Tree=clean_22)  # -> Paths, Length, Count
tstat_23 = TreeStatistics(Tree=clean_23)  # -> Paths, Length, Count
tstat_24 = TreeStatistics(Tree=clean_25)  # -> Paths, Length, Count
tstat_25 = TreeStatistics(Tree=clean_24)  # -> Paths, Length, Count
item_24 = ListItem(List=tstat_16.Paths, Index=bang.Branch2, Wrap=False)  # -> Item, Item1
item_25 = ListItem(List=tstat_18.Paths, Index=bang.Branch4, Wrap=False)  # -> Item, Item1, Item2, Item3
item_26 = ListItem(List=tstat_20.Paths, Index=bang.Branch0, Wrap=False)  # -> Item, Item1, Item2
item_27 = ListItem(List=tstat_21.Paths, Index=bang.Branch1, Wrap=False)  # -> Item, Item1, Item2
item_28 = ListItem(List=tstat_19.Paths, Index=bang.Branch5, Wrap=False)  # -> Item, Item1, Item2, Item3, Item4, Item5, Item6
item_29 = ListItem(List=tstat_17.Paths, Index=bang.Branch3, Wrap=False)  # -> Item, Item1
item_30 = ListItem(List=tstat_22.Paths, Index=bang.Branch6, Wrap=False)  # -> Item, Item1, Item2, Item3, Item4
item_31 = ListItem(List=tstat_23.Paths, Index=bang.Branch9, Wrap=False)  # -> Item, Item1, Item2, Item3
item_32 = ListItem(List=tstat_24.Paths, Index=bang.Branch8, Wrap=False)  # -> Item, Item1, Item2, Item3
item_33 = ListItem(List=tstat_25.Paths, Index=bang.Branch7, Wrap=False)  # -> Item, Item1
series_7 = Series(Start=0, Step=1, Count=functionscount_4)
branch_7 = TreeBranch(Tree=clean_16, Path=item_24.Item, MaintainPaths=True)
branch_8 = TreeBranch(Tree=clean_16, Path=item_24.Item1, MaintainPaths=True)
branch_9 = TreeBranch(Tree=clean_20, Path=item_26.Item, MaintainPaths=True)
branch_10 = TreeBranch(Tree=clean_20, Path=item_26.Item1, MaintainPaths=True)
branch_11 = TreeBranch(Tree=clean_17, Path=item_29.Item, MaintainPaths=True)
branch_12 = TreeBranch(Tree=clean_17, Path=item_29.Item1, MaintainPaths=True)
branch_13 = TreeBranch(Tree=clean_18, Path=item_25.Item, MaintainPaths=True)
branch_14 = TreeBranch(Tree=clean_20, Path=item_26.Item2, MaintainPaths=True)
branch_15 = TreeBranch(Tree=clean_19, Path=item_28.Item4, MaintainPaths=True)
branch_16 = TreeBranch(Tree=clean_18, Path=item_25.Item1, MaintainPaths=True)
branch_17 = TreeBranch(Tree=clean_18, Path=item_25.Item2, MaintainPaths=True)
branch_18 = TreeBranch(Tree=clean_18, Path=item_25.Item3, MaintainPaths=True)
branch_19 = TreeBranch(Tree=clean_19, Path=item_28.Item2, MaintainPaths=True)
branch_20 = TreeBranch(Tree=clean_19, Path=item_28.Item5, MaintainPaths=True)
branch_21 = TreeBranch(Tree=clean_19, Path=item_28.Item6, MaintainPaths=True)
branch_22 = TreeBranch(Tree=clean_19, Path=item_28.Item, MaintainPaths=True)
branch_23 = TreeBranch(Tree=clean_19, Path=item_28.Item1, MaintainPaths=True)
branch_24 = TreeBranch(Tree=clean_19, Path=item_28.Item3, MaintainPaths=True)
databasemapping_6 = Panel("""0,1,2;(0!=zero)and(1!=zero)
3,6,7;
4,5;(4!=zero)and(5!=zero)
3,5;
6,7,8,9;(6!=8)and(7!=9)
10,11,12,13,14,15;
6,7,17,18,19;
20,21;20=!k*pi,k=1,2,3..
22,23;(22!=zero)and(23!=zero)
24,25;(24!=zero)and(25!=zero)""")
branch_25 = TreeBranch(Tree=clean_21, Path=item_27.Item, MaintainPaths=True)
branch_26 = TreeBranch(Tree=clean_21, Path=item_27.Item1, MaintainPaths=True)
branch_27 = TreeBranch(Tree=clean_21, Path=item_27.Item2, MaintainPaths=True)
# foolish!
# foolish!
# foolish!
tstat_26 = TreeStatistics(Tree=int_14)  # -> Paths, Length, Count
branch_28 = TreeBranch(Tree=clean_23, Path=item_31.Item1, MaintainPaths=True)
branch_29 = TreeBranch(Tree=clean_22, Path=item_30.Item, MaintainPaths=True)
branch_30 = TreeBranch(Tree=clean_22, Path=item_30.Item1, MaintainPaths=True)
branch_31 = TreeBranch(Tree=clean_22, Path=item_30.Item2, MaintainPaths=True)
branch_32 = TreeBranch(Tree=clean_22, Path=item_30.Item3, MaintainPaths=True)
branch_33 = TreeBranch(Tree=clean_22, Path=item_30.Item4, MaintainPaths=True)
branch_34 = TreeBranch(Tree=clean_23, Path=item_31.Item, MaintainPaths=True)
branch_35 = TreeBranch(Tree=clean_23, Path=item_31.Item2, MaintainPaths=True)
branch_36 = TreeBranch(Tree=clean_23, Path=item_31.Item3, MaintainPaths=True)
branch_37 = TreeBranch(Tree=clean_24, Path=item_33.Item, MaintainPaths=True)
branch_38 = TreeBranch(Tree=clean_24, Path=item_33.Item1, MaintainPaths=True)
branch_39 = TreeBranch(Tree=clean_25, Path=item_32.Item1, MaintainPaths=True)
branch_40 = TreeBranch(Tree=clean_25, Path=item_32.Item2, MaintainPaths=True)
branch_41 = TreeBranch(Tree=clean_25, Path=item_32.Item3, MaintainPaths=True)
branch_42 = TreeBranch(Tree=clean_25, Path=item_32.Item, MaintainPaths=True)
item_34 = ListItem(List=panel_80, Index=0, Wrap=True)
pshift_7 = ShiftPaths(Data=tstat_26.Paths, Offset=-1)
eval_15 = Evaluate(F=item_23.Item2, a=branch_7, b=branch_8)
eval_16 = Evaluate(F=item_23.Item3, k=branch_11, b=branch_12)
eval_17 = Evaluate(F=item_23.Item, A=branch_9, B=branch_10, C=branch_14)
eval_18 = Evaluate(F=item_23.Item1, k=branch_25, x0=branch_26, y0=branch_27)
eval_19 = Evaluate(F=item_23.Item4, x0=branch_13, y0=branch_16, x1=branch_17, y1=branch_18)
eval_20 = Evaluate(F=item_23.Item5, A0=branch_22, B0=branch_23, C0=branch_19, A1=branch_24, B1=branch_15, C1=branch_20, m=branch_21)
eval_21 = Evaluate(F=item_23.Item6, A2=branch_31, B2=branch_32, C2=branch_33, x0=branch_29, y0=branch_30)
eval_22 = Evaluate(F=item_23.Item7, angle=branch_37, p=branch_38)
dpath_9 = DeconstructPath(Branch=pshift_7)
viewer_15 = ParamViewer(dpath_9)
eval_23 = Evaluate(F=item_23.Item8, x0=branch_42, y0=branch_39, u=branch_40, v=branch_41)
eval_24 = Evaluate(F=item_23.Item9, x0=branch_34, y0=branch_28, nu=branch_35, nv=branch_36)
replace_16 = ReplacePaths(Data=dpath_9, Search=viewer_15, Replace=item_14)
item_35 = ListItem(List=replace_16, Index=0, Wrap=True)  # -> Item, Item1
panel_81 = Panel(replace_16)
merge_11 = Merge(
    Data1=eval_17,
    Data2=eval_18,
    Data3=eval_15,
    Data4=eval_16,
    Data5=eval_19,
    Data6=eval_20,
    Data7=eval_21,
    Data8=eval_22,
    Data9=eval_23,
    Data10=eval_24)
int_17 = Integer(item_35.Item)
int_18 = Integer(item_35.Item1)
data_6 = Data(simplify(merge_11))

# ----
# {a;b;c;d;e}
# a --> line index
# b --> line type
# c --> line parameter index
# d --> line function mapping
lng_7 = ListLength(List=int_14)
flatten_29 = FlattenTree(Tree=item.Item1, Path="{0}")
stack_16 = StackData(Data=int_17, Stack=lng_7)
item_36 = ListItem(List=flatten_29, Index=stack_16, Wrap=True)
stack_17 = StackData(Data=int_18, Stack=lng_7)
graft_37 = GraftTree(Tree=int_14, IncludeEmptyLists=True, IncludeNullItems=True)
graft_38 = GraftTree(Tree=stack_16, IncludeEmptyLists=True, IncludeNullItems=True)
graft_39 = GraftTree(Tree=item_36, IncludeEmptyLists=True, IncludeNullItems=True)
graft_40 = GraftTree(Tree=stack_17, IncludeEmptyLists=True, IncludeNullItems=True)
merge_12 = Merge(Data1=graft_38, Data2=graft_39, Data3=graft_37)
merge_13 = Merge(Data1=graft_38, Data2=graft_39, Data3=graft_37, Data4=graft_40)
path_18 = ConstructPath(Indices=merge_12)
path_19 = ConstructPath(Indices=merge_13)
data_7 = Data(data)
flatten_30 = FlattenTree(Tree=path_18, Path="{0}")
flatten_31 = FlattenTree(Tree=path_19, Path="{0}")
branch_43 = TreeBranch(Tree=data_7, Path=flatten_30, MaintainPaths=True)
viewer_16 = ParamViewer(branch_43)
replace_17 = ReplacePaths(Data=branch_43, Search=viewer_16, Replace=flatten_31)

pshift_8 = ShiftPaths(Data=data_6, Offset=-1)
panel_82 = Panel(data_6)
pdecon_4 = Deconstruct(Point=pshift_8)  # -> XComponent, YComponent, ZComponent
panel_83 = Panel(pshift_8)
int_19 = Integer(tstat_8.Length)
panel_84 = Panel("""0;0;0_3.2/1_1.0/3_2.2/5_4.0
1;0;2_2.5/3_4.0/4_8.2/5_1.2/7_2,3.2
2;0;1_2.2/7_2,1.9/11_3.222
3;0;4_8.2/6_4,2.2/14_2.442,3.442
4;0;4_8.2/6_1.2,4.2/14_3.56,4.23
5;0;3_3.2/6_1.2,4.2
6;0;0_2/2_2.3/1_3.2
7;0;6_3.2,1.2/7_1.2,3.2
8;0;8_3.2,2.2,1.2/9_3.4,1.3,1.2/10_2
9;0;6_2.2,3.1/11_4,3,2.2
10;0;12_3.221/13_4
11;0;6_3.21,2.22/15_4.23,5.43""")
int_20 = Integer(graft_40)
data_8 = Data(replace_17)
panel_85 = Panel(data_8)
panel_86 = Panel(replace_17)
item_37 = ListItem(List=int_19, Index=0, Wrap=False)  # -> Item, Item1, Item2, Item3, Item4, Item5, Item6, Item7, Item8, Item9
num_14 = Number(item_37.Item8)
series_8 = Series(Start=0, Step=1, Count=num_14)
sift_17 = SiftPattern(List=tstat_15.Paths, SiftPattern=series_8)  # -> Output0, Output1
branch_44 = TreeBranch(Tree=clean_14, Path=sift_17.Output1, MaintainPaths=True)
branch_45 = TreeBranch(Tree=clean_14, Path=sift_17.Output0, MaintainPaths=True)
item_38 = ListItem(List=branch_45, Index=0, Wrap=False)  # -> Item, Item1
item_39 = ListItem(List=branch_44, Index=0, Wrap=False)  # -> Item, Item1

u = Number(item_39.Item)
v = Number(item_39.Item1)
y0_2 = Number(item_38.Item1)
x0_2 = Number(item_38.Item)
equals_13 = Equality(FirstNumber=u, SecondNumber="0")  # -> Equality, Inequality
equals_14 = Equality(FirstNumber=v, SecondNumber="0")  # -> Equality, Inequality
and_8 = GateAnd(A=equals_13.Inequality, B=equals_14.Inequality)
sift_18 = SiftPattern(List=v, SiftPattern=and_8)  # -> Output0, Output1
sift_19 = SiftPattern(List=u, SiftPattern=and_8)  # -> Output0, Output1
eval_25 = Evaluate(F="{v,-u,-v*x0+u*y0}", x0=x0_2, y0=y0_2, u=sift_19.Output1, v=sift_18.Output1)
panel_87 = Panel(eval_25)
path_mapper = PathMapper(eval_25, source="{A;B;C;D}", target="{A;B;0}")
panel_88 = Panel(path_mapper)

sift_20 = SiftPattern(List=data_8, SiftPattern=int_20)  # -> Output0, Output1, Output2, Output3, Output4, Output5, Output6, Output7, Output8, Output9
clean_26 = CleanTree(RemoveNulls=True, RemoveInvalid=True, RemoveEmpty=True, Tree=sift_20.Output0)
clean_27 = CleanTree(RemoveNulls=True, RemoveInvalid=True, RemoveEmpty=True, Tree=sift_20.Output1)
clean_28 = CleanTree(RemoveNulls=True, RemoveInvalid=True, RemoveEmpty=True, Tree=sift_20.Output2)
clean_29 = CleanTree(RemoveNulls=True, RemoveInvalid=True, RemoveEmpty=True, Tree=sift_20.Output3)
clean_30 = CleanTree(RemoveNulls=True, RemoveInvalid=True, RemoveEmpty=True, Tree=sift_20.Output4)
clean_31 = CleanTree(RemoveNulls=True, RemoveInvalid=True, RemoveEmpty=True, Tree=sift_20.Output5)
clean_32 = CleanTree(RemoveNulls=True, RemoveInvalid=True, RemoveEmpty=True, Tree=sift_20.Output6)
clean_33 = CleanTree(RemoveNulls=True, RemoveInvalid=True, RemoveEmpty=True, Tree=sift_20.Output7)
clean_34 = CleanTree(RemoveNulls=True, RemoveInvalid=True, RemoveEmpty=True, Tree=sift_20.Output8)
clean_35 = CleanTree(RemoveNulls=True, RemoveInvalid=True, RemoveEmpty=True, Tree=sift_20.Output9)
tstat_27 = TreeStatistics(Tree=clean_33)  # -> Paths, Length, Count
tstat_28 = TreeStatistics(Tree=clean_31)  # -> Paths, Length, Count
tstat_29 = TreeStatistics(Tree=clean_32)  # -> Paths, Length, Count
tstat_30 = TreeStatistics(Tree=clean_30)  # -> Paths, Length, Count

# ----
# 00 common parallel
# 10 vectical
# 20 reverse parallel
# 30 vectical
path_20 = DataPath(path_17)
flatten_32 = FlattenTree(Tree=path_20, Path="{0}")
tstat_31 = TreeStatistics(Tree=path_20)  # -> Paths, Length, Count
tstat_32 = TreeStatistics(Tree=path_20)  # -> Paths, Length, Count
ma_3 = MassAddition(Input=tstat_31.Length)  # -> Result, PartialResults
series_9 = Series(Start=0, Step=1, Count=tstat_32.Count)
stack_18 = StackData(Data=ma_3.PartialResults, Stack=tstat_31.Length)
shift = ShiftList(List=series_9, Shift=stack_18, Wrap=False)
item_40 = ListItem(List=flatten_32, Index=shift, Wrap=True)  # -> simplify(Item)
lng_8 = ListLength(List=item_40)
# log:
# 20161011
# 如何识别path知道非正交的相反的向量
# 增强path的排序的算法前馈，可通过path运算直接得到向量关系
# 运用path提取相应的两条交线；
# 索引交线，并保留原有树形结构
stack_19 = StackData(Data=path_20, Stack=lng_8)
secondpath = DataPath(item_40)
firstpath = DataPath(stack_19)
dpath_10 = DeconstructPath(Branch=firstpath)
dpath_11 = DeconstructPath(Branch=secondpath)
subtraction_4 = Subtraction(A=dpath_10, B=dpath_11)
abs_2 = Absolute(Value=subtraction_4)
item_41 = ListItem(List=abs_2, Index=0, Wrap=True)  # -> Item, Item1
panel_89 = Panel("""00
10
20
30""")
ultimateangle_afterelection_2 = Number(ultimateangle_afterelection)
concat = Concatenate(FragmentA=item_41.Item, FragmentB=item_41.Item1)
mindex_6 = MemberIndex(Set=panel_89, Member=concat)  # -> simplify(Index), Count
graft_41 = GraftTree(Tree=secondpath, IncludeEmptyLists=True, IncludeNullItems=True)
graft_42 = GraftTree(Tree=firstpath, IncludeEmptyLists=True, IncludeNullItems=True)

tstat_33 = TreeStatistics(Tree=clean_35)  # -> Paths, Length, Count
tstat_34 = TreeStatistics(Tree=clean_29)  # -> Paths, Length, Count
tstat_35 = TreeStatistics(Tree=clean_26)  # -> Paths, Length, Count
num_15 = Number(item_37.Item7)
num_16 = Number(item_37.Item5)
num_17 = Number(item_37.Item6)
num_18 = Number(item_37.Item4)
num_19 = Number(item_37.Item)
tstat_36 = TreeStatistics(Tree=clean_28)  # -> Paths, Length, Count
num_20 = Number(item_37.Item3)
num_21 = Number(item_37.Item9)
tstat_37 = TreeStatistics(Tree=clean_27)  # -> Paths, Length, Count
series_10 = Series(Start=0, Step=1, Count=num_15)
num_22 = Number(item_37.Item1)
num_23 = Number(item_37.Item2)
series_11 = Series(Start=0, Step=1, Count=num_16)
series_12 = Series(Start=0, Step=1, Count=num_17)
series_13 = Series(Start=0, Step=1, Count=num_19)
series_14 = Series(Start=0, Step=1, Count=num_18)
num_24 = Number(item_37.Item8)
tstat_38 = TreeStatistics(Tree=clean_34)  # -> Paths, Length, Count
series_15 = Series(Start=0, Step=1, Count=num_21)
series_16 = Series(Start=0, Step=1, Count=num_20)
series_17 = Series(Start=0, Step=1, Count=num_22)
series_18 = Series(Start=0, Step=1, Count=num_23)
sift_21 = SiftPattern(List=tstat_27.Paths, SiftPattern=series_10)  # -> Output0, Output1
sift_22 = SiftPattern(List=tstat_28.Paths, SiftPattern=series_11)  # -> Output0, Output1, Output2
sift_23 = SiftPattern(List=tstat_29.Paths, SiftPattern=series_12)  # -> Output0, Output1
series_19 = Series(Start=0, Step=1, Count=num_24)
sift_24 = SiftPattern(List=tstat_35.Paths, SiftPattern=series_13)  # -> Output0, Output1, Output2
panel_90 = Panel(sift_24.Output0)
sift_25 = SiftPattern(List=tstat_30.Paths, SiftPattern=series_14)  # -> Output0, Output1
sift_26 = SiftPattern(List=tstat_33.Paths, SiftPattern=series_15)  # -> Output0, Output1
sift_27 = SiftPattern(List=tstat_34.Paths, SiftPattern=series_16)  # -> Output0, Output1
sift_28 = SiftPattern(List=tstat_37.Paths, SiftPattern=series_17)  # -> Output0, Output1
sift_29 = SiftPattern(List=tstat_36.Paths, SiftPattern=series_18)  # -> Output0, Output1
sift_30 = SiftPattern(List=tstat_38.Paths, SiftPattern=series_19)  # -> Output0, Output1
branch_46 = TreeBranch(Tree=clean_31, Path=sift_22.Output1, MaintainPaths=True)
branch_47 = TreeBranch(Tree=clean_31, Path=sift_22.Output0, MaintainPaths=True)
branch_48 = TreeBranch(Tree=clean_31, Path=sift_22.Output2, MaintainPaths=True)
branch_49 = TreeBranch(Tree=clean_32, Path=sift_23.Output0, MaintainPaths=True)
branch_50 = TreeBranch(Tree=clean_30, Path=sift_25.Output0, MaintainPaths=True)
branch_51 = TreeBranch(Tree=clean_32, Path=sift_23.Output1, MaintainPaths=True)
branch_52 = TreeBranch(Tree=clean_30, Path=sift_25.Output1, MaintainPaths=True)
branch_53 = TreeBranch(Tree=clean_33, Path=sift_21.Output0, MaintainPaths=True)
branch_54 = TreeBranch(Tree=clean_33, Path=sift_21.Output1, MaintainPaths=True)
branch_55 = TreeBranch(Tree=clean_35, Path=sift_26.Output0, MaintainPaths=True)
branch_56 = TreeBranch(Tree=clean_29, Path=sift_27.Output0, MaintainPaths=True)
branch_57 = TreeBranch(Tree=clean_35, Path=sift_26.Output1, MaintainPaths=True)
branch_58 = TreeBranch(Tree=clean_29, Path=sift_27.Output1, MaintainPaths=True)
branch_59 = TreeBranch(Tree=clean_26, Path=sift_24.Output0, MaintainPaths=True)
branch_60 = TreeBranch(Tree=clean_26, Path=sift_24.Output1, MaintainPaths=True)
branch_61 = TreeBranch(Tree=clean_26, Path=sift_24.Output1, MaintainPaths=True)
branch_62 = TreeBranch(Tree=clean_28, Path=sift_29.Output1, MaintainPaths=True)
branch_63 = TreeBranch(Tree=clean_28, Path=sift_29.Output0, MaintainPaths=True)
branch_64 = TreeBranch(Tree=clean_27, Path=sift_28.Output1, MaintainPaths=True)
branch_65 = TreeBranch(Tree=clean_27, Path=sift_28.Output0, MaintainPaths=True)
branch_66 = TreeBranch(Tree=clean_34, Path=sift_30.Output1, MaintainPaths=True)
branch_67 = TreeBranch(Tree=clean_34, Path=sift_30.Output0, MaintainPaths=True)
item_42 = ListItem(List=branch_47, Index=0, Wrap=True)  # -> Item, Item1, Item2
item_43 = ListItem(List=branch_46, Index=0, Wrap=True)  # -> Item, Item1, Item2
item_44 = ListItem(List=branch_50, Index=0, Wrap=True)  # -> Item, Item1
item_45 = ListItem(List=branch_52, Index=0, Wrap=True)  # -> Item, Item1
item_46 = ListItem(List=branch_49, Index=0, Wrap=True)  # -> Item, Item1
item_47 = ListItem(List=branch_51, Index=0, Wrap=False)  # -> Item, Item1, Item2
item_48 = ListItem(List=branch_57, Index=0, Wrap=False)  # -> Item, Item1
item_49 = ListItem(List=branch_55, Index=0, Wrap=False)  # -> Item, Item1

A_2 = Number(branch_59)
B_2 = Number(branch_61)
C_2 = Number(branch_60)
equals_15 = Equality(FirstNumber=A_2, SecondNumber="0")  # -> Equality, Inequality
equals_16 = Equality(FirstNumber=B_2, SecondNumber="0")  # -> Equality, Inequality
and_9 = GateAnd(A=equals_15.Inequality, B=equals_16.Inequality)
sift_31 = SiftPattern(List=A_2, SiftPattern=and_9)  # -> Output0, Output1
sift_32 = SiftPattern(List=B_2, SiftPattern=and_9)  # -> Output0, Output1
sift_33 = SiftPattern(List=C_2, SiftPattern=and_9)  # -> Output0, Output1
eval_26 = Evaluate(F="{A,B,C}", A=sift_31.Output1, B=sift_32.Output1, C=sift_33.Output1)
panel_91 = Panel(eval_26)

item_50 = ListItem(List=branch_67, Index=0, Wrap=False)  # -> Item, Item1

k_2 = Number(branch_56)
b_2 = Number(branch_58)
eval_27 = Evaluate(F="{k,-1,b}", k=k_2, b=b_2)
panel_92 = Panel(eval_27)

item_51 = ListItem(List=branch_66, Index=0, Wrap=False)  # -> Item, Item1
panel_93 = Panel(item_42.Item2)

eval_28 = Evaluate(
    F="{m*A0+A1,m*B0+B1,m*C0+C1}",
    A0=item_42.Item,
    B0=item_42.Item1,
    C0=item_42.Item2,
    A1=item_43.Item,
    B1=item_43.Item1,
    C1=item_43.Item2,
    m=branch_48)
panel_94 = Panel(eval_28)

item_52 = ListItem(List=branch_64, Index=0, Wrap=True)  # -> Item, Item1
k_3 = Number(branch_65)
x0_3 = Number(item_52.Item)
y0_3 = Number(item_52.Item1)
eval_29 = Evaluate(F="{k,-1,y0-k*x0}", k=k_3, x0=x0_3, y0=y0_3)
panel_95 = Panel(eval_29)

x0_4 = Number(item_44.Item)
y0_4 = Number(item_44.Item1)
x1_2 = Number(item_45.Item)
y1_2 = Number(item_45.Item1)
eval_30 = Evaluate(F="{x0-x1,y1-y0,x0*x1-y0*y1-x0*x0+y0*y0}", x0=x0_4, y0=y0_4, x1=x1_2, y1=y1_2)
panel_96 = Panel(eval_30)

y0_5 = Number(item_46.Item1)
a2 = Number(item_47.Item)
x0_5 = Number(item_46.Item)
b2 = Number(item_47.Item1)
c2 = Number(item_47.Item2)
eval_31 = Evaluate(F="{A2,B2,-A2*x0-B2*y0}", A2=a2, B2=b2, C2=c2, x0=x0_5, y0=y0_5)
panel_97 = Panel(eval_31)

angle_5 = Number(branch_53)
distance_p_2 = Number(branch_54)
pi_10 = Pi(Factor=1)
division_5 = Division(A=angle_5, B=pi_10)
int_21 = Integer(division_5)
subtraction_5 = Subtraction(A=division_5, B=int_21)
abs_3 = Absolute(Value=subtraction_5)
larger_5 = LargerThan(FirstNumber=abs_3, SecondNumber="0.000001")  # -> LargerThan, OrEqualTo
sift_34 = SiftPattern(List=angle_5, SiftPattern=larger_5.LargerThan)  # -> Output0, Output1
sift_35 = SiftPattern(List=distance_p_2, SiftPattern=larger_5.LargerThan)  # -> Output0, Output1
eval_32 = Evaluate(F="{cos(angle),sin(angle),-p}", angle=sift_34.Output1, p=sift_35.Output1)
panel_98 = Panel(eval_32)

a_2 = Number(branch_63)
b_3 = Number(branch_62)
equals_17 = Equality(FirstNumber=b_3, SecondNumber="0")  # -> Equality, Inequality
equals_18 = Equality(FirstNumber=a_2, SecondNumber="0")  # -> Equality, Inequality
and_10 = GateAnd(A=equals_18.Inequality, B=equals_17.Inequality)
sift_36 = SiftPattern(List=a_2, SiftPattern=and_10)  # -> Output0, Output1
sift_37 = SiftPattern(List=b_3, SiftPattern=and_10)  # -> Output0, Output1
eval_33 = Evaluate(F="{b,a,-a*b}", a=sift_36.Output1, b=sift_37.Output1)
panel_99 = Panel(eval_33)

x0_6 = Number(item_50.Item)
y0_6 = Number(item_50.Item1)
u_2 = Number(item_51.Item)
v_2 = Number(item_51.Item1)
equals_19 = Equality(FirstNumber=u_2, SecondNumber="0")  # -> Equality, Inequality
equals_20 = Equality(FirstNumber=v_2, SecondNumber="0")  # -> Equality, Inequality
and_11 = GateAnd(A=equals_19.Inequality, B=equals_20.Inequality)
sift_38 = SiftPattern(List=v_2, SiftPattern=and_11)  # -> Output0, Output1
sift_39 = SiftPattern(List=u_2, SiftPattern=and_11)  # -> Output0, Output1
eval_34 = Evaluate(F="{v,-u,-v*x0+u*y0}", x0=x0_6, y0=y0_6, u=sift_39.Output1, v=sift_38.Output1)
panel_100 = Panel(eval_34)

x0_7 = Number(item_49.Item)
y0_7 = Number(item_49.Item1)
nu2 = Number(item_48.Item1)
nu1 = Number(item_48.Item)
equals_21 = Equality(FirstNumber=nu2, SecondNumber="0")  # -> Equality, Inequality
equals_22 = Equality(FirstNumber=nu1, SecondNumber="0")  # -> Equality, Inequality
and_12 = GateAnd(A=equals_22.Inequality, B=equals_21.Inequality)
sift_40 = SiftPattern(List=nu2, SiftPattern=and_12)  # -> Output0, Output1
sift_41 = SiftPattern(List=nu1, SiftPattern=and_12)  # -> Output0, Output1
eval_35 = Evaluate(F="{nu,nv,-nu*x0-nv*y0}", x0=x0_7, y0=y0_7, nu=sift_41.Output1, nv=sift_40.Output1)

path_mapper_2 = PathMapper(eval_28, source="{A;B;C;D}", target="{A;B;0}")
path_mapper_3 = PathMapper(eval_33, source="{A;B;C;D}", target="{A;B;0}")
path_mapper_4 = PathMapper(eval_27, source="{A;B;C;D}", target="{A;B;0}")
panel_101 = Panel(mindex_6.Index)
path_mapper_5 = PathMapper(eval_30, source="{A;B;C;D}", target="{A;B;0}")
path_mapper_6 = PathMapper(eval_29, source="{A;B;C;D}", target="{A;B;0}")
pshift_9 = ShiftPaths(Data=eval_26, Offset=-1)
path_mapper_7 = PathMapper(eval_31, source="{A;B;C;D}", target="{A;B;0}")
panel_102 = Panel(eval_35)
path_mapper_8 = PathMapper(eval_34, source="{A;B;C;D}", target="{A;B;0}")
panel_103 = Panel(pshift_9)
pdecon_5 = Deconstruct(Point=pshift_9)  # -> XComponent, YComponent, ZComponent
graft_43 = GraftTree(Tree=pshift_9, IncludeEmptyLists=True, IncludeNullItems=True)
panel_104 = Panel(path_mapper_6)
path_mapper_9 = PathMapper(eval_32, source="{A;B;C;D}", target="{A;B;0}")
path_mapper_10 = PathMapper(pdecon_5.XComponent, source="{A;B;C}", target="{A;B;0}")
path_mapper_11 = PathMapper(pdecon_5.YComponent, source="{A;B;C}", target="{A;B;1}")
path_mapper_12 = PathMapper(pdecon_5.ZComponent, source="{A;B;C}", target="{A;B;2}")
path_mapper_13 = PathMapper(eval_26, source="{A;B;C;D}", target="{A;B;0;0;0}")
panel_105 = Panel(path_mapper_8)
panel_106 = Panel(path_mapper_12)
panel_107 = Panel(path_mapper_13)
panel_108 = Panel("描述方法只是数据结构的不同，先用几何代表抽象的数据结构")
panel_109 = Panel("""x0,y0;0,1,2,3
x1,y0;0,3,2""")
panel_110 = Panel("""多条线且含有多折线连线组织数据结构问题
得到交点
交点的path替换""")
crv = Curve([<curve referenced from the Rhino model> x3])
crv_2 = Curve([<curve referenced from the Rhino model> x3])
explode = Explode(Curve=crv_2, Recursive=True)  # -> Segments, Vertices
end = EndPoints(Curve=crv_2)  # -> Start, End
neg_4 = Negative(Value="1")
shift_2 = ShiftList(List=explode.Vertices, Shift="1", Wrap=False)
shift_3 = ShiftList(List=explode.Vertices, Shift=neg_4, Wrap=False)

panel_111 = Panel("""1,0
0,1
-1,0
0,-1""")
vec = Vector(panel_111)

# ----
# describe space by (point;index) of vector
md_slider = MDSlider(
    slider_value=Point(0.5591201782, 0.4691162109, 0.5),
    SliderMode=0,
    x_domain=Domain(-1000, 1000),
    y_domain=Domain(-1000, 1000),
    z_domain=Domain(0, 1))
panel_112 = Panel("""0
1
2
3""")
line_length = Panel("""3.2
5.1
3.2
5.1""")
line_length_2 = Number(line_length)
int_22 = Integer(panel_112)
lng_9 = ListLength(List=int_22)
series_20 = Series(Start=0, Step=1, Count=lng_9)
item_53 = ListItem(List=vec, Index=int_22, Wrap=True)
item_54 = ListItem(List=line_length_2, Index=series_20, Wrap=True)
basicvectorunit = Vector(item_53)
amp = Amplitude(Vector=basicvectorunit, Amplitude=item_54)
ma_4 = MassAddition(Input=amp)  # -> Result, PartialResults
addition_2 = Addition(A=md_slider, B=ma_4.PartialResults)
pt = Point(addition_2)
shift_4 = ShiftList(List=ma_4.PartialResults, Shift=-1, Wrap=True)
complex_5 = ComplexComponents(Complex=shift_4)  # -> Real, Imaginary
concat_2 = Concatenate(FragmentA=complex_5.Real, FragmentB=complex_5.Imaginary, JoinSeparator=",")
pline = PolyLine(Vertices=pt, Closed=True)
concat_3 = Concatenate(FragmentA=concat_2, FragmentB=int_22, JoinSeparator=";")

subtraction_6 = Subtraction(A=shift_2, B=shift_3)

graft_44 = GraftTree(Tree=end.Start, IncludeEmptyLists=True, IncludeNullItems=True)  # -> simplify(Tree)
subtraction_7 = Subtraction(A=graft_44, B="{0,0,0}")  # -> flatten(Result)
item_55 = ListItem(List=subtraction_7, Index="0", Wrap=True)
subtraction_8 = Subtraction(A=graft_44, B=item_55)

unit = UnitVector(Vector=subtraction_6)
vec_2 = Vector(subtraction_6)
len = Length(Curve=explode.Segments)  # -> simplify(Length)

panel_113 = Panel("""{A,B,C}
{k,-1,y0-k*x0}
{b,a,-a*b}
{k,-1,b}
{x0-x1,y1-y0,x0*x1-y0*y1-x0*x0+y0*y0}
{m*A0+A1,m*B0+B1,m*C0+C1}
{A2,B2,-A2*x0-B2*y0}
{cos(angle),sin(angle),-p}
{v,-u,-v*x0+u*y0}
{nu,nv,-nu*x0-nv*y0}""")
sift_42 = SiftPattern(List=num_11, SiftPattern=parametersindex_tree)  # -> Output0, Output1, Output2, Output3, Output4, Output5, Output6, Output7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
item_56 = ListItem(List=panel_113, Index=functionindex, Wrap=True)
pshift_10 = ShiftPaths(Data=item_56, Offset=-1)
clean_36 = CleanTree(RemoveNulls=True, RemoveInvalid=True, RemoveEmpty=True, Tree=sift_42.Output0)
clean_37 = CleanTree(RemoveNulls=True, RemoveInvalid=True, RemoveEmpty=True, Tree=sift_42.Output1)
clean_38 = CleanTree(RemoveNulls=True, RemoveInvalid=True, RemoveEmpty=True, Tree=sift_42.Output2)
clean_39 = CleanTree(RemoveNulls=True, RemoveInvalid=True, RemoveEmpty=True, Tree=sift_42.Output3)
clean_40 = CleanTree(RemoveNulls=True, RemoveInvalid=True, RemoveEmpty=True, Tree=sift_42.Output4)
clean_41 = CleanTree(RemoveNulls=True, RemoveInvalid=True, RemoveEmpty=True, Tree=sift_42.Output5)
clean_42 = CleanTree(RemoveNulls=True, RemoveInvalid=True, RemoveEmpty=True, Tree=sift_42.Output6)
clean_43 = CleanTree(RemoveNulls=True, RemoveInvalid=True, RemoveEmpty=True, Tree=sift_42.Output7)
clean_44 = CleanTree(RemoveNulls=True, RemoveInvalid=True, RemoveEmpty=True, Tree=sift_42.Output8)
clean_45 = CleanTree(RemoveNulls=True, RemoveInvalid=True, RemoveEmpty=True, Tree=sift_42.Output9)
clean_46 = CleanTree(RemoveNulls=True, RemoveInvalid=True, RemoveEmpty=True, Tree=sift_42.Output10)
clean_47 = CleanTree(RemoveNulls=True, RemoveInvalid=True, RemoveEmpty=True, Tree=sift_42.Output11)
clean_48 = CleanTree(RemoveNulls=True, RemoveInvalid=True, RemoveEmpty=True, Tree=sift_42.Output12)
clean_49 = CleanTree(RemoveNulls=True, RemoveInvalid=True, RemoveEmpty=True, Tree=sift_42.Output13)
clean_50 = CleanTree(RemoveNulls=True, RemoveInvalid=True, RemoveEmpty=True, Tree=sift_42.Output14)
clean_51 = CleanTree(RemoveNulls=True, RemoveInvalid=True, RemoveEmpty=True, Tree=sift_42.Output15)
clean_52 = CleanTree(RemoveNulls=True, RemoveInvalid=True, RemoveEmpty=True, Tree=sift_42.Output16)
clean_53 = CleanTree(RemoveNulls=True, RemoveInvalid=True, RemoveEmpty=True, Tree=sift_42.Output17)
clean_54 = CleanTree(RemoveNulls=True, RemoveInvalid=True, RemoveEmpty=True, Tree=sift_42.Output18)
clean_55 = CleanTree(RemoveNulls=True, RemoveInvalid=True, RemoveEmpty=True, Tree=sift_42.Output19)
clean_56 = CleanTree(RemoveNulls=True, RemoveInvalid=True, RemoveEmpty=True, Tree=sift_42.Output20)
clean_57 = CleanTree(RemoveNulls=True, RemoveInvalid=True, RemoveEmpty=True, Tree=sift_42.Output21)
clean_58 = CleanTree(RemoveNulls=True, RemoveInvalid=True, RemoveEmpty=True, Tree=sift_42.Output22)
clean_59 = CleanTree(RemoveNulls=True, RemoveInvalid=True, RemoveEmpty=True, Tree=sift_42.Output23)
clean_60 = CleanTree(RemoveNulls=True, RemoveInvalid=True, RemoveEmpty=True, Tree=sift_42.Output24)
clean_61 = CleanTree(RemoveNulls=True, RemoveInvalid=True, RemoveEmpty=True, Tree=sift_42.Output25)
pshift_11 = ShiftPaths(Data=clean_52, Offset="-2")
pshift_12 = ShiftPaths(Data=clean_36, Offset="-2")
pshift_13 = ShiftPaths(Data=clean_38, Offset="-2")
pshift_14 = ShiftPaths(Data=clean_39, Offset="-2")
pshift_15 = ShiftPaths(Data=clean_41, Offset="-2")
pshift_16 = ShiftPaths(Data=clean_42, Offset="-2")
pshift_17 = ShiftPaths(Data=clean_43, Offset="-2")
pshift_18 = ShiftPaths(Data=clean_44, Offset="-2")
pshift_19 = ShiftPaths(Data=clean_45, Offset="-2")
pshift_20 = ShiftPaths(Data=clean_46, Offset="-2")
pshift_21 = ShiftPaths(Data=clean_47, Offset="-2")
pshift_22 = ShiftPaths(Data=clean_48, Offset="-2")
pshift_23 = ShiftPaths(Data=clean_49, Offset="-2")
pshift_24 = ShiftPaths(Data=clean_50, Offset="-2")
pshift_25 = ShiftPaths(Data=clean_51, Offset="-2")
pshift_26 = ShiftPaths(Data=clean_53, Offset="-2")
pshift_27 = ShiftPaths(Data=clean_54, Offset="-2")
pshift_28 = ShiftPaths(Data=clean_55, Offset="-2")
pshift_29 = ShiftPaths(Data=clean_56, Offset="-2")
pshift_30 = ShiftPaths(Data=clean_57, Offset="-2")
pshift_31 = ShiftPaths(Data=clean_58, Offset="-2")
pshift_32 = ShiftPaths(Data=clean_59, Offset="-2")
pshift_33 = ShiftPaths(Data=clean_60, Offset="-2")
pshift_34 = ShiftPaths(Data=clean_61, Offset="-2")
pshift_35 = ShiftPaths(Data=clean_37, Offset="-2")
pshift_36 = ShiftPaths(Data=clean_40, Offset="-2")
eval_36 = Evaluate(
    F=pshift_10,
    A=pshift_12,
    B=pshift_35,
    C=pshift_13,
    k=pshift_14,
    a=pshift_36,
    b=pshift_15,
    x0=pshift_16,
    y0=pshift_17,
    x1=pshift_18,
    y1=pshift_19,
    A0=pshift_20,
    B0=pshift_21,
    C0=pshift_22,
    A1=pshift_23,
    B1=pshift_24,
    C1=pshift_25,
    m=pshift_11,
    A2=pshift_26,
    B2=pshift_27,
    C2=pshift_28,
    angle=pshift_29,
    p=pshift_30,
    u=pshift_31,
    v=pshift_32,
    nu=pshift_33,
    nv=pshift_34)

pshift_37 = ShiftPaths(Data=unit, Offset=-1)
mindex_7 = MemberIndex(Set=vec, Member=pshift_37)  # -> Index, Count
vdis = VectorDisplay(Anchor=shift_3, Vector=vec_2)
pshift_38 = ShiftPaths(Data=mindex_7.Index, Offset=-1)  # -> simplify(Data)

vecdirection = Integer(pshift_38)
veclength = Number(len)
pt_2 = Point(graft_44)

panel_114 = Panel(vec)
item_57 = ListItem(List=vec, Index=vecdirection, Wrap=True)
amp_2 = Amplitude(Vector=item_57, Amplitude=veclength)
ma_5 = MassAddition(Input=amp_2)  # -> Result, PartialResults
addition_3 = Addition(A=pt_2, B=ma_5.PartialResults)
pt_3 = Point(addition_3)
ins_9 = InsertItems(List=addition_3, Item=pt_2, Indices="0", Wrap=True)
neg_5 = Negative(Value="1")
panel_115 = Panel(pt_2)
panel_116 = Panel(concat_3)
panel_117 = Panel(amp)
shift_5 = ShiftList(List=ins_9, Shift=neg_5, Wrap=False)  # -> simplify(List)

# ----
# tree data trial
# first point 和 end point 的数据结构组织的方式是同一种的
# 
# 先手工傻做，再寻找规律
# 
# 先不管结构如何，把他们放在一起，结构在外部运算，在替换成对的树形数据
# 上升数据结构后手工或者数列
# 上升后全部拍平处理
# 用stack+listItem对拍平的数据处理
# 
# 留下来的问题是数据结构的替换
# 手工
pt_4 = Point(shift_5)
graft_45 = GraftTree(Tree=pt_4, IncludeEmptyLists=True, IncludeNullItems=True)

flatten_33 = FlattenTree(Tree=graft_45, Path="{0}")
tstat_39 = TreeStatistics(Tree=pt_4)  # -> Paths, Length, Count
tstat_40 = TreeStatistics(Tree=graft_45)  # -> Paths, Length, Count
ma_6 = MassAddition(Input=tstat_39.Length)  # -> Result, PartialResults
series_21 = Series(Start=0, Step=1, Count=tstat_40.Count)
stack_20 = StackData(Data=ma_6.PartialResults, Stack=tstat_39.Length)
shift_6 = ShiftList(List=series_21, Shift=stack_20, Wrap=False)
item_58 = ListItem(List=flatten_33, Index=shift_6, Wrap=True)  # -> simplify(Item)

lng_10 = ListLength(List=item_58)

bang_2 = ExplodeTree(Data=graft_45)  # -> Branch0, Branch1, Branch2, Branch3, Branch4, Branch5
merge_14 = Merge(Data1=bang_2.Branch1, Data2=bang_2.Branch2, Data3=bang_2.Branch3, Data4=bang_2.Branch4, Data5=bang_2.Branch5)
entwine = Entwine(
    Branch00=merge_14,
    Branch01=bang_2.Branch5,
    Branch02=bang_2.Branch5,
    Branch03=bang_2.Branch5,
    Branch04=bang_2.Branch5,
    FlattenInputs=True)

stack_21 = StackData(Data=graft_45, Stack=lng_10)
shift_7 = ShiftList(List=ins_9, Shift="1", Wrap=False)  # -> simplify(List)
graft_46 = GraftTree(Tree=stack_21, IncludeEmptyLists=True, IncludeNullItems=True)
graft_47 = GraftTree(Tree=shift_5, IncludeEmptyLists=True, IncludeNullItems=True)

flatten_34 = FlattenTree(Tree=graft_47, Path="{0}")
tstat_41 = TreeStatistics(Tree=shift_5)  # -> Paths, Length, Count
tstat_42 = TreeStatistics(Tree=graft_47)  # -> Paths, Length, Count
ma_7 = MassAddition(Input=tstat_41.Length)  # -> Result, PartialResults
series_22 = Series(Start=0, Step=1, Count=tstat_42.Count)
stack_22 = StackData(Data=ma_7.PartialResults, Stack=tstat_41.Length)
shift_8 = ShiftList(List=series_22, Shift=stack_22, Wrap=False)
viewer_17 = ParamViewer()
item_59 = ListItem(List=flatten_34, Index=shift_8, Wrap=True)  # -> simplify(Item)
replace_18 = ReplacePaths(Data=item_59, Search=viewer_17)

graft_48 = GraftTree(Tree=shift_7, IncludeEmptyLists=True, IncludeNullItems=True)

# ----
# kernel tree data
flatten_35 = FlattenTree(Tree=graft_48, Path="{0}")
tstat_43 = TreeStatistics(Tree=shift_7)  # -> Paths, Length, Count
tstat_44 = TreeStatistics(Tree=graft_48)  # -> Paths, Length, Count
ma_8 = MassAddition(Input=tstat_43.Length)  # -> Result, PartialResults
series_23 = Series(Start=0, Step=1, Count=tstat_44.Count)
stack_23 = StackData(Data=ma_8.PartialResults, Stack=tstat_43.Length)
shift_9 = ShiftList(List=series_23, Shift=stack_23, Wrap=False)
item_60 = ListItem(List=flatten_35, Index=shift_9, Wrap=True)  # -> simplify(Item)
viewer_18 = ParamViewer()
replace_19 = ReplacePaths(Data=item_60, Search=viewer_18)

addition_4 = Addition(A=pt_2)

viewer_19 = ParamViewer()
replace_20 = ReplacePaths(Data=item_58, Search=viewer_19)

firstpt_line0 = Point(graft_47)
firstpt_line1 = Point(item_59)
endpt_line0 = Point(graft_48)
endpt_line1 = Point(item_60)

graft_49 = GraftTree(Tree=item_58, IncludeEmptyLists=True, IncludeNullItems=True)

# ----
# f(x) revise beta1
panel_118 = Panel("""4
3
7""")
graft_50 = GraftTree(Tree=panel_118, IncludeEmptyLists=True, IncludeNullItems=True)
panel_119 = Panel("""9
6
3""")
panel_120 = Panel("""4
2
7""")
panel_121 = Panel("""x+y
x+2*y
x*y""")
path_21 = ConstructPath(Indices=graft_50)
graft_51 = GraftTree(Tree=panel_119, IncludeEmptyLists=True, IncludeNullItems=True)
graft_52 = GraftTree(Tree=panel_120, IncludeEmptyLists=True, IncludeNullItems=True)
item_61 = ListItem(List=panel_121, Index=graft_50, Wrap=True)
flatten_36 = FlattenTree(Tree=path_21, Path="{0}")
viewer_20 = ParamViewer(graft_51)
viewer_21 = ParamViewer(graft_52)
viewer_22 = ParamViewer(item_61)
replace_21 = ReplacePaths(Data=graft_51, Search=viewer_20, Replace=flatten_36)
replace_22 = ReplacePaths(Data=graft_52, Search=viewer_21, Replace=flatten_36)
replace_23 = ReplacePaths(Data=item_61, Search=viewer_22, Replace=flatten_36)
eval_37 = Evaluate(F=replace_23, x=replace_22, y=replace_21)
panel_122 = Panel(replace_23)
panel_123 = Panel(eval_37)

# ----
# f(x) revise beta 02
panel_124 = Panel("""4
3
7
1
3""")
panel_125 = Panel("""4
3
7""")
int_23 = Integer(panel_125)
int_24 = Integer(panel_124)
graft_53 = GraftTree(Tree=int_23, IncludeEmptyLists=True, IncludeNullItems=True)
graft_54 = GraftTree(Tree=int_24, IncludeEmptyLists=True, IncludeNullItems=True)
panel_126 = Panel("""9
6
3
4
2""")
panel_127 = Panel("""x+y
x+2*y
x*y""")
panel_128 = Panel("""4
2
7
4
3""")
path_22 = ConstructPath(Indices=graft_53)
path_23 = ConstructPath(Indices=graft_54)
graft_55 = GraftTree(Tree=panel_126, IncludeEmptyLists=True, IncludeNullItems=True)
graft_56 = GraftTree(Tree=panel_128, IncludeEmptyLists=True, IncludeNullItems=True)
graft_57 = GraftTree(Tree=panel_127, IncludeEmptyLists=True, IncludeNullItems=True)
flatten_37 = FlattenTree(Tree=path_22, Path="{0}")
flatten_38 = FlattenTree(Tree=path_23, Path="{0}")
viewer_23 = ParamViewer(graft_56)
viewer_24 = ParamViewer(graft_55)
viewer_25 = ParamViewer(graft_57)
replace_24 = ReplacePaths(Data=graft_56, Search=viewer_23, Replace=flatten_38)
replace_25 = ReplacePaths(Data=graft_55, Search=viewer_24, Replace=flatten_38)
replace_26 = ReplacePaths(Data=graft_57, Search=viewer_25, Replace=flatten_37)
branch_68 = TreeBranch(Tree=replace_25, Path=flatten_37, MaintainPaths=True)
branch_69 = TreeBranch(Tree=replace_24, Path=flatten_37, MaintainPaths=True)
panel_129 = Panel(graft_57)
eval_38 = Evaluate(F=replace_26, x=branch_69, y=branch_68)
panel_130 = Panel(replace_26)
panel_131 = Panel(branch_69)
panel_132 = Panel(eval_38)
panel_133 = Panel(branch_68)

# ----
# explore a point position in space
line_4 = Line([Line((120.4046894, -60.83579072, 0), (120.4046894, -60.79145643, 0)), Line((120.3917346, -60.82485109, 0), (120.420811, -60.82485109, 0))])
panel_134 = Panel("""处理k不存在的情况

写成函数
把坐标在相减后就分开来算

对实交和虚交的算法 不够缜密""")
# debug:可以做，但是要改动很多，先放放，出现问题了再来
linelist = Curve(line_4)
end_2 = EndPoints(Curve=linelist)  # -> Start, End
subtraction_9 = Subtraction(A=end_2.End, B=end_2.Start)
xy = XYPlane(Origin=Point(0, 0, 0))

startpoint = Point(end_2.Start)
vec_3 = Vector(subtraction_9)

addition_5 = Addition(A=startpoint, B=vec_3)
endpoint = Point(addition_5)
lng_11 = ListLength(List=addition_5)
lng_12 = ListLength(List=startpoint)
subtraction_10 = Subtraction(A=lng_11, B="1")
subtraction_11 = Subtraction(A=lng_12, B="1")
series_24 = Series(Start=0, Step=1, Count=subtraction_11)
series_25 = Series(Start=0, Step=1, Count=subtraction_10)
addition_6 = Addition(A=series_24, B="1")
addition_7 = Addition(A=series_25, B="1")
item_62 = ListItem(List=startpoint, Index=series_24, Wrap=False)  # -> simplify(graft(Item))
item_63 = ListItem(List=addition_5, Index=series_25, Wrap=False)  # -> simplify(graft(Item))
shift_10 = ShiftList(List=addition_5, Shift=addition_7, Wrap=False)  # -> simplify(List)
shift_11 = ShiftList(List=startpoint, Shift=addition_6, Wrap=False)  # -> simplify(List)

firstpt_line0_2 = Point(item_62)
firstpt_line1_2 = Point(shift_11)
endpt1_line1 = Point(shift_10)
endpt_line0_2 = Point(item_63)

points = PointList(Points=flatten(firstpt_line0_2), Size=Slider(6, range=0..100))

complex_6 = ComplexComponents(Complex=firstpt_line0_2)  # -> Real, Imaginary
complex_7 = ComplexComponents(Complex=endpt_line0_2)  # -> Real, Imaginary
complex_8 = ComplexComponents(Complex=firstpt_line1_2)  # -> Real, Imaginary
complex_9 = ComplexComponents(Complex=endpt1_line1)  # -> Real, Imaginary
subtraction_12 = Subtraction(A=complex_8.Imaginary, B=complex_9.Imaginary)
subtraction_13 = Subtraction(A=complex_8.Real, B=complex_9.Real)
subtraction_14 = Subtraction(A=complex_6.Real, B=complex_7.Real)
subtraction_15 = Subtraction(A=complex_6.Imaginary, B=complex_7.Imaginary)
division_6 = Division(A=subtraction_12, B=subtraction_13)
division_7 = Division(A=subtraction_15, B=subtraction_14)
k1 = Number(division_7)
k2 = Number(division_6)
multiplication_5 = Multiplication(A=k2, B=complex_8.Real)
subtraction_16 = Subtraction(A=complex_8.Imaginary, B=multiplication_5)
b2_2 = Number(subtraction_16)
subtraction_17 = Subtraction(A=k1, B=k2)

multiplication_6 = Multiplication(A=k1, B=complex_6.Real)
subtraction_18 = Subtraction(A=complex_6.Imaginary, B=multiplication_6)

equals_23 = Equality(FirstNumber=subtraction_13, SecondNumber="0")  # -> Equality, Inequality
equals_24 = Equality(FirstNumber=subtraction_14, SecondNumber="0")  # -> Equality, Inequality
sift_43 = SiftPattern(List=complex_9.Real, SiftPattern=equals_23.Equality)  # -> Output0, Output1
sift_44 = SiftPattern(List=complex_6.Real, SiftPattern=equals_24.Equality)  # -> Output0, Output1
or = GateOr(A=equals_24.Equality, B=equals_23.Equality)
combine = CombineData(Input0=sift_44.Output1, Input1=sift_43.Output1)  # -> Result, Index
sift_45 = SiftPattern(List=k2, SiftPattern=equals_23.Equality)  # -> Output0, Output1
sift_46 = SiftPattern(List=b2_2, SiftPattern=equals_23.Equality)  # -> Output0, Output1
sift_47 = SiftPattern(List=k1, SiftPattern=equals_24.Equality)  # -> Output0, Output1
combine_2 = CombineData(Input0=sift_47.Output0, Input1=sift_45.Output0)  # -> Result, Index
a_3 = Number(combine.Result)
k_4 = Number(combine_2.Result)
multiplication_7 = Multiplication(A=a_3, B=k_4)
intersection_x = Number(a_3)

b1 = Number(subtraction_18)
subtraction_19 = Subtraction(A=b2_2, B=b1)
division_8 = Division(A=subtraction_19, B=subtraction_17)
multiplication_8 = Multiplication(A=division_8, B=k2)
addition_8 = Addition(A=multiplication_8, B=b2_2)
sift_48 = SiftPattern(List=addition_8, SiftPattern=or)  # -> Output0, Output1

sift_49 = SiftPattern(List=b1, SiftPattern=equals_24.Equality)  # -> Output0, Output1
combine_3 = CombineData(Input0=sift_49.Output0, Input1=sift_46.Output0)  # -> Result, Index
b_4 = Number(combine_3.Result)
sift_50 = SiftPattern(List=b_4, SiftPattern=or)  # -> Output0, Output1
addition_9 = Addition(A=multiplication_7, B=sift_50.Output1)
intersection_y = Number(addition_9)

combine_4 = CombineData(Input0=sift_48.Output0, Input1=intersection_y)  # -> Result, Index
combine_5 = CombineData(Input0=division_8, Input1=intersection_x)  # -> Result, Index

panel_135 = Panel(equals_24.Equality)
intersection_x_2 = Number(combine_5.Result)
intersection_y_2 = Number(combine_4.Result)
pt_5 = PointOriented(BasePlane=xy, UComponent=intersection_x_2, VComponent=intersection_y_2, WComponent=0)

# ----
# true --> real insection
# false --> extend
# 10,11 --> real insection
# 01       --> extend one line
# 00       --> extend two lines
# true   -- > extend one line
# false -->  extend two lines
dom = ConstructDomain(DomainStart=complex_6.Imaginary, DomainEnd=complex_7.Imaginary)
dom_2 = ConstructDomain(DomainStart=complex_6.Real, DomainEnd=complex_7.Real)
dom_3 = ConstructDomain(DomainStart=complex_8.Real, DomainEnd=complex_9.Real)
dom_4 = ConstructDomain(DomainStart=complex_8.Imaginary, DomainEnd=complex_9.Imaginary)
firstpty_domain = Domain(dom)
firstptx_domain = Domain(dom_2)
endpty_domain = Domain(dom_4)
endptx_domain = Domain(dom_3)
inc = Includes(Value=intersection_y_2, Domain=firstpty_domain)  # -> Includes, Deviation
inc_2 = Includes(Value=intersection_x_2, Domain=endptx_domain)  # -> Includes, Deviation
inc_3 = Includes(Value=intersection_y_2, Domain=endpty_domain)  # -> Includes, Deviation
inc_4 = Includes(Value=intersection_x_2, Domain=firstptx_domain)  # -> Includes, Deviation
or_2 = GateOr(A=inc_4.Includes, B=inc.Includes, C=inc_2.Includes, D=inc_3.Includes)
and_13 = GateAnd(A=inc_4.Includes, B=inc.Includes, C=inc_2.Includes, D=inc_3.Includes)
int_25 = Integer(or_2)
int_26 = Integer(and_13)
concat_4 = Concatenate(FragmentA=int_26, FragmentB=int_25)
panel_136 = Panel("""10
11
01
00""")
panel_137 = Panel("""0
0
1
2""")
keysearch_4 = KeyValueSearch(Keys=panel_136, Values=panel_137, Search=concat_4)
extendlinecount = Integer(keysearch_4)

sift_51 = SiftPattern(List=pt_5, SiftPattern=extendlinecount)  # -> Output0, Output1, Output2
intersectionontwolines = Point(sift_51.Output0)
intersectionononeline = Point(sift_51.Output1)
intersectiononextend = Point(sift_51.Output2)
panel_138 = Panel(intersectionontwolines)

# ----
# failure try
panel_139 = Panel("""{A,B,C}
{k,-1,y0-k*x0}
{b,a,-a*b}
{k,-1,b}
{x0-x1,y1-y0,x0*x1-y0*y1-x0*x0+y0*y0}
{m*A0+A1,m*B0+B1,m*C0+C1}
{A2,B2,-A2*x0-B2*y0}
{cos(angle),sin(angle),-p}
{v,-u,-v*x0+u*y0}
{nu,nv,-nu*x0-nv*y0}""")
panel_140 = Panel(eval_36)

item_64 = ListItem(List=panel_139, Index=functionindex, Wrap=True)
eval_39 = Evaluate(F=item_64)
panel_141 = Panel(eval_39)

panel_142 = Panel(item_64)

firstpt0 = Point(firstpt_line0)
firstpt1 = Point(firstpt_line1)
endpt0 = Point(endpt_line0)
endpt1 = Point(endpt_line1)
points_2 = PointList(Points=flatten(firstpt0), Size=Slider(0.109, range=0..3))
complex_10 = ComplexComponents(Complex=firstpt0)  # -> Real, Imaginary
complex_11 = ComplexComponents(Complex=firstpt1)  # -> Real, Imaginary
complex_12 = ComplexComponents(Complex=endpt1)  # -> Real, Imaginary
complex_13 = ComplexComponents(Complex=endpt0)  # -> Real, Imaginary
subtraction_20 = Subtraction(A=complex_11.Imaginary, B=complex_12.Imaginary)
subtraction_21 = Subtraction(A=complex_11.Real, B=complex_12.Real)
equals_25 = Equality(FirstNumber=subtraction_21, SecondNumber="0")  # -> Equality, Inequality
sift_52 = SiftPattern(List=complex_12.Real, SiftPattern=equals_25.Equality)  # -> Output0, Output1
subtraction_22 = Subtraction(A=complex_10.Imaginary, B=complex_13.Imaginary)
subtraction_23 = Subtraction(A=complex_10.Real, B=complex_13.Real)
equals_26 = Equality(FirstNumber=subtraction_23, SecondNumber="0")  # -> Equality, Inequality
sift_53 = SiftPattern(List=complex_10.Real, SiftPattern=equals_26.Equality)  # -> Output0, Output1
or_3 = GateOr(A=equals_26.Equality, B=equals_25.Equality)
combine_6 = CombineData(Input0=sift_53.Output1, Input1=sift_52.Output1)  # -> Result, Index
division_9 = Division(A=subtraction_20, B=subtraction_21)
division_10 = Division(A=subtraction_22, B=subtraction_23)
panel_143 = Panel("""处理k不存在的情况

写成函数
把坐标在相减后就分开来算""")
k1_2 = Number(division_10)
multiplication_9 = Multiplication(A=k1_2, B=complex_10.Real)
sift_54 = SiftPattern(List=k1_2, SiftPattern=equals_26.Equality)  # -> Output0, Output1
subtraction_24 = Subtraction(A=complex_10.Imaginary, B=multiplication_9)
b1_2 = Number(subtraction_24)
sift_55 = SiftPattern(List=b1_2, SiftPattern=equals_26.Equality)  # -> Output0, Output1
k2_2 = Number(division_9)
multiplication_10 = Multiplication(A=k2_2, B=complex_11.Real)
sift_56 = SiftPattern(List=k2_2, SiftPattern=equals_25.Equality)  # -> Output0, Output1
subtraction_25 = Subtraction(A=complex_11.Imaginary, B=multiplication_10)
combine_7 = CombineData(Input0=sift_54.Output0, Input1=sift_56.Output0)  # -> Result, Index
b2_3 = Number(subtraction_25)
sift_57 = SiftPattern(List=b2_3, SiftPattern=equals_25.Equality)  # -> Output0, Output1
combine_8 = CombineData(Input0=sift_55.Output0, Input1=sift_57.Output0)  # -> Result, Index
subtraction_26 = Subtraction(A=b2_3, B=b1_2)
b_5 = Number(combine_8.Result)
a_4 = Number(combine_6.Result)
k_5 = Number(combine_7.Result)
subtraction_27 = Subtraction(A=k1_2, B=k2_2)
sift_58 = SiftPattern(List=b_5, SiftPattern=or_3)  # -> Output0, Output1
multiplication_11 = Multiplication(A=a_4, B=k_5)
division_11 = Division(A=subtraction_26, B=subtraction_27)
multiplication_12 = Multiplication(A=division_11, B=k2_2)
addition_10 = Addition(A=multiplication_12, B=b2_3)
sift_59 = SiftPattern(List=addition_10, SiftPattern=or_3)  # -> Output0, Output1
addition_11 = Addition(A=multiplication_11, B=sift_58.Output1)
intersection_x_3 = Number(a_4)
intersection_y_3 = Number(addition_11)
combine_9 = CombineData(Input0=sift_59.Output0, Input1=intersection_y_3)  # -> Result, Index
combine_10 = CombineData(Input0=division_11, Input1=intersection_x_3)  # -> Result, Index
intersection_x_4 = Number(combine_10.Result)
intersection_y_4 = Number(combine_9.Result)
xy_2 = XYPlane(Origin=Point(0, 0, 0))
pt_6 = PointOriented(BasePlane=xy_2, UComponent=intersection_x_4, VComponent=intersection_y_4, WComponent=0)

# ----
# true --> real insection
# false --> extend
# 10,11 --> real insection
# 01       --> extend one line
# 00       --> extend two lines
# true   -- > extend one line
# false -->  extend two lines
dom_5 = ConstructDomain(DomainStart=complex_10.Imaginary, DomainEnd=complex_13.Imaginary)
dom_6 = ConstructDomain(DomainStart=complex_10.Real, DomainEnd=complex_13.Real)
dom_7 = ConstructDomain(DomainStart=complex_11.Real, DomainEnd=complex_12.Real)
dom_8 = ConstructDomain(DomainStart=complex_11.Imaginary, DomainEnd=complex_12.Imaginary)
firstpty_domain_2 = Domain(dom_5)
firstptx_domain_2 = Domain(dom_6)
endpty_domain_2 = Domain(dom_8)
endptx_domain_2 = Domain(dom_7)
inc_5 = Includes(Value=intersection_y_4, Domain=firstpty_domain_2)  # -> Includes, Deviation
inc_6 = Includes(Value=intersection_x_4, Domain=endptx_domain_2)  # -> Includes, Deviation
inc_7 = Includes(Value=intersection_y_4, Domain=endpty_domain_2)  # -> Includes, Deviation
inc_8 = Includes(Value=intersection_x_4, Domain=firstptx_domain_2)  # -> Includes, Deviation
or_4 = GateOr(A=inc_8.Includes, B=inc_5.Includes, C=inc_6.Includes, D=inc_7.Includes)
and_14 = GateAnd(A=inc_8.Includes, B=inc_5.Includes, C=inc_6.Includes, D=inc_7.Includes)
int_27 = Integer(or_4)
int_28 = Integer(and_14)
concat_5 = Concatenate(FragmentA=int_28, FragmentB=int_27)
panel_144 = Panel("""10
11
01
00""")
panel_145 = Panel("""0
0
1
2""")
keysearch_5 = KeyValueSearch(Keys=panel_144, Values=panel_145, Search=concat_5)
extendlinecount_2 = Integer(keysearch_5)

sift_60 = SiftPattern(List=pt_6, SiftPattern=extendlinecount_2)  # -> Output0, Output1, Output2
intersectionontwolines_2 = Point(sift_60.Output0)
intersectionononeline_2 = Point(sift_60.Output1)
intersectiononextend_2 = Point(sift_60.Output2)

# ----
# 计算点到边界的垂直向量
# describe space by (point;index) of vector
# 问题在于，当某一path缺少时，替换的内容仍然会配对，造成数据多余错误
# 要探测出缺少的路径
# statistics-->DePath
# 最后拍平后替换路径
line_length_3 = Panel("""3.2
5.1
3.2
5.1
6.4
10.2""")
panel_146 = Panel("""0
1
0
1
2
3""")
md_slider_2 = MDSlider(
    slider_value=Point(0.4899997711, 0.4549980164, 0.5),
    SliderMode=0,
    x_domain=Domain(0, 1),
    y_domain=Domain(0, 1),
    z_domain=Domain(0, 1))
panel_147 = Panel("""0
1
2
3""")
line_length_4 = Panel("""3.2
5.1
3.2
5.1""")
panel_148 = Panel("""用字符串的方法表示还差最后一步，那么先拆开来用判断的方法做
拆开的方法很繁琐，索性还是用字符串替换的方法
检查目前的替换方法是否可以简化
并且找出到各个边的距离最近点""")
line_length_5 = Number(line_length_4)
panel_149 = Panel("""1,0
0,1
-1,0
0,-1""")
vec_4 = Vector(panel_149)
int_29 = Integer(panel_147)
lng_13 = ListLength(List=int_29)
series_26 = Series(Start=0, Step=1, Count=lng_13)
item_65 = ListItem(List=vec_4, Index=int_29, Wrap=True)
panel_150 = Panel(item_65)
item_66 = ListItem(List=line_length_5, Index=series_26, Wrap=True)
basicvectorunit_2 = Vector(item_65)
amp_3 = Amplitude(Vector=basicvectorunit_2, Amplitude=item_66)
ma_9 = MassAddition(Input=amp_3)  # -> Result, PartialResults
addition_12 = Addition(A=md_slider_2, B=ma_9.PartialResults)
shift_12 = ShiftList(List=ma_9.PartialResults, Shift=-1, Wrap=True)
complex_14 = ComplexComponents(Complex=shift_12)  # -> Real, Imaginary
concat_6 = Concatenate(FragmentA=complex_14.Real, FragmentB=complex_14.Imaginary, JoinSeparator=",")
item_67 = ListItem(List=amp_3, Index=graft(series_26), Wrap=True)
panel_151 = Panel(ma_9.PartialResults)
concat_7 = Concatenate(FragmentA=concat_6, FragmentB=int_29, JoinSeparator=";")
item_68 = ListItem(List=concat_7, Index=series_26, Wrap=True)
split_17 = TextSplit(Text=item_68, Separators=";")  # -> simplify(Result)
item_69 = ListItem(List=split_17, Index=0, Wrap=True)  # -> Item, Item1
pt_7 = Point(item_69.Item)
addition_13 = Addition(A=pt_7, B=item_67)
firstpt0_2 = Point(item_69.Item)
endpt0_2 = Point(addition_13)
panel_152 = Panel(concat_7)
complex_15 = ComplexComponents(Complex=endpt0_2)  # -> Real, Imaginary
complex_16 = ComplexComponents(Complex=firstpt0_2)  # -> Real, Imaginary
pt_8 = Point(Point(1.488717773, 12.13872048, 0))
subtraction_28 = Subtraction(A=complex_16.Imaginary, B=complex_15.Imaginary)
subtraction_29 = Subtraction(A=complex_16.Real, B=complex_15.Real)
complex_17 = ComplexComponents(Complex=pt_8)  # -> Real, Imaginary
division_12 = Division(A=subtraction_28, B=subtraction_29)
k1_3 = Number(division_12)
multiplication_13 = Multiplication(A=k1_3, B=complex_15.Real)
subtraction_30 = Subtraction(A=complex_15.Imaginary, B=multiplication_13)
b1_3 = Number(subtraction_30)
panel_153 = Panel("abs(k*x0-y0+b)/sqrt(k*k+1)")
panel_154 = Panel("(k*x0-y0+b)/sqrt(k*k+1)")
panel_155 = Panel("-(k*x0-y0+b)/sqrt(k*k+1)")

y = Number(complex_17.Imaginary)
x = Number(complex_17.Real)
larger_6 = LargerThan(FirstNumber=complex_16.Real, SecondNumber=x)  # -> LargerThan, OrEqualTo
larger_7 = LargerThan(FirstNumber=complex_16.Imaginary, SecondNumber=y)  # -> LargerThan, OrEqualTo
int_30 = Integer(larger_6.LargerThan)
int_31 = Integer(larger_7.LargerThan)
concat_8 = Concatenate(FragmentA=int_30, FragmentB=int_31)

# ---- group: vector match concept Error
panel_156 = Panel("""010
012
110
112""")
panel_157 = Panel("""101
103
111
113""")
panel_158 = Panel("""001
003
011
013""")
panel_159 = Panel("""000
002
100
102""")
merge_15 = Merge(Data1=panel_157, Data2=panel_156, Data3=panel_158, Data4=panel_159)
entwine_2 = Entwine(Branch00=panel_157, Branch01=panel_156, Branch02=panel_158, Branch03=panel_159, FlattenInputs=True)  # -> simplify(Result)
concat_9 = Concatenate(FragmentA=concat_8, FragmentB=item_69.Item1)
flatten_39 = FlattenTree(Tree=concat_9, Path="{0}")
mindex_8 = MemberIndex(Set=merge_15, Member=flatten_39)  # -> Index, Count
division_13 = Division(A=mindex_8.Index, B="4")
int_32 = Integer(division_13)
item_70 = ListItem(List=vec_4, Index=int_32, Wrap=True)

# ----
pt_9 = Point(ma_9.PartialResults)
pline_2 = PolyLine(Vertices=pt_9, Closed=True)

# ---- group: vector match concept Error
mindex_9 = MemberIndex(Set=entwine_2, Member=flatten_39)  # -> Index, Count
clean_62 = CleanTree(RemoveNulls=True, RemoveInvalid=True, RemoveEmpty=True, Tree=mindex_9.Index)
tstat_45 = TreeStatistics(Tree=clean_62)  # -> Paths, Length, Count
split_18 = TextSplit(Text=tstat_45.Paths, Separators=";")
item_71 = ListItem(List=split_18, Index="0", Wrap=True)
split_19 = TextSplit(Text=item_71, Separators="{")
item_72 = ListItem(List=split_19, Index="1", Wrap=True)  # -> simplify(Item)

equals_27 = Equality(FirstNumber=graft(flatten_39), SecondNumber=merge_15)  # -> Equality, Inequality
mindex_10 = MemberIndex(Set=equals_27.Equality, Member=Toggle(True))  # -> Index, Count

# ----
# distances between points and space boundary
null = NullItem(Item=k1_3)  # -> NullFlags, InvalidFlags, Description
sift_61 = SiftPattern(List=pt_7, SiftPattern=null.NullFlags)  # -> Output0, Output1
complex_18 = ComplexComponents(Complex=sift_61.Output1)  # -> Real, Imaginary
eval_40 = Evaluate(F="abs(k*x0-y0+b)/sqrt(k*k+1)", k=k1_3, b=b1_3, x0=complex_17.Real, y0=complex_17.Imaginary)
subtraction_31 = Subtraction(A=complex_17.Real, B=complex_18.Real)  # -> simplify(Result)
distance = Number(eval_40)
abs_4 = Absolute(Value=subtraction_31)  # -> simplify(Result)
combine_11 = CombineData(Input0=distance, Input1=abs_4)  # -> Result, Index

# ---- group: vector match method 1
concat_10 = Concatenate(FragmentA=concat_8, FragmentB=item_69.Item1)
flatten_40 = FlattenTree(Tree=concat_10, Path="{0}")
panel_160 = Panel("""000
002
100
102""")
panel_161 = Panel("""010
012
110
112""")
panel_162 = Panel("""101
103
111
113""")
panel_163 = Panel("""001
003
011
013""")
mindex_11 = MemberIndex(Set=panel_163, Member=flatten_40)  # -> Index, Count
mindex_12 = MemberIndex(Set=panel_160, Member=flatten_40)  # -> Index, Count
mindex_13 = MemberIndex(Set=panel_162, Member=flatten_40)  # -> Index, Count
mindex_14 = MemberIndex(Set=panel_161, Member=flatten_40)  # -> Index, Count
clean_63 = CleanTree(RemoveNulls=True, RemoveInvalid=True, RemoveEmpty=True, Tree=mindex_14.Index)
clean_64 = CleanTree(RemoveNulls=True, RemoveInvalid=True, RemoveEmpty=True, Tree=mindex_12.Index)
clean_65 = CleanTree(RemoveNulls=True, RemoveInvalid=True, RemoveEmpty=True, Tree=mindex_13.Index)
clean_66 = CleanTree(RemoveNulls=True, RemoveInvalid=True, RemoveEmpty=True, Tree=mindex_11.Index)
replace_27 = ReplaceItems(List=clean_65, Item="0", Indices="0", Wrap=False)
replace_28 = ReplaceItems(List=clean_63, Item="1", Indices="0", Wrap=False)
replace_29 = ReplaceItems(List=clean_66, Item="2", Indices="0", Wrap=False)
replace_30 = ReplaceItems(List=clean_64, Item="3", Indices="0", Wrap=False)
merge_16 = Merge(Data1=replace_27, Data2=replace_28, Data3=replace_29, Data4=replace_30)
item_73 = ListItem(List=vec_4, Index=merge_16, Wrap=True)
amp_4 = Amplitude(Vector=item_73, Amplitude=combine_11.Result)
vdis_2 = VectorDisplay(Anchor=pt_8, Vector=amp_4)

# ---- group: vector match method 0 Error
# left-down;x-axis
# left-up;y-axis
a_5 = Number(complex_16.Real)
b_6 = Number(complex_16.Imaginary)
y_2 = Number(complex_17.Imaginary)
x_2 = Number(complex_17.Real)
item_74 = ListItem(List=vec_4, Index=item_69.Item1, Wrap=True)
smaller_4 = SmallerThan(FirstNumber=b_6, SecondNumber=y_2)  # -> SmallerThan, OrEqualTo
not = GateNot(A=smaller_4.SmallerThan)
smaller_5 = SmallerThan(FirstNumber=a_5, SecondNumber=x_2)  # -> SmallerThan, OrEqualTo
and_15 = GateAnd(A=smaller_5.SmallerThan, B=not)
equals_28 = Equality(FirstNumber="0", SecondNumber=graft(int_29))  # -> Equality, Inequality
equals_29 = Equality(FirstNumber="2", SecondNumber=graft(int_29))  # -> Equality, Inequality
and_16 = GateAnd(A=smaller_5.SmallerThan, B=smaller_4.SmallerThan)
equals_30 = Equality(FirstNumber="1", SecondNumber=graft(int_29))  # -> Equality, Inequality
equals_31 = Equality(FirstNumber="3", SecondNumber=graft(int_29))  # -> Equality, Inequality
or_5 = GateOr(A=equals_28.Equality, B=equals_29.Equality)
or_6 = GateOr(A=equals_30.Equality, B=equals_31.Equality)
and_17 = GateAnd(A=or_6, B=and_16)
and_18 = GateAnd(A=or_5, B=and_15)
or_7 = GateOr(A=and_17, B=and_18)
sift_62 = SiftPattern(List=item_74, SiftPattern=or_7)  # -> Output0, Output1
pi_11 = Pi(Factor="0.5")
Z = UnitZ(Factor=1)
neg_6 = Negative(Value=pi_11)
vrot = Rotate(Vector=sift_62.Output0, Axis=Z, Angle=neg_6)
vrot_2 = Rotate(Vector=sift_62.Output1, Axis=Z, Angle=pi_11)
combine_12 = CombineData(Input0=vrot, Input1=vrot_2)  # -> Result, Index
amp_5 = Amplitude(Vector=combine_12.Result, Amplitude=combine_11.Result)
vdis_3 = VectorDisplay(Anchor=pt_8, Vector=amp_5)

# ----
# vectors between points and space boundary
panel_164 = Panel("0.5")  # disabled
item_75 = ListItem(List=vec_4, Index=item_69.Item1, Wrap=True)  # disabled
pi_12 = Pi(Factor=panel_164)  # disabled
neg_7 = Negative(Value=pi_12)  # disabled
Z_2 = UnitZ(Factor=1)  # disabled
vrot_3 = Rotate(Vector=item_75, Axis=Z_2, Angle=neg_7)  # disabled
amp_6 = Amplitude(Vector=vrot_3, Amplitude=combine_11.Result)  # disabled

panel_165 = Panel(eval_40)
panel_166 = Panel(combine_11.Result)

# ---- group: vector match method 1 simplify
entwine_3 = Entwine(Branch00=panel_157, Branch01=panel_156, Branch02=panel_158, Branch03=panel_159, FlattenInputs=True)  # -> simplify(Result)
flatten_41 = FlattenTree(Tree=concat_10, Path="{0}")
mindex_15 = MemberIndex(Set=entwine_3, Member=flatten_41)  # -> Index, Count
clean_67 = CleanTree(RemoveNulls=True, RemoveInvalid=True, RemoveEmpty=True, Tree=mindex_15.Index)
pshift_39 = ShiftPaths(Data=clean_67, Offset=-1)
viewer_26 = ParamViewer(clean_67)

tstat_46 = TreeStatistics(Tree=pshift_39)  # -> Paths, Length, Count
dpath_12 = DeconstructPath(Branch=tstat_46.Paths)  # -> simplify(Indices)

graft_58 = GraftTree(Tree=tstat_46.Length, IncludeEmptyLists=True, IncludeNullItems=True)
series_27 = Series(Start=0, Step=1, Count=graft_58)
int_33 = Integer(simplify(series_27))
replace_31 = ReplaceItems(List=pshift_39, Item=dpath_12, Indices=int_33, Wrap=False)
graft_59 = GraftTree(Tree=flatten(replace_31), IncludeEmptyLists=True, IncludeNullItems=True)
viewer_27 = ParamViewer(graft_59)
replace_32 = ReplacePaths(Data=graft_59, Search=viewer_27, Replace=viewer_26)
pshift_40 = ShiftPaths(Data=replace_32, Offset="1")
item_76 = ListItem(List=vec_4, Index=pshift_40, Wrap=True)
amp_7 = Amplitude(Vector=item_76, Amplitude=combine_11.Result)
vdis_4 = VectorDisplay(Anchor=pt_8, Vector=amp_7)
