# Grasshopper definition 20161110_tim_graphics_fillArea_scanLine_002.gh (Grasshopper 0.9.76)

# ----
# 向量运算部分
genes = GenePool(Decimals=6, Maximum=50, Minimum=0, Value=[8.5769, 12.084605])
genes_2 = GenePool(Decimals=6, Maximum=50, Minimum=0, Value=[9.729951, 4.591837])
panel = Panel("""3
0
0
4""")
num = Number([genes, genes_2])
panel_2 = Panel("""0
1""")
panel_3 = Panel("""0
2""")
item = ListItem(List=num, Index=panel_3, Wrap=False)  # -> Item, Item1
item_2 = ListItem(List=num, Index=panel_3, Wrap=False)  # -> Item, Item1
complex = CreateComplex(Real=item.Item, Imaginary=item.Item1)
pt = PointOriented(BasePlane=PlaneXY(0, 0, 0), UComponent=0, VComponent=0, WComponent=0)
cmod = ComplexModulus(Complex=complex)
panel_4 = Panel("2.angleCos cos = u*v/|u|*|v|")
panel_5 = Panel("1.length:|u|2 = u*u")
cmod_2 = ComplexModulus(Complex=complex)
multiplication = Multiplication(A=item.Item, B=item.Item1)
panel_6 = Panel("3.")
vdis = VectorDisplay(Anchor=pt, Vector=complex)
sqr = Square(Value=cmod)
ma = MassAddition(Input=multiplication)  # -> Result, PartialResults
equals = Equality(FirstNumber=ma.Result, SecondNumber="0")  # -> Equality, Inequality
mm = MassMultiplication(Input=cmod_2)  # -> Result, PartialResults
item_3 = ListItem(List=["非正交", "正交"], Index=equals.Equality, Wrap=True)
division = Division(A=ma.Result, B=mm.Result)
sqr_2 = Square(Value=item.Item)
sqr_3 = Square(Value=item.Item1)
panel_7 = Panel(item_3)
addition = Addition(A=sqr_2, B=sqr_3)

# ----
# log:区域填充算法
# 20161110:
# 向量几何公式的gh实现
# 向量乘积：点积，差积，行列式
# 向量需要用时候再学习
# 
# 扫描线填色算法gh实现:
# n,x_array,y_array的形式给出多边形
# 扫描线给定有限元finite_distance从上而下求交点
# 左右顶点处理（考虑是否有限元法不会有此问题）
# 左:y1<y2<y3 y2-y1>0,y2-y3<0
# 右:y1>y2>y3 y2-y1<0,y2-y3>0
panel_8 = Panel("""{7.656903, 14.500688, 0.0}
{6.429437, -1.86552, 0.0}
{2.065114, -5.411532, 0.0}
{-5.367872, 0.521218, 0.0}
{1.724152, 5.294696, 0.0}
{-2.435593, 5.840236, 0.0}
{-1.753668, 10.136366, 0.0}""")

# ----
# include wheater In domain
x1 = Number(Slider(3.22, range=0..10))
y1 = Number(Slider(3.99, range=0..10))
y2 = Number(Slider(2.51, range=0..10))
x2 = Number(Slider(1.32, range=0..10))
y0 = Number(Slider(2.568001, range=0..5))
merge = Merge(Data1=y1, Data2=y2)
subtraction = Subtraction(A=x1, B=x2)
subtraction_2 = Subtraction(A=y1, B=y2)
division_2 = Division(A=subtraction_2, B=subtraction)
eval = Evaluate(F="(y1-y2)/(x1-x2)", x1=x1, y1=y1, x2=x2, y2=y2)
subtraction_3 = Subtraction(A=merge, B=y0)
multiplication_2 = Multiplication(A=x1, B=division_2)
smaller = SmallerThan(FirstNumber=subtraction_3, SecondNumber="0")  # -> SmallerThan, OrEqualTo
eval_2 = Evaluate(F="y-k*x", x=x1, y=y1, k=eval)
subtraction_4 = Subtraction(A=y1, B=multiplication_2)
int = Integer(smaller.SmallerThan)
eval_3 = Evaluate(F="(y0-b)/k", y0=y0, k=eval, b=eval_2)
subtraction_5 = Subtraction(A=y0, B=subtraction_4)
division_3 = Division(A=subtraction_5, B=division_2)
join = TextJoin(Text=int)
equals_2 = Equality(FirstNumber=join, SecondNumber="01")  # -> Equality, Inequality

txt = Text(panel_8)
complex_2 = ComplexComponents(Complex=txt)  # -> Real, Imaginary
lng = ListLength(List=panel_8)
finite_distance = Number(Slider(0.27758, range=0..1))
n = Integer(lng)
x_array = Number(complex_2.Real)
y_array = Number(complex_2.Imaginary)
sort = SortList(Keys=y_array)  # -> Keys, ValuesA
shift = ShiftList(List=y_array, Shift=[1, -1], Wrap=True)
x2_original = Number(x_array)
y2_original = Number(y_array)
# 左右顶点处理
# left:   y2-y1>0,y2-y3<0 -->10-->0
# right: y2-y1<0,y2-y3>0 -->01-->1
# down y2-y1<0,y2-y3<0-->00--> 2
# up    y2-y1>0,y2-y3>0-->11--> 3
# 研究凹凸性的一个方向
number = Number(shift)  # "y1,y3"
shift_2 = ShiftList(List=x_array, Shift=1, Wrap=True)
shift_3 = ShiftList(List=y_array, Shift=1, Wrap=True)
item_4 = ListItem(List=sort.Keys, Index="-1", Wrap=True)  # -> Item, Item1
dom = ConstructDomain(DomainStart=y1, DomainEnd=y2)
subtraction_6 = Subtraction(A=y2_original, B=number)
pshift = ShiftPaths(Data=shift_2, Offset=-1)
pshift_2 = ShiftPaths(Data=shift_3, Offset=-1)
subtraction_7 = Subtraction(A=item_4.Item, B=item_4.Item1)
division_4 = Division(A=subtraction_7, B=finite_distance)
inc = Includes(Value=y0, Domain=dom)  # -> Includes, Deviation
int_2 = Integer(division_4)
larger = LargerThan(FirstNumber=subtraction_6, SecondNumber="0")  # -> LargerThan, OrEqualTo
subtraction_8 = Subtraction(A=y_array, B=pshift_2)
subtraction_9 = Subtraction(A=x_array, B=pshift)
neg = Negative(Value=finite_distance)
addition_2 = Addition(A=int_2, B=2)
int_3 = Integer(larger.LargerThan)
dom_2 = ConstructDomain(DomainStart=y_array, DomainEnd=pshift_2)
division_5 = Division(A=subtraction_8, B=subtraction_9)
panel_9 = Panel("""-1
1
0
0""")
series = Series(Start=item_4.Item, Step=neg, Count=addition_2)
panel_10 = Panel(equals_2.Equality)
flip = FlipMatrix(Data=int_3)
panel_11 = Panel("""10
01
00
11""")
k = Number(division_5)
ins = InsertItems(List=series, Item=y_array, Indices="0", Wrap=True)
y0_2 = Number(ins)
join_2 = TextJoin(Text=flip)
replace = ReplaceMembers(Set=join_2, Find=panel_11, Replace=panel_9)  # -> flatten(Result)
k_2 = Number(k)
graft = GraftTree(Tree=y0_2, IncludeEmptyLists=True, IncludeNullItems=True)
inc_2 = Includes(Value=graft, Domain=dom_2)  # -> Includes, Deviation
sift = SiftPattern(List=k, SiftPattern=inc_2.Includes)  # -> Output0, Output1
multiplication_3 = Multiplication(A=x_array, B=sift.Output1)
division_6 = Division(A="1", B=k_2)
subtraction_10 = Subtraction(A=y_array, B=multiplication_3)
multiplication_4 = Multiplication(A=division_6, B=replace)
subtraction_11 = Subtraction(A=graft, B=subtraction_10)
panel_12 = Panel(ins)
addition_3 = Addition(A=x2_original, B=multiplication_4)
addition_4 = Addition(A=y2_original, B=replace)
division_7 = Division(A=subtraction_11, B=sift.Output1)

pt_2 = Point(panel_8)
pline = PolyLine(Vertices=pt_2, Closed=True)
points = PointList(Points=panel_8, Size=Slider(3, range=0..10))
complex_3 = CreateComplex(Real=division_7, Imaginary=graft)
pt_3 = Point(complex_3)

clean = CleanTree(RemoveNulls=True, RemoveInvalid=True, RemoveEmpty=False, Tree=pt_3)
item_5 = ListItem(List=clean, Index=0, Wrap=True)  # -> Item, Item1
x2_after_revise = Number(addition_3)
y2_after_revise = Number(addition_4)
panel_13 = Panel(graft)
ln = Line(StartPoint=item_5.Item, EndPoint=item_5.Item1)
panel_14 = Panel(item_5.Item)
panel_15 = Panel(ln)
