# Grasshopper definition 20161017_sortList_gh_python.gh (Grasshopper 0.9.76)
# plug-ins: Python Interpreter

pt = Point([Point(7, -9, 0), Point(-12, -6, 0), Point(-2, -2, 0), Point(18, -4, 0), Point(12, 4, 0), Point(-8, 4, 0), Point(1, 9, 0), Point(16, 9, 0)])
series = Series(Start=Slider(7, range=0..10), Step=Slider(3, range=0..10), Count=Slider(4, range=0..10))
panel = Panel(pt)
jitter = Jitter(List=series, Jitter=1, Seed=Slider(33.22, range=0..100))  # -> Values, Indices
lng = ListLength(List=pt)
pt_2 = Point([Point(7, -9, 0), Point(-12, -6, 0), Point(-2, -2, 0), Point(18, -4, 0), Point(12, 4, 0), Point(-8, 4, 0), Point(1, 9, 0), Point(16, 9, 0)])
complex = ComplexComponents(Complex=pt)  # -> Real, Imaginary
rev = ReverseList(List=jitter.Values)
series_2 = Series(Start=0, Step=1, Count=lng)
panel_2 = Panel("""0
5
-1
3
4
2
1""")
num = Number(flatten(rev))
lng_2 = ListLength(List=num)
series_3 = Series(Start=0, Step=1, Count=lng_2)
jitter_2 = Jitter(List=series_3, Jitter=1, Seed=Slider(18.61, range=0..100))  # -> Values, Indices
rev_2 = ReverseList(List=series_3)
num_2 = Number(flatten(series_3))
python = PythonScript(x=panel_2, pts=pt_2)  # -> out, a, b; inputs x: list, y: list, pts: list
# ---------- python: Python ----------
from rhinoscriptsyntax import coerce3dpointlist
help(sorted)
#sort float
a = sorted(x)

#sort strings
def myKey(s):
    return s[0]
    
s0 = ['amy','cname','dis','btim']
s1 = sorted(s0,key = myKey)
print (s1)

#sort points
pts_3d = coerce3dpointlist(pts)
#print (pts_3d[1])
def getPtKey(pt):
    return pt[1]
    
ptSorted_list = sorted(pts_3d,key = getPtKey)
print (ptSorted_list)
b = ptSorted_list
# ---------- end python ----------
sort = SortList(Keys=complex.Real, ValuesA=pt)  # -> Keys, ValuesA
panel_3 = Panel(num)
panel_4 = Panel(num_2)
sort_2 = SortList(Keys=num_2, ValuesA=num)  # -> Keys, ValuesA
panel_5 = Panel(python.a)
panel_6 = Panel(sort.Keys)
panel_7 = Panel(sort.ValuesA)
panel_8 = Panel(sort_2.Keys)
panel_9 = Panel(sort_2.ValuesA)
panel_10 = Panel(python.b)
