# Grasshopper definition 160913_haystack_001_input.gh (Grasshopper 0.9.76)

file = ReadFile(File="E:/tim/prac/py/class/haystack/data.txt", PerLineParse=True)
chars = Characters()  # -> Result, Unicode
split = TextSplit(Text=file, Separators="*")
shift = ShiftList(List=split, Shift=-1, Wrap=False)
null = NullItem(Item=split)  # -> NullFlags, InvalidFlags, Description
split_2 = TextSplit(Text=shift, Separators=":")  # -> simplify(Result)
item = ListItem(List=split_2, Index="0", Wrap=True)
item_2 = ListItem(List=split_2, Index="1", Wrap=True)
split_3 = TextSplit(Text=item_2, Separators=";")  # -> simplify(Result)
item_3 = ListItem(List=split_3, Index="0", Wrap=True)
item_4 = ListItem(List=split_3, Index="1", Wrap=True)
split_4 = TextSplit(Text=item_3, Separators=",")  # -> simplify(Result)
item_5 = ListItem(List=split_4, Index=0, Wrap=True)  # -> Item, Item1, Item2
pt = ConstructPoint(XCoordinate=item_5.Item, YCoordinate=item_5.Item1, ZCoordinate=item_5.Item2)
cir = Circle(Plane=pt, Radius=item_4)
panel = Panel(split_4)
panel_2 = Panel(cir)
